# Dynamo graph AAAAAAAAAA.dyn (Dynamo 2.3.0.5885)
# packages: Clockwork for Dynamo 2.x 2.3.0

select_face = DSFaceSelection()  # 1 picked in the model
perimeterCurves = Surface.PerimeterCurves(surface=select_face)
flatten = List.Flatten(list=perimeterCurves)
current = Document.Current()
activeView = Document.ActiveView(document=current)
byCurve = Custom[DetailCurve.ByCurve+](curve=flatten, view=activeView)  # package Clockwork for Dynamo 2.x; Creates a detail line based on a given curve. Unlike the OOTB node it can also draw circles.
code_block = CodeBlock { 3; }
