# Dynamo graph AreaBoundary_FromFaceAndSelectedLines.dyn (Dynamo 2.3.0.5885)

select_face = DSFaceSelection()  # 1 picked in the model
perimeterCurves = Surface.PerimeterCurves(surface=select_face)
flatten = List.Flatten(list=perimeterCurves)
byJoinedCurves = PolyCurve.ByJoinedCurves(curves=flatten)
boolean = BoolSelector(true)
python_script = Python(IN[0]=boolean)
# ---------- python_script.python (31 lines) ----------
import clr

clr.AddReference("RevitAPIUI")
from  Autodesk.Revit.UI import *

clr.AddReference("RevitServices")
import RevitServices
from RevitServices.Persistence import DocumentManager
doc = DocumentManager.Instance.CurrentDBDocument
uidoc=DocumentManager.Instance.CurrentUIApplication.ActiveUIDocument

clr.AddReference("RevitNodes")
import Revit
clr.ImportExtensions(Revit.Elements)



sel1 = uidoc.Selection
obt1 = Selection.ObjectType.Element
msg1 = 'SELECCIONA LOS OBJETOS DE 2 CATEGORIAS A UNIR, PRESIONA "ESC"PARA SALIR.'
out1 = []

flag = True
TaskDialog.Show("Springall + MK", msg1)
while flag:
	try:
		el1 = doc.GetElement(sel1.PickObject(obt1, msg1).ElementId)
		out1.append(el1.ToDSType(True))
	except : flag = False

OUT = out1
# ----------------------------------------
geometry = Element.Geometry(element=python_script)
flatten_2 = List.Flatten(list=geometry)
ZAxis = Vector.ZAxis()
code_block = CodeBlock { 8000; }
extrude = Curve.Extrude(curve=flatten_2, direction=ZAxis, distance=code_block)
intersect = Geometry.Intersect(geometry=byJoinedCurves, other=extrude)
flatten_3 = List.Flatten(list=intersect)
integer_slider = IntegerSlider(5083, range=0..10000 step 1)
code_block_2 = CodeBlock(number=integer_slider) { 0..1..#number; }
pointAtParameter = Curve.PointAtParameter(curve=byJoinedCurves, param=code_block_2)
code_block_3 = CodeBlock { 1; }
boolean_2 = BoolSelector(true)
byControlPoints = NurbsCurve.ByControlPoints(points=pointAtParameter, degree=code_block_3, closeCurve=boolean_2)
