# Dynamo graph AreaBoundary_From_Curves.dyn (Dynamo 2.3.0.5885)
# packages: Clockwork for Dynamo 2.x 2.3.0

select_model_elements = DSModelElementsSelection()  # 1 picked in the model; graph input
geometry = Element.Geometry(element=select_model_elements)
flatten = List.Flatten(list=geometry)
byJoinedCurves = PolyCurve.ByJoinedCurves(curves=flatten)
integer_slider = IntegerSlider(60, range=0..200 step 1)  # graph input
code_block = CodeBlock(cc=integer_slider) { 0..1..#cc; }
pointAtParameter = Curve.PointAtParameter(curve=byJoinedCurves, param=code_block)
byPoints = PolyCurve.ByPoints(points=pointAtParameter)
curves = PolyCurve.Curves(polyCurve=byPoints)
levels = Levels("Level 121 Gentlemen's")  # graph input
plane = Custom[Level.Plane](level=levels)  # package Clockwork for Dynamo 2.x; Retrieves the plane of a given level
byPlane = SketchPlane.ByPlane(plane=plane)
current = Document.Current()
activeView = Document.ActiveView(document=current)
python_script = Python(IN[0]=curves, IN[1]=byPlane, IN[2]=activeView)
# ---------- python_script.python (29 lines) ----------
import clr
clr.AddReference('RevitAPI')
from Autodesk.Revit.DB import *

clr.AddReference("RevitNodes")
import Revit
clr.ImportExtensions(Revit.GeometryConversion)

clr.AddReference("RevitServices")
import RevitServices
from RevitServices.Persistence import DocumentManager
from RevitServices.Transactions import TransactionManager

doc = DocumentManager.Instance.CurrentDBDocument
curves = UnwrapElement(IN[0])
sketchplane = UnwrapElement(IN[1])
view = UnwrapElement(IN[2])
elementlist = list()

if str(view.ViewType) == "AreaPlan":
	TransactionManager.Instance.EnsureInTransaction(doc)
	doccreation = doc.Create
	for curve in curves:
		separator = doccreation.NewAreaBoundaryLine(sketchplane, curve.ToRevitType(), view)
		elementlist.append(separator)
	TransactionManager.Instance.TransactionTaskDone()
else:
	elementlist = list("The active view needs to be an area plan...")
OUT = elementlist
# ----------------------------------------
