# Dynamo graph AreaBoundary_From_Face.dyn (Dynamo 2.3.0.5885)
# packages: Clockwork for Dynamo 2.x 2.3.0

select_face = DSFaceSelection()  # 1 picked in the model
perimeterCurves = Surface.PerimeterCurves(surface=select_face)
flatten = List.Flatten(list=perimeterCurves)
levels = Levels("Level 121 Gentlemen's")
plane = Custom[Level.Plane](level=levels)  # package Clockwork for Dynamo 2.x; Retrieves the plane of a given level
byPlane = SketchPlane.ByPlane(plane=plane)
current = Document.Current()
activeView = Document.ActiveView(document=current)
fromCurve = Custom[AreaSeparator.FromCurve](curve=flatten, sketchPlane=byPlane, areaPlanView=activeView)  # package Clockwork for Dynamo 2.x; Creates area separation lines from geometry curves.
