# Dynamo graph SetParameters.dyn (Dynamo 2.3.0.5885)

# group: get walltypes and default material
element_types = ElementTypes("WallType")
all_elements_of_type = ElementsOfType(element_type=element_types)
uniqueItems = List.UniqueItems(list=all_elements_of_type)
categories = Categories("OST_Materials")
all_elements_of_category = ElementsOfCategory(Category=categories)
code_block = CodeBlock(l=all_elements_of_category) { l[0]; }
python_script = Python(IN[0]=uniqueItems, IN[1]=code_block)
# ---------- python_script.python (74 lines) ----------
# Enable Python support and load DesignScript library
import clr
clr.AddReference('ProtoGeometry')
from Autodesk.DesignScript.Geometry import *

clr.AddReference("RevitNodes")

import Revit
clr.ImportExtensions(Revit.Elements)
clr.AddReference("RevitServices")

import RevitServices
from RevitServices.Persistence import DocumentManager
from RevitServices.Transactions import TransactionManager

clr.AddReference("RevitAPI")
from Autodesk.Revit.DB import *
import System


def GetBasicWalls(walltypes):
	a = []
	for wtype in walltypes:
		if(WallKind.Basic == wtype.Kind):
			a.append(wtype)
	return a
	
def GetCSruct(basicwalltypes):
	b = []
	for i in basicwalltypes:
		b.append(i.GetCompoundStructure())
	return b

def GetStructureLayers(compoundST):
	h = []
	for i in compoundST:
		
		h.append(i.GetLayers())
	
	return h


doc = DocumentManager.Instance.CurrentDBDocument

WallTypes = UnwrapElement(IN[0])

basicWalls = GetBasicWalls(WallTypes)
CStruct = GetCSruct(basicWalls)
layers = GetStructureLayers(CStruct)
A = []
B = []
C = []
for i in layers:
	mm = []
	bb = []
	cc = []
	for a in i:
		
		Mat = doc.GetElement(a.MaterialId)
		
		if(None == Mat):
			Mat = UnwrapElement(IN[1])
			mm.append(Mat)
			bb.append(a.LayerId)
			cc.append(a)
		else:
			mm.append(Mat)
			bb.append(a.LayerId)
			cc.append(a)
	A.append(mm)
	B.append(bb)
	C.append(cc)

OUT = A,basicWalls,B,C
# ----------------------------------------

code_block_2 = CodeBlock { 3; }
getItemAtIndex = List.GetItemAtIndex(list=python_script, index=code_block_2)
code_block_3 = CodeBlock { 1; }
lista_de_walltypes = List.GetItemAtIndex(list=python_script, index=code_block_3)
code_block_4 = CodeBlock { 0; }
lista_de_materiales = List.GetItemAtIndex(list=python_script, index=code_block_4)
code_block_5 = CodeBlock { "Mark"; }
getParameterValueByName = Element.GetParameterValueByName(element=lista_de_materiales, parameterName=code_block_5)
marks_sin_data = Python(IN[0]=getParameterValueByName)
# ---------- marks_sin_data.python (21 lines) ----------
# Load the Python Standard and DesignScript Libraries
import sys
import clr
clr.AddReference('ProtoGeometry')
from Autodesk.DesignScript.Geometry import *

MARKS = IN[0]
rr = []
for i in MARKS:
	o = []
	for b in i:
		if "" == b:
			o.append("NULL")
		else:
			o.append(b)
	rr.append(o)
			

			
	
OUT = rr
# ----------------------------------------
code_block_6 = CodeBlock { 2; }

# group: data structure main
python_script_2 = Python(IN[0]=getItemAtIndex)
# ---------- python_script_2.python (32 lines) ----------
# Enable Python support and load DesignScript library
import clr
clr.AddReference('ProtoGeometry')
from Autodesk.DesignScript.Geometry import *

clr.AddReference("RevitNodes")

import Revit
clr.ImportExtensions(Revit.Elements)
clr.AddReference("RevitServices")

import RevitServices
from RevitServices.Persistence import DocumentManager
from RevitServices.Transactions import TransactionManager

clr.AddReference("RevitAPI")
from Autodesk.Revit.DB import *
import System

doc = DocumentManager.Instance.CurrentDBDocument
funciones = UnwrapElement(IN[0])


a = []
for funcion in funciones:
	h = []	
	for func in funcion:
		h.append(func.Function)
		
	a.append(h)

OUT = a
# ----------------------------------------
indexes_of_layers = List.GetItemAtIndex(list=python_script, index=code_block_6)
python_script_3 = Python(IN[0]=getItemAtIndex, IN[1]=marks_sin_data, IN[2]=indexes_of_layers)
# ---------- python_script_3.python (41 lines) ----------
# Enable Python support and load DesignScript library
import clr
clr.AddReference('ProtoGeometry')
from Autodesk.DesignScript.Geometry import *

clr.AddReference("RevitNodes")

import Revit
clr.ImportExtensions(Revit.Elements)
clr.AddReference("RevitServices")

import RevitServices
from RevitServices.Persistence import DocumentManager
from RevitServices.Transactions import TransactionManager

clr.AddReference("RevitAPI")
from Autodesk.Revit.DB import *
import System

doc = DocumentManager.Instance.CurrentDBDocument
funciones = UnwrapElement(IN[0])
marks = IN[1]
indices = IN[2]


a = []
for funcion,marcas,indises in zip(funciones,marks,indices):
	h = []	
	for func,mark,indi in zip(funcion,marcas,indises):
		
		if(func.Function == MaterialFunctionAssignment.Structure):
			
			h.append(indi)
			
			continue
		
		
		
	a.append(h)

OUT = a
# ----------------------------------------
flatten = List.Flatten(list=python_script_3)

# group: engine
python_script_4 = Python(IN[0]=getItemAtIndex, IN[1]=marks_sin_data, IN[2]=indexes_of_layers, IN[3]=flatten)
# ---------- python_script_4.python (58 lines) ----------
# Enable Python support and load DesignScript library
import clr
clr.AddReference('ProtoGeometry')
from Autodesk.DesignScript.Geometry import *

clr.AddReference("RevitNodes")

import Revit
clr.ImportExtensions(Revit.Elements)
clr.AddReference("RevitServices")

import RevitServices
from RevitServices.Persistence import DocumentManager
from RevitServices.Transactions import TransactionManager

clr.AddReference("RevitAPI")
from Autodesk.Revit.DB import *
import System

doc = DocumentManager.Instance.CurrentDBDocument
funciones = UnwrapElement(IN[0])
marks = IN[1]
indices = IN[2]

numerosest = IN[3]

a = []
for funcion,marcas,indises in zip(funciones,marks,indices):
	contador = 0
	
	h = []	
	for func,mark,indi in zip(funcion,marcas,indises):
		contador +=1
		if(func.Function == MaterialFunctionAssignment.Structure):
			valor = "StructureAXM" + "_" + mark 
			h.append(valor)
			numero = indi
			
		elif(func.Function == MaterialFunctionAssignment.Finish1):
			
			if(func.LayerId < numerosest[contador]):
				h.append("Finish1AXM" + "_" + mark)
				
			else:
				h.append("Finish1AAXM" + "_" + mark)
				
		elif(func.Function == MaterialFunctionAssignment.Finish2):
			if(func.LayerId < numerosest[contador]):
				h.append("Finish2AXM" + "_ " + mark)
			else:
				h.append("Finish2AAXM" + "_" + mark)
		elif(func.Function == MaterialFunctionAssignment.Insulation):
			h.append("InsulationAXM" + "_" + mark)
		
		
	a.append(h)

OUT = a
# ----------------------------------------

count = List.Count(list=python_script_4@L2)
ofRepeatedItem = List.OfRepeatedItem(item=lista_de_walltypes@L1, amount=count@L1)
walltypes = List.Flatten(list=ofRepeatedItem)
code_block_7 = CodeBlock { "_"; }
split = String.Split(str=python_script_4, separator0=code_block_7)
code_block_8 = CodeBlock { 0; }
parameternames = List.GetItemAtIndex(list=split@L2, index=code_block_8)
code_block_9 = CodeBlock { 1; }
parameter_values = List.GetItemAtIndex(list=split@L2, index=code_block_9)
setParameterByName = Element.SetParameterByName(element=walltypes, parameterName=parameternames, value=parameter_values)  # frozen
