# Dynamo graph CanopiesAreaBoundaries2DetailCurves.dyn (Dynamo 2.3.0.5885)

current = Document.Current()
activeView = Document.ActiveView(document=current)
select_model_elements = DSModelElementsSelection()  # 1859 picked in the model
curve = CurveElement.Curve(curveElement=select_model_elements)
byCurve = DetailCurve.ByCurve(view=activeView, curve=curve)
