# Dynamo graph Clean Override Elements.dyn (Dynamo 2.0.3.8104)

# group: USER INTERFACE ()
code_block = CodeBlock { "CLASH MASTER || OVERRIDE SETTINGS"; }
file_path = Filename("..\..\UI\s+mk.png")
code_block_2 = CodeBlock { "LIMPIAR ELEMENTOS EN VISTA"; }
code_block_3 = CodeBlock { "CATEGORIAS"; }
categories_list = Custom[Categories list]()  # Gives list of all Revit categories and a matching list of their names
ui_dropdown_data = Custom[UI.DropDown Data](InputName=code_block_3, Keys=categories_list.Category_name_s, Values=categories_list.Category_name_s)  # Create data for DropDown input in UI.MultiInputForm ++ . Check out www.data-shapes.net for more infos.
boolean = BoolSelector(true)

code_block_4 = CodeBlock { "RESET VIEW"; }
boolean_2 = BoolSelector(true)
ui_boolean_input = Custom[UI.Boolean input](InputName=code_block_4, DefaultValue=boolean_2)  # Creates a boolean input for UI.MultipleInputForm ++ . Check out www.data-shapes.net for more infos!
code_block_5 = CodeBlock(A=ui_dropdown_data, B=ui_boolean_input) { L=[A,B]; }

# group (continued): USER INTERFACE ()
ui_multipleinputform = Custom[UI.MultipleInputForm ++](Description_optional=code_block, Logo_optional=file_path, ButtonText_optional=code_block_2, Inputs=code_block_5, Toggle=boolean)  # Create a form with multiple inputs. see www.data-shapes.net for tutorials and infos!

code_block_6 = CodeBlock(L=ui_multipleinputform.User_Inputs) { L[0]; }
byName = Category.ByName(name=code_block_6)
all_elements_of_category = ElementsOfCategory(Category=byName)
python_script = Python(IN[0]=boolean)
# ---------- python_script.python (14 lines) ----------
#Copyright(c) 2016, Dimitar Venkov
# @5devene, dimitar.ven@gmail.com

import clr

clr.AddReference("RevitServices")
import RevitServices
from RevitServices.Persistence import DocumentManager
doc = DocumentManager.Instance.CurrentDBDocument
clr.AddReference("RevitNodes")
import Revit
clr.ImportExtensions(Revit.Elements)

OUT = doc.ActiveView
# ----------------------------------------
resetElementOverrides = Custom[View.ResetElementOverrides](element=all_elements_of_category, view=python_script)  # Resets all overrides for an element in a given view
