# Dynamo graph Model2Link.dyn (Dynamo 2.0.3.8810)

getDocuments = archilab.Revit.Selection.Select.GetDocuments()

# group: BASED FRONT/END
code_block = CodeBlock { "VIEW CLASH DETECTION"; }
file_path = Filename("..\..\UI\s+mk.png")
code_block_2 = CodeBlock { "RUN INTERFERENCE CHECK"; }

code_block_3 = CodeBlock { "INTERFERENCE CHECKER COLOR OVERRIDE"; }
file_path_2 = Filename("..\..\UI\conexion.png")
ui_image_data = Custom[UI.Image Data](ImageTitle=code_block_3, Image=file_path_2)  # Places an image on UI.MultipleInutForm ++ .
code_block_4 = CodeBlock { "Linked Models List"; }
ui_dropdown_data = Custom[UI.DropDown Data](InputName=code_block_4, Keys=getDocuments.Link_Name, Values=getDocuments.Link_Name)  # Create data for DropDown input in UI.MultiInputForm ++ . Check out www.data-shapes.net for more infos.
code_block_5 = CodeBlock { "Linked Model Categories"; }
categories_list = Custom[Categories list]()  # Gives list of all Revit categories and a matching list of their names
ui_dropdown_data_2 = Custom[UI.DropDown Data](InputName=code_block_5, Keys=categories_list.Category_name_s, Values=categories_list.Category_name_s)
code_block_6 = CodeBlock { "Host Model Categories"; }
ui_dropdown_data_3 = Custom[UI.DropDown Data](InputName=code_block_6, Keys=categories_list.Category_name_s, Values=categories_list.Category_name_s)
code_block_7 = CodeBlock { "CLASHED ELEMENTS OVERRIDE COLOR"; }
code_block_8 = CodeBlock { "PICK A COLOR"; }
ui_colorinput_data = Custom[UI.ColorInput Data](InputName=code_block_7, ButtonText=code_block_8)  # Create a color selection input for UI.MultiInputForm++ . Check out www.data-shapes.net for more infos! Warning : Only works with Revit 2017
code_block_9 = CodeBlock { "TRANSPARENCY"; }
code_block_10 = CodeBlock { 0; 100; }
code_block_11 = CodeBlock { 20; }
slider = Custom[UI.Slider](InputName=code_block_9, Minimum=code_block_10.out0, Maximum=code_block_10.out1, Default_Value=code_block_11)  # Creates slider input for UI.MultipleInputForm ++ . Set the step to decimal value if you want a double slider, or to a integer value if you want an integer slider.
code_block_12 = CodeBlock { "GUARDAR EXCEL"; "NOMBRE DE LA HOJA"; }
file_path_3 = Filename("C:\Users\Admin\3D Objects\TEST.xlsx")
code_block_13 = CodeBlock { "BUSCAR"; }
filepath_data = Custom[FilePath Data](InputName=code_block_12.out0, DefaulPath=file_path_3, ButtonText=code_block_13)  # Create filepath input for UI.MultipleInputForm ++ . Check out www.data-shapes.net for more infos !
code_block_14 = CodeBlock { "Hoja1"; }
textbox_data = Custom[TextBox Data](InputName=code_block_12.out1, DefaultText=code_block_14)  # Create Data for TextBox input in UI.MultipleInputForm ++ . Check out www.data-shapes.net for more informations
list_create = List.Create(item0=ui_image_data, item1=ui_dropdown_data, item2=ui_dropdown_data_2, item3=ui_dropdown_data_3, item4=ui_colorinput_data, item5=slider, item6=filepath_data, item7=textbox_data)
boolean = BoolSelector(true)
ui_multipleinputform = Custom[UI.MultipleInputForm ++](Description_optional=code_block, Logo_optional=file_path, ButtonText_optional=code_block_2, Inputs=list_create, Toggle=boolean)  # Create a form with multiple inputs. see www.data-shapes.net for tutorials and infos!

# group: GET LINKED ELEMENTS BY HOST VIEW & CATEGORY FILTER
code_block_15 = CodeBlock { 0; 1; }
getItemAtIndex = List.GetItemAtIndex(list=ui_multipleinputform.User_Inputs, index=code_block_15.out0)
string_from_object = FromObject(obj=getDocuments.Link_Name)
eq = getItemAtIndex == string_from_object
filterByBoolMask = List.FilterByBoolMask(list=getDocuments.Link_Instance, mask=eq)
getItemAtIndex_2 = List.GetItemAtIndex(list=ui_multipleinputform.User_Inputs, index=code_block_15.out1)
byName = Category.ByName(name=getItemAtIndex_2)
ofCategory = Revit.LinkElement.OfCategory(linkInstance=filterByBoolMask.in, Category=byName)

# group: GET HOST ELEMENTS OF CATEGORY
code_block_16 = CodeBlock { 2; }
getItemAtIndex_3 = List.GetItemAtIndex(list=ui_multipleinputform.User_Inputs, index=code_block_16)
byName_2 = Category.ByName(name=getItemAtIndex_3)
all_elements_of_category = ElementsOfCategory(Category=byName_2)
flatten = List.Flatten(list=all_elements_of_category)

# group: CLASHING AND NOT CLASING ELEMENTS
intersectsElement = Revit.Element.IntersectsElement(elementSetA=ofCategory, elementSetB=flatten)
isEmpty = List.IsEmpty(list=intersectsElement.Element@L2)
filterByBoolMask_2 = List.FilterByBoolMask(list=intersectsElement.Element@L3, mask=isEmpty)
flatten_2 = List.Flatten(list=filterByBoolMask_2.out)
python_script = Python(IN[0]=flatten_2, IN[1]=flatten)
# ---------- python_script.python (35 lines) ----------
import clr
clr.AddReference('RevitAPI')
from Autodesk.Revit.DB import *

clr.AddReference("RevitNodes")
import Revit
clr.ImportExtensions(Revit.Elements)

clr.AddReference("RevitServices")
import RevitServices
from RevitServices.Persistence import DocumentManager
from RevitServices.Transactions import TransactionManager

doc = DocumentManager.Instance.CurrentDBDocument

xwalls = UnwrapElement(IN[0])
walls = UnwrapElement(IN[1])

a = []
b = []
f = []

for wa in xwalls:
	res = wa.Id
	a.append(res)


for el in walls:
	re = el.Id
	if re in a:
		b.append(el)
	else:
		f.append(el)

OUT = f
# ----------------------------------------

# group: OVERRIDE ELEMENTS SETTINGS
code_block_17 = CodeBlock { 3; }
getItemAtIndex_4 = List.GetItemAtIndex(list=ui_multipleinputform.User_Inputs, index=code_block_17)
python_script_2 = Python(IN[0]=getItemAtIndex_4)
# ---------- python_script_2.python (24 lines) ----------
import clr
clr.AddReference('RevitAPI')
from Autodesk.Revit.DB import *

clr.AddReference("RevitNodes")
import Revit
clr.ImportExtensions(Revit.Elements)

clr.AddReference("RevitServices")
import RevitServices
from RevitServices.Persistence import DocumentManager
from RevitServices.Transactions import TransactionManager

doc = DocumentManager.Instance.CurrentDBDocument

red = IN[0].Red
blue = IN[0].Blue
green = IN[0].Green

ll = [red,green,blue]



OUT = ll
# ----------------------------------------
code_block_18 = CodeBlock(L=python_script_2) { L[0]; L[1]; L[2]; }
byARGB = Color.ByARGB(r=code_block_18.out0, g=code_block_18.out1, b=code_block_18.out2)
code_block_19 = CodeBlock { 4; }
getItemAtIndex_5 = List.GetItemAtIndex(list=ui_multipleinputform.User_Inputs, index=code_block_19)

# group: COLOR GRAPHIC OVERRIDES BY CLASHING ELEMENTS ()
boolean_2 = BoolSelector(true)
ꟿ_document_activeview = Custom[ꟿ Document.ActiveView](refresh=boolean_2)  # Selects the current document's active view. Supports more view types than the built-in option. Will be depreciated once the bult in node works with all plan types.
resetElementOverrides = Custom[View.ResetElementOverrides](element=python_script, view=ꟿ_document_activeview)  # Resets all overrides for an element in a given view
fill_patterns = FillPatterns(index=0)
byProperties = Revit.Filter.OverrideGraphicSettings.ByProperties(projectionFillColor=byARGB, projectionLineColor=byARGB, projectionFillPattern=fill_patterns, transparency=getItemAtIndex_5)
overrideInView = Element.OverrideInView(element=flatten_2, overrides=byProperties)
flatten_3 = List.Flatten(list=overrideInView)
python_script_3 = Python(IN[0]=flatten_3)
# ---------- python_script_3.python (31 lines) ----------
import clr
clr.AddReference('RevitAPI')
from Autodesk.Revit.DB import *

clr.AddReference("RevitAPIUI")
from Autodesk.Revit.UI import *

clr.AddReference("RevitNodes")
import Revit
clr.ImportExtensions(Revit.Elements)

clr.AddReference("RevitServices")
import RevitServices
from RevitServices.Persistence import DocumentManager
from RevitServices.Transactions import TransactionManager

doc = DocumentManager.Instance.CurrentDBDocument
uidoc = DocumentManager.Instance.CurrentUIApplication.ActiveUIDocument

elist = IN[0]

llist = len(elist)

stlist = llist.ToString()

msg1 = "SE HAN DETECTADO :" + stlist + "COLISIONES EN EL MODELO"

TaskDialog.Show("Springall + MK" ,msg1)


OUT = 0
# ----------------------------------------

code_block_20 = CodeBlock(L=ui_multipleinputform.User_Inputs) { L[5]; }
code_block_21 = CodeBlock(l=ui_multipleinputform.User_Inputs) { l[6]; }
code_block_22 = CodeBlock { 1; }
code_block_23 = CodeBlock { false; }
elementos_coloreados = List.Clean(list=intersectsElement.Element, preserveIndices=code_block_23)
flatten_4 = List.Flatten(list=elementos_coloreados)
type = archilab.Revit.Elements.Elements.Type(element=flatten_4)
id = Element.Id(element=flatten_4)
elementos_chocantes = List.Clean(list=intersectsElement.intersectsWith, preserveIndices=code_block_23)
flatten_5 = List.Flatten(list=elementos_chocantes)
id_2 = Element.Id(element=flatten_5)
list_create_2 = List.Create(item0=type, item1=id, item2=flatten_5, item3=id_2)
transpose = List.Transpose(lists=list_create_2)
exportExcel = Data.ExportExcel(filePath=code_block_20, sheetName=code_block_21, startRow=code_block_22, startCol=code_block_22, data=transpose)
