# Dynamo graph Grid Bubble On-Off.dyn (Dynamo 2.3.0.5885)

select_model_elements = DSModelElementsSelection()  # 6 picked in the model
current = Document.Current()
activeView = Document.ActiveView(document=current)
python_script = Python(IN[0]=select_model_elements, IN[1]=activeView)
# ---------- python_script.python (52 lines) ----------
# Enable Python support and load DesignScript library
import clr
clr.AddReference('ProtoGeometry')
from Autodesk.DesignScript.Geometry import *

clr.AddReference("RevitNodes")

import Revit

clr.ImportExtensions(Revit.Elements)
clr.ImportExtensions(Revit.GeometryConversion)

clr.AddReference("RevitServices")

import RevitServices
from RevitServices.Persistence import DocumentManager
from RevitServices.Transactions import TransactionManager

from System.Collections.Generic import *

clr.AddReference("RevitAPI")
from Autodesk.Revit.DB import *
import System

doc = DocumentManager.Instance.CurrentDBDocument
uiapp = DocumentManager.Instance.CurrentUIApplication
app = uiapp.Application
uidoc = DocumentManager.Instance.CurrentUIApplication.ActiveUIDocument

a = []

grids_leveles = UnwrapElement(IN[0])

aview = UnwrapElement(IN[1])

TransactionManager.Instance.EnsureInTransaction(doc)

for i in grids_leveles:
	i.HideBubbleInView(DatumEnds.End1,aview)
	i.ShowBubbleInView(DatumEnds.End0,aview)
		
	
	
	
	
		
	
TransactionManager.Instance.TransactionTaskDone()

doc.Regenerate()

OUT = grids_leveles
# ----------------------------------------
