# Dynamo graph GridsVsGrids.dyn (Dynamo 2.3.0.5885)

current = Document.Current()
activeView = Document.ActiveView(document=current)

# group: host model
python_script = Python()
# ---------- python_script.python (14 lines) ----------
import clr
clr.AddReference('RevitAPI')
from Autodesk.Revit.DB import *
from System.Collections.Generic import *
clr.AddReference("RevitServices")
import RevitServices
from RevitServices.Persistence import DocumentManager
from RevitServices.Transactions import TransactionManager

doc = DocumentManager.Instance.CurrentDBDocument

filtro = FilteredElementCollector(doc,doc.ActiveView.Id).OfCategory(BuiltInCategory.OST_Grids).WhereElementIsNotElementType().ToElements()

OUT = filtro
# ----------------------------------------
code_block = CodeBlock { "Name"; }
getParameterValueByName = Element.GetParameterValueByName(element=python_script, parameterName=code_block)
curve = Grid.Curve(grid=python_script)

sort = List.Sort(list=getParameterValueByName)

# group: geometry transorm link shared coorrdinates
seleccione_link = DSModelElementSelection()  # 1 picked in the model; graph input
python_script_2 = Python(IN[0]=seleccione_link)
# ---------- python_script_2.python (19 lines) ----------
import clr
clr.AddReference('RevitAPI')
from Autodesk.Revit.DB import *
from System.Collections.Generic import *
clr.AddReference("RevitServices")
import RevitServices
from RevitServices.Persistence import DocumentManager
from RevitServices.Transactions import TransactionManager

doc = DocumentManager.Instance.CurrentDBDocument
linst = UnwrapElement(IN[0])

linkDoc = linst.GetLinkDocument()

filtro = FilteredElementCollector(linkDoc).OfCategory(BuiltInCategory.OST_Grids).WhereElementIsNotElementType().ToElements()

t = linst.GetTotalTransform()

OUT = filtro
# ----------------------------------------
curve_2 = Grid.Curve(grid=python_script_2)
origin = Point.Origin()
python_script_3 = Python(IN[0]=seleccione_link)
# ---------- python_script_3.python (24 lines) ----------
import clr
clr.AddReference('RevitAPI')
from Autodesk.Revit.DB import *
from System.Collections.Generic import *
clr.AddReference("RevitServices")
import RevitServices
from RevitServices.Persistence import DocumentManager
from RevitServices.Transactions import TransactionManager

clr.AddReference("RevitNodes")
import Revit
clr.ImportExtensions(Revit.GeometryConversion)

doc = DocumentManager.Instance.CurrentDBDocument
linst = UnwrapElement(IN[0])

linkDoc = linst.GetLinkDocument()


t = linst.GetTotalTransform()
origin = XYZ(0, 0, 0)
offsetPoint = t.OfPoint(origin)

OUT = OUT = offsetPoint.ToPoint()
# ----------------------------------------
byTwoPoints = Vector.ByTwoPoints(start=origin, end=python_script_3)
translate = Geometry.Translate(geometry=curve_2, direction=byTwoPoints)
getParameterValueByName_2 = Element.GetParameterValueByName(element=python_script_2, parameterName=code_block)

sortByKey = List.SortByKey(list=translate, keys=getParameterValueByName_2)
python_script_4 = Python(IN[0]=sort, IN[1]=sortByKey.sorted_keys, IN[2]=sortByKey.sorted_list)
# ---------- python_script_4.python (26 lines) ----------
import clr
clr.AddReference('RevitAPI')
from Autodesk.Revit.DB import *
from System.Collections.Generic import *
clr.AddReference("RevitServices")
import RevitServices
from RevitServices.Persistence import DocumentManager
from RevitServices.Transactions import TransactionManager

doc = DocumentManager.Instance.CurrentDBDocument
master = IN[0]

unsorted = IN[1]
unsorted_geo = IN[2]


rr = []
rb = []
for sor,unsort in zip(unsorted,unsorted_geo):
	if sor in master:
		rr.append(unsort)
		rb.append(sor)
		


OUT = rr,rb
# ----------------------------------------
code_block_2 = CodeBlock(l=python_script_4) { l[1]; l[0]; }
sortByKey_2 = List.SortByKey(list=curve, keys=getParameterValueByName)
python_script_5 = Python(IN[0]=code_block_2.out0, IN[1]=sortByKey_2.sorted_keys, IN[2]=sortByKey_2.sorted_list)  # same code as python_script_4
code_block_3 = CodeBlock(l=python_script_5) { l[1]; l[0]; }
sortByKey_3 = List.SortByKey(list=python_script, keys=getParameterValueByName)
python_script_6 = Python(IN[0]=code_block_2.out0, IN[1]=sortByKey_3.sorted_keys, IN[2]=sortByKey_3.sorted_list)
# ---------- python_script_6.python (26 lines) ----------
import clr
clr.AddReference('RevitAPI')
from Autodesk.Revit.DB import *
from System.Collections.Generic import *
clr.AddReference("RevitServices")
import RevitServices
from RevitServices.Persistence import DocumentManager
from RevitServices.Transactions import TransactionManager

doc = DocumentManager.Instance.CurrentDBDocument
master = IN[0]

unsorted = IN[1]
unsorted_geo = IN[2]


rr = []
rb = []
for sor,unsort in zip(unsorted,unsorted_geo):
	if sor in master:
		rr.append(unsort)
		rb.append(sor)
		


OUT = rr
# ----------------------------------------
byCoordinates = Point.ByCoordinates()
python_script_7 = Python(IN[0]=code_block_3.out1, IN[1]=code_block_3.out0, IN[2]=code_block_2.out1, IN[3]=code_block_2.out0, IN[4]=python_script_6, IN[5]=byCoordinates)
# ---------- python_script_7.python (42 lines) ----------
# Load the Python Standard and DesignScript Libraries
import sys
import clr
clr.AddReference('ProtoGeometry')
from Autodesk.DesignScript.Geometry import *

clr.AddReference('RevitAPI')
from Autodesk.Revit.DB import *
from System.Collections.Generic import *
clr.AddReference("RevitServices")
import RevitServices
from RevitServices.Persistence import DocumentManager
from RevitServices.Transactions import TransactionManager

clr.AddReference("RevitNodes")
import Revit
clr.ImportExtensions(Revit.GeometryConversion)

import math

doc = DocumentManager.Instance.CurrentDBDocument
curvas_Host = IN[0]
names_Host = IN[1]
curvas_Link = IN[2]
names_Link = IN[3]
grids = IN[4]
a = []
b =[]
c = []
d = []
pt = IN[5]
for crv,crvl,nh,gr in zip(curvas_Host,curvas_Link,names_Host,grids ):
	rr = Geometry.DoesIntersect(crv,crvl)

	if not (rr):
		a.append(nh)
		b.append(gr)
		c.append(crvl)



OUT = a,b,c
# ----------------------------------------
code_block_4 = CodeBlock { 2; }
getItemAtIndex = List.GetItemAtIndex(list=python_script_7, index=code_block_4)
byCurve = DetailCurve.ByCurve(view=activeView, curve=getItemAtIndex)
ruta_del_excel_para_reporte = Filename("..\..\..\29_GridCoordination\211109\BLD-3\MNSR_AXMA_ARC_BLD-3_211110.xlsx")  # graph input
nombre_del_test = StringInput("ARQ VS ELEC")  # graph input
code_block_5 = CodeBlock { 2; 0; }
code_block_6 = CodeBlock { "LISTA DE EJES DESFASADOS"; }
code_block_7 = CodeBlock { 1; }
getItemAtIndex_2 = List.GetItemAtIndex(list=python_script_7, index=code_block_7)
getParameterValueByName_3 = Element.GetParameterValueByName(element=getItemAtIndex_2, parameterName=code_block)
addItemToFront = List.AddItemToFront(item=code_block_6, list=getParameterValueByName_3)
code_block_8 = CodeBlock { "EDIFICIO PERTENECIENTE"; }
code_block_9 = CodeBlock { "Pertenece A"; }
getParameterValueByName_4 = Element.GetParameterValueByName(element=getItemAtIndex_2, parameterName=code_block_9)
addItemToFront_2 = List.AddItemToFront(item=code_block_8, list=getParameterValueByName_4)
code_block_10 = CodeBlock { "DISTANCIA DESFASADA EN MM"; }
curve_3 = Grid.Curve(grid=getItemAtIndex_2)
distanceTo = Geometry.DistanceTo(geometry=curve_3, other=getItemAtIndex)
round = Math.Round(number=distanceTo)
addItemToFront_3 = List.AddItemToFront(item=code_block_10, list=round)
code_block_11 = CodeBlock { "COORDNEDAS EJES AXM "; }
startPoint = Curve.StartPoint(curve=curve_3)
endPoint = Curve.EndPoint(curve=curve_3)
byTwoPoints_2 = Vector.ByTwoPoints(start=startPoint, end=endPoint)
addItemToFront_4 = List.AddItemToFront(item=code_block_11, list=byTwoPoints_2)
code_block_12 = CodeBlock { "COORDNEDAS EJES WSP"; }
startPoint_2 = Curve.StartPoint(curve=getItemAtIndex)
endPoint_2 = Curve.EndPoint(curve=getItemAtIndex)
byTwoPoints_3 = Vector.ByTwoPoints(start=startPoint_2, end=endPoint_2)
addItemToFront_5 = List.AddItemToFront(item=code_block_12, list=byTwoPoints_3)
list_create = List.Create(item0=addItemToFront, item1=addItemToFront_2, item2=addItemToFront_3, item3=addItemToFront_4, item4=addItemToFront_5)
transpose = List.Transpose(lists=list_create)
boolean = BoolSelector(true)
exportExcel = Data.ExportExcel(filePath=ruta_del_excel_para_reporte, sheetName=nombre_del_test, startRow=code_block_5.out0, startCol=code_block_5.out1, data=transpose, overWrite=boolean)
