# Dynamo graph Niveles_3D-a-2D.dyn (Dynamo 2.3.0.5885)

python_script = Python()  # unwired: IN[0]
# ---------- python_script.python (36 lines) ----------
# Enable Python support and load DesignScript library
import clr
clr.AddReference('ProtoGeometry')
from Autodesk.DesignScript.Geometry import *

clr.AddReference("RevitNodes")

import Revit
clr.ImportExtensions(Revit.Elements)
clr.AddReference("RevitServices")

import RevitServices
from RevitServices.Persistence import DocumentManager
from RevitServices.Transactions import TransactionManager

clr.AddReference("RevitAPI")
from Autodesk.Revit.DB import *
import System

doc = DocumentManager.Instance.CurrentDBDocument

a = []

grids_leveles = FilteredElementCollector(doc,doc.ActiveView.Id).OfCategory(BuiltInCategory.OST_Levels).WhereElementIsNotElementType().ToElements()


TransactionManager.Instance.EnsureInTransaction(doc)

for i in grids_leveles:
	i.SetDatumExtentType(DatumEnds.End0,doc.ActiveView,DatumExtentType.ViewSpecific)
	
	i.SetDatumExtentType(DatumEnds.End1,doc.ActiveView,DatumExtentType.ViewSpecific)
	
TransactionManager.Instance.TransactionTaskDone()

OUT = grids_leveles
# ----------------------------------------
