# Dynamo graph DYNAMO-REVITSETELEMENTIDS.dyn (Dynamo 2.3.0.5885)

# group: UIDOC.SELECTION
python_script = Python()  # unwired: IN[0]
# ---------- python_script.python (32 lines) ----------
import clr

clr.AddReference("RevitServices")
import RevitServices
from RevitServices.Persistence import DocumentManager
uidoc = DocumentManager.Instance.CurrentUIApplication.ActiveUIDocument
doc = DocumentManager.Instance.CurrentDBDocument
clr.AddReference("RevitNodes")
import Revit
clr.ImportExtensions(Revit.Elements)

clr.AddReference("RevitAPI")
from Autodesk.Revit.DB import ElementId
clr.AddReference("RevitAPIUI")
from Autodesk.Revit.UI.Selection import *

clr.AddReference("System")
from System.Collections.Generic import List as cList

selection = uidoc.Selection
ids1 = selection.GetElementIds()
ids = cList[ElementId](ids1)
uidoc.Selection.SetElementIds(ids)

A = []

for i in ids1:
	ele = doc.GetElement(i)
	A.append(ele)


OUT = A
# ----------------------------------------

code_block = CodeBlock { "Sheet Number"; }
code_block_2 = CodeBlock { 13..27; }
python_script_2 = Python(IN[0]=code_block_2)
# ---------- python_script_2.python (14 lines) ----------
# Load the Python Standard and DesignScript Libraries
import sys
import clr
clr.AddReference('ProtoGeometry')
from Autodesk.DesignScript.Geometry import *

# The inputs to this node will be stored as a list in the IN variables.
SEC = IN[0]
a = []
for i in SEC:
 newss = "B-D"+ str(i)
 a.append(newss)
# Assign your output to the OUT variable.
OUT = a
# ----------------------------------------
setParameterByName = Element.SetParameterByName(element=python_script, parameterName=code_block, value=python_script_2)
