# Dynamo graph AH Parámetros 01.dyn (Dynamo 2.0.3.8104)

# group: MAIN INPUTS
categories = Categories(index=74)
all_elements_of_category = ElementsOfCategory(Category=categories)
code_block = CodeBlock { "Programa"; }
getParameterValueByName = Element.GetParameterValueByName(element=all_elements_of_category, parameterName=code_block)
code_block_2 = CodeBlock { "Departamentos"; }
eq = getParameterValueByName == code_block_2
filterByBoolMask = List.FilterByBoolMask(list=all_elements_of_category, mask=eq)
code_block_3 = CodeBlock { "Programa"; }
code_block_4 = CodeBlock { "Level"; }

# group: SPLIT AREA LISTS BY USE
getParameterValueByName_2 = Element.GetParameterValueByName(element=filterByBoolMask.in, parameterName=code_block_3)
code_block_5 = CodeBlock { L = ["Estacionamiento","Estacionamiento+CM","Cisterna"]; }
python_script = Python(IN[0]=getParameterValueByName_2, IN[1]=code_block_5)
# ---------- python_script.python (22 lines) ----------
# Enable Python support and load DesignScript library
import clr
clr.AddReference('ProtoGeometry')
from Autodesk.DesignScript.Geometry import *

# The inputs to this node will be stored as a list in the IN variables.
categories = IN[0]
unique_keys = IN[1]

a = []

# Place your code below this line


for num in categories:
	if num in unique_keys:
		a.append(True)
	else:
		a.append(False)

# Assign your output to the OUT variable.
OUT = a
# ----------------------------------------
filterByBoolMask_2 = List.FilterByBoolMask(list=filterByBoolMask.in, mask=python_script)
getParameterValueByName_3 = Element.GetParameterValueByName(element=filterByBoolMask_2.out, parameterName=code_block_4)

# group: CIRCULACIONES X NIVEL
getParameterValueByName_4 = Element.GetParameterValueByName(element=filterByBoolMask.in, parameterName=code_block_4)
sortByKey = List.SortByKey(list=filterByBoolMask.in, keys=getParameterValueByName_4)
groupByKey = List.GroupByKey(list=sortByKey.sorted_list, keys=sortByKey.sorted_keys)
code_block_6 = CodeBlock { "Circulaciones"; }
code_block_7 = CodeBlock { "Name"; }
getParameterValueByName_5 = Element.GetParameterValueByName(element=filterByBoolMask.in, parameterName=code_block_7)
code_block_8 = CodeBlock { "Circulaciones"; }
eq_2 = getParameterValueByName_5 == code_block_8
filterByBoolMask_3 = List.FilterByBoolMask(list=filterByBoolMask.in, mask=eq_2)
getParameterValueByName_6 = Element.GetParameterValueByName(element=filterByBoolMask_3.in, parameterName=code_block_4)
sortByKey_2 = List.SortByKey(list=filterByBoolMask_3.in, keys=getParameterValueByName_6)
groupByKey_2 = List.GroupByKey(list=sortByKey_2.sorted_list, keys=sortByKey_2.sorted_keys)
code_block_9 = CodeBlock { "Area"; }
getParameterValueByName_7 = Element.GetParameterValueByName(element=groupByKey_2.groups, parameterName=code_block_9)
code_block_10 = CodeBlock { 2; }
round = Math.Round(number=getParameterValueByName_7, digits=code_block_10)
sum = Math.Sum(values=round)
count = List.Count(list=groupByKey.groups@L2)
div = sum / count
ofRepeatedItem = List.OfRepeatedItem(item=div@L1, amount=count@L1)
setParameterByName = Element.SetParameterByName(element=groupByKey.groups, parameterName=code_block_6, value=ofRepeatedItem)

# group: SET PARAMETER "ELEVACION"
code_block_11 = CodeBlock { "Level"; }
getParameterValueByName_8 = Element.GetParameterValueByName(element=all_elements_of_category, parameterName=code_block_11)
sortByKey_3 = List.SortByKey(list=all_elements_of_category, keys=getParameterValueByName_8)
groupByKey_3 = List.GroupByKey(list=sortByKey_3.sorted_list, keys=sortByKey_3.sorted_keys)
flatten = List.Flatten(list=groupByKey_3.groups)
code_block_12 = CodeBlock { "Elevacion"; }
categories_2 = Categories(index=248)
all_elements_of_category_2 = ElementsOfCategory(Category=categories_2)
name = Level.Name(level=all_elements_of_category_2)
sortByKey_4 = List.SortByKey(list=all_elements_of_category_2, keys=name)
python_script_2 = Python(IN[0]=groupByKey_3.unique_keys, IN[1]=sortByKey_4.sorted_keys, IN[2]=sortByKey_4.sorted_list)
# ---------- python_script_2.python (23 lines) ----------
# Enable Python support and load DesignScript library
import clr
clr.AddReference('ProtoGeometry')
from Autodesk.DesignScript.Geometry import *

# The inputs to this node will be stored as a list in the IN variables.
a_levels = IN[0]

levels = IN[1]
revit_levels = IN[2]
a =[]
ll = zip(levels,revit_levels)

# Place your code below this line

for num,lev in ll:
	if num in a_levels:
		a.append(lev)
	else:
		pass
	
# Assign your output to the OUT variable.
OUT = a
# ----------------------------------------
elevation = Level.Elevation(level=python_script_2)
code_block_13 = CodeBlock { 2; }
round_2 = Math.Round(number=elevation, digits=code_block_13)
count_2 = List.Count(list=groupByKey_3.groups@L2)
ofRepeatedItem_2 = List.OfRepeatedItem(item=round_2@L1, amount=count_2@L1)
flatten_2 = List.Flatten(list=ofRepeatedItem_2)
setParameterByName_2 = Element.SetParameterByName(element=flatten, parameterName=code_block_12, value=flatten_2)

# group: GROUPING AREAS PER LEVEL
code_block_14 = CodeBlock { "Level"; }
getParameterValueByName_9 = Element.GetParameterValueByName(element=filterByBoolMask_2.in, parameterName=code_block_14)
sortByKey_5 = List.SortByKey(list=filterByBoolMask_2.in, keys=getParameterValueByName_9)
groupByKey_4 = List.GroupByKey(list=sortByKey_5.sorted_list, keys=sortByKey_5.sorted_keys)
parking_elements = List.Flatten(list=groupByKey_4.groups)
count_3 = List.Count(list=groupByKey_4.groups@L2)

# group: PARKING ELEMENTS GROUPING ()
getDocuments = archilab.Revit.Selection.Select.GetDocuments()
code_block_15 = CodeBlock { "Host"; }
code_block_16 = CodeBlock { ":"; }
code_block_17 = CodeBlock { 1; }
code_block_18 = CodeBlock { 0; 1; }
code_block_19 = CodeBlock { "Estacionamiento"; }
contains = String.Contains(str=getDocuments.Link_Name, searchFor=code_block_19)
filterByBoolMask_4 = List.FilterByBoolMask(list=getDocuments.Link_Instance, mask=contains)
filterByBoolMask_5 = List.FilterByBoolMask(list=getDocuments.Link_Doc, mask=contains)
categories_3 = Categories(index=332)
getFromLinkedFile = Custom[Element.GetFromLinkedFile](Link_Instance=filterByBoolMask_4.in, Link_Document=filterByBoolMask_5.in, Category=categories_3)  # Get elements from link document instance based on category
string_from_object = FromObject(obj=getFromLinkedFile)
code_block_20 = CodeBlock { "C"; }
startsWith = String.StartsWith(str=string_from_object, searchFor=code_block_20)
filterByBoolMask_6 = List.FilterByBoolMask(list=getFromLinkedFile, mask=startsWith)
getParameterValueByName_10 = Revit.LinkElement.GetParameterValueByName(linkElement=filterByBoolMask_6.in, parameterName=code_block_15)
split = String.Split(str=getParameterValueByName_10, separater0=code_block_16)
getItemAtIndex = List.GetItemAtIndex(list=split@L2, index=code_block_17)
remove = String.Remove(str=getItemAtIndex, startIndex=code_block_18.out0, count=code_block_18.out1)
getLevelByName = archilab.Revit.Selection.Select.GetLevelByName(name=remove)
name_2 = Level.Name(level=getLevelByName)
sortByKey_6 = List.SortByKey(list=filterByBoolMask_6.in, keys=name_2)
groupByKey_5 = List.GroupByKey(list=sortByKey_6.sorted_list, keys=sortByKey_6.sorted_keys)
count_4 = List.Count(list=groupByKey_5.groups@L2)
div_2 = count_4 / count_3

# group: furniture collector ref for parkin elements per level (residential)
code_block_21 = CodeBlock { "Mobiliario"; }
contains_2 = String.Contains(str=getDocuments.Link_Name, searchFor=code_block_21)
filterByBoolMask_7 = List.FilterByBoolMask(list=getDocuments.Link_Instance, mask=contains_2)
filterByBoolMask_8 = List.FilterByBoolMask(list=getDocuments.Link_Doc, mask=contains_2)
categories_4 = Categories(index=222)
getFromLinkedFile_2 = Custom[Element.GetFromLinkedFile](Link_Instance=filterByBoolMask_7.in, Link_Document=filterByBoolMask_8.in, Category=categories_4)
string_from_object_2 = FromObject(obj=getFromLinkedFile_2)
code_block_22 = CodeBlock { "CAMA_STANDARD"; }
contains_3 = String.Contains(str=string_from_object_2, searchFor=code_block_22)
filterByBoolMask_9 = List.FilterByBoolMask(list=getFromLinkedFile_2, mask=contains_3)
getParameterValueByName_11 = Revit.LinkElement.GetParameterValueByName(linkElement=filterByBoolMask_9.in, parameterName=code_block_15)
split_2 = String.Split(str=getParameterValueByName_11, separater0=code_block_16)
getItemAtIndex_2 = List.GetItemAtIndex(list=split_2@L2, index=code_block_17)
remove_2 = String.Remove(str=getItemAtIndex_2, startIndex=code_block_18.out0, count=code_block_18.out1)
getLevelByName_2 = archilab.Revit.Selection.Select.GetLevelByName(name=remove_2)
name_3 = Level.Name(level=getLevelByName_2)

# group: SET PARAMETER " CAJONES UX"
sortByKey_7 = List.SortByKey(list=filterByBoolMask_2.out, keys=getParameterValueByName_3)
groupByKey_6 = List.GroupByKey(list=sortByKey_7.sorted_list, keys=sortByKey_7.sorted_keys)
flatten_3 = List.Flatten(list=groupByKey_6.groups)
code_block_23 = CodeBlock { "CajonesXU"; }
sortByKey_8 = List.SortByKey(list=filterByBoolMask_9.in, keys=name_3)
groupByKey_7 = List.GroupByKey(list=sortByKey_8.sorted_list, keys=sortByKey_8.sorted_keys)
count_5 = List.Count(list=groupByKey_7.groups@L2)
count_6 = List.Count(list=groupByKey_6.groups@L2)

div_3 = count_5 / count_6

# group (continued): SET PARAMETER " CAJONES UX"
ofRepeatedItem_3 = List.OfRepeatedItem(item=div_3@L1, amount=count_6@L1)
flatten_4 = List.Flatten(list=ofRepeatedItem_3)
setParameterByName_3 = Element.SetParameterByName(element=flatten_3, parameterName=code_block_23, value=flatten_4)

# group: EXTERIORES CUBIERTOS
code_block_24 = CodeBlock { 2; }
code_block_25 = CodeBlock { "EXT_CUBIERTA"; }
eq_3 = getParameterValueByName_5 == code_block_25
filterByBoolMask_10 = List.FilterByBoolMask(list=filterByBoolMask.in, mask=eq_3)
getParameterValueByName_12 = Element.GetParameterValueByName(element=filterByBoolMask_10.in, parameterName=code_block_4)
sortByKey_9 = List.SortByKey(list=filterByBoolMask_10.in, keys=getParameterValueByName_12)
groupByKey_8 = List.GroupByKey(list=sortByKey_9.sorted_list, keys=sortByKey_9.sorted_keys)
getParameterValueByName_13 = Element.GetParameterValueByName(element=groupByKey_8.groups, parameterName=code_block_9)
round_3 = Math.Round(number=getParameterValueByName_13, digits=code_block_24)
sum_2 = Math.Sum(values=round_3)

# group: INTERIOR VIVIENDA
code_block_26 = CodeBlock { "INTERIOR"; }
eq_4 = getParameterValueByName_5 == code_block_26
filterByBoolMask_11 = List.FilterByBoolMask(list=filterByBoolMask.in, mask=eq_4)
getParameterValueByName_14 = Element.GetParameterValueByName(element=filterByBoolMask_11.in, parameterName=code_block_4)
sortByKey_10 = List.SortByKey(list=filterByBoolMask_11.in, keys=getParameterValueByName_14)
groupByKey_9 = List.GroupByKey(list=sortByKey_10.sorted_list, keys=sortByKey_10.sorted_keys)
getParameterValueByName_15 = Element.GetParameterValueByName(element=groupByKey_9.groups, parameterName=code_block_9)
round_4 = Math.Round(number=getParameterValueByName_15, digits=code_block_24)
sum_3 = Math.Sum(values=round_4)

div_4 = sum_3 / count_6

# group (continued): INTERIOR VIVIENDA
ofRepeatedItem_4 = List.OfRepeatedItem(item=div_4@L1, amount=count_6@L1)

# group: EXTERIORES NO CUBIERTOS
code_block_27 = CodeBlock { "EXT_SC"; }
eq_5 = getParameterValueByName_5 == code_block_27
filterByBoolMask_12 = List.FilterByBoolMask(list=filterByBoolMask.in, mask=eq_5)
getParameterValueByName_16 = Element.GetParameterValueByName(element=filterByBoolMask_12.in, parameterName=code_block_4)
sortByKey_11 = List.SortByKey(list=filterByBoolMask_12.in, keys=getParameterValueByName_16)
groupByKey_10 = List.GroupByKey(list=sortByKey_11.sorted_list, keys=sortByKey_11.sorted_keys)
getParameterValueByName_17 = Element.GetParameterValueByName(element=groupByKey_10.groups, parameterName=code_block_9)
round_5 = Math.Round(number=getParameterValueByName_17, digits=code_block_24)
sum_4 = Math.Sum(values=round_5)
div_5 = sum_4 / count_6
ofRepeatedItem_5 = List.OfRepeatedItem(item=div_5@L1, amount=count_6@L1)
div_6 = sum_2 / count_6

# group (continued): GROUPING AREAS PER LEVEL
ofRepeatedItem_6 = List.OfRepeatedItem(item=div_2@L1, amount=count_3@L1)
flatten_5 = List.Flatten(list=ofRepeatedItem_6)

# group: TOTAL ESTACIONAMIENTOS
code_block_28 = CodeBlock { "Cajones Estac"; }
setParameterByName_4 = Element.SetParameterByName(element=parking_elements, parameterName=code_block_28, value=flatten_5)

code_block_29 = CodeBlock { 2; }
code_block_30 = CodeBlock { "LOCAL/NOMBRE"; }
code_block_31 = CodeBlock { "Level"; }
code_block_32 = CodeBlock { "clave_unica"; }

# group: INTERIOR MASTER
int_el = List.Flatten(list=groupByKey_9.groups)
int = Object.Identity(obj=int_el)
getParameterValueByName_18 = Element.GetParameterValueByName(element=int, parameterName=code_block_30)
getParameterValueByName_19 = Element.GetParameterValueByName(element=int, parameterName=code_block_31)
getParameterValueByName_20 = Element.GetParameterValueByName(element=int, parameterName=code_block_32)

code_block_33 = CodeBlock { 1; }
code_block_34 = CodeBlock { "Area"; }
code_block_35 = CodeBlock { 2; }

# group: EXTERIOR NO CUBIERTA
ext_nc = List.Flatten(list=groupByKey_10.groups)
getParameterValueByName_21 = Element.GetParameterValueByName(element=ext_nc, parameterName=code_block_30)
getParameterValueByName_22 = Element.GetParameterValueByName(element=ext_nc, parameterName=code_block_31)
getParameterValueByName_23 = Element.GetParameterValueByName(element=ext_nc, parameterName=code_block_32)
python_script_3 = Python(IN[0]=getParameterValueByName_21, IN[1]=getParameterValueByName_22, IN[2]=getParameterValueByName_23, IN[3]=getParameterValueByName_18, IN[4]=getParameterValueByName_19, IN[5]=getParameterValueByName_20, IN[6]=int)
# ---------- python_script_3.python (26 lines) ----------
# Enable Python support and load DesignScript library
import clr
clr.AddReference('ProtoGeometry')
from Autodesk.DesignScript.Geometry import *

# The inputs to this node will be stored as a list in the IN variables.
cat_keys= IN[0]
cat_lev = IN[1]
cat_enum = IN[2]


ll = zip(IN[3],IN[4],IN[5],IN[6])

a = []

for nombres,niveles,enums,areas in ll:
	if nombres in cat_keys and niveles in cat_lev and enums in cat_enum:
		a.append(areas)
	else:
		pass


# Place your code below this line

# Assign your output to the OUT variable.
OUT = a
# ----------------------------------------
code_block_36 = CodeBlock { "m2 Terraza No Cubierta"; }
getParameterValueByName_24 = Element.GetParameterValueByName(element=python_script_3, parameterName=code_block_32)
python_script_4 = Python(IN[0]=getParameterValueByName_23, IN[1]=ext_nc, IN[2]=getParameterValueByName_24)
# ---------- python_script_4.python (17 lines) ----------
# Enable Python support and load DesignScript library
import clr
clr.AddReference('ProtoGeometry')
from Autodesk.DesignScript.Geometry import *

# The inputs to this node will be stored as a list in the IN variables.
cargas_dsord = IN[0]
keys_dsord = IN[1]
lisord = IN[2]


test_list = zip(cargas_dsord,keys_dsord)

res = [tuple for x in lisord for tuple in test_list if tuple [0] ==x]

# Assign your output to the OUT variable.
OUT = res
# ----------------------------------------
getItemAtIndex_3 = List.GetItemAtIndex(list=python_script_4@L2, index=code_block_33)

getParameterValueByName_25 = Element.GetParameterValueByName(element=getItemAtIndex_3, parameterName=code_block_32)
groupByKey_11 = List.GroupByKey(list=getItemAtIndex_3, keys=getParameterValueByName_25)

# group (continued): EXTERIOR NO CUBIERTA
getParameterValueByName_26 = Element.GetParameterValueByName(element=groupByKey_11.groups, parameterName=code_block_34)
round_6 = Math.Round(number=getParameterValueByName_26, digits=code_block_35)

sum_5 = Math.Sum(values=round_6)

# group (continued): EXTERIOR NO CUBIERTA
setParameterByName_5 = Element.SetParameterByName(element=python_script_3, parameterName=code_block_36, value=sum_5)

# group: ESTACIONAMIENTO METADATA
code_block_37 = CodeBlock { "#Grandes"; "#Medianos"; "#Chicos"; "#Discapacitados"; "#Bicicletas"; }
string_from_object_3 = FromObject(obj=groupByKey_5.groups)
flatten_6 = List.Flatten(list=string_from_object_3)
code_block_38 = CodeBlock { "CGB"; "CCB"; "CCC"; "CGC"; "CD"; "bike"; "CMB"; "CMC"; }
eq_6 = flatten_6 == code_block_38.out0
filterByBoolMask_13 = List.FilterByBoolMask(list=groupByKey_5.groups, mask=eq_6)
count_7 = List.Count(list=filterByBoolMask_13.in@L2)
div_7 = count_7 / count_3
ofRepeatedItem_7 = List.OfRepeatedItem(item=div_7@L1, amount=count_3@L1)
flatten_7 = List.Flatten(list=ofRepeatedItem_7)
eq_7 = flatten_6 == code_block_38.out3
filterByBoolMask_14 = List.FilterByBoolMask(list=groupByKey_5.groups, mask=eq_7)
count_8 = List.Count(list=filterByBoolMask_14.in@L2)
div_8 = count_8 / count_3
ofRepeatedItem_8 = List.OfRepeatedItem(item=div_8@L1, amount=count_3@L1)
flatten_8 = List.Flatten(list=ofRepeatedItem_8)
add = flatten_7 + flatten_8
setParameterByName_6 = Element.SetParameterByName(element=parking_elements, parameterName=code_block_37.out0, value=add)
eq_8 = flatten_6 == code_block_38.out1
filterByBoolMask_15 = List.FilterByBoolMask(list=groupByKey_5.groups, mask=eq_8)
count_9 = List.Count(list=filterByBoolMask_15.in@L2)
div_9 = count_9 / count_3
ofRepeatedItem_9 = List.OfRepeatedItem(item=div_9@L1, amount=count_3@L1)
flatten_9 = List.Flatten(list=ofRepeatedItem_9)
eq_9 = flatten_6 == code_block_38.out2
filterByBoolMask_16 = List.FilterByBoolMask(list=groupByKey_5.groups, mask=eq_9)
count_10 = List.Count(list=filterByBoolMask_16.in@L2)
div_10 = count_10 / count_3
ofRepeatedItem_10 = List.OfRepeatedItem(item=div_10@L1, amount=count_3@L1)
flatten_10 = List.Flatten(list=ofRepeatedItem_10)
add_2 = flatten_9 + flatten_10
setParameterByName_7 = Element.SetParameterByName(element=parking_elements, parameterName=code_block_37.out2, value=add_2)
eq_10 = flatten_6 == code_block_38.out4
filterByBoolMask_17 = List.FilterByBoolMask(list=groupByKey_5.groups, mask=eq_10)
count_11 = List.Count(list=filterByBoolMask_17.in@L2)
div_11 = count_11 / count_3
ofRepeatedItem_11 = List.OfRepeatedItem(item=div_11@L1, amount=count_3@L1)
flatten_11 = List.Flatten(list=ofRepeatedItem_11)
setParameterByName_8 = Element.SetParameterByName(element=parking_elements, parameterName=code_block_37.out3, value=flatten_11)
eq_11 = flatten_6 == code_block_38.out5
filterByBoolMask_18 = List.FilterByBoolMask(list=groupByKey_5.groups, mask=eq_11)
count_12 = List.Count(list=filterByBoolMask_18.in@L2)
div_12 = count_12 / count_3
ofRepeatedItem_12 = List.OfRepeatedItem(item=div_12@L1, amount=count_3@L1)
flatten_12 = List.Flatten(list=ofRepeatedItem_12)
setParameterByName_9 = Element.SetParameterByName(element=parking_elements, parameterName=code_block_37.out4, value=flatten_12)
eq_12 = flatten_6 == code_block_38.out6
filterByBoolMask_19 = List.FilterByBoolMask(list=groupByKey_5.groups, mask=eq_12)
count_13 = List.Count(list=filterByBoolMask_19.in@L2)
div_13 = count_13 / count_3
ofRepeatedItem_13 = List.OfRepeatedItem(item=div_13@L1, amount=count_3@L1)
flatten_13 = List.Flatten(list=ofRepeatedItem_13)
eq_13 = flatten_6 == code_block_38.out7
filterByBoolMask_20 = List.FilterByBoolMask(list=groupByKey_5.groups, mask=eq_13)
count_14 = List.Count(list=filterByBoolMask_20.in@L2)
div_14 = count_14 / count_3
ofRepeatedItem_14 = List.OfRepeatedItem(item=div_14@L1, amount=count_3@L1)
flatten_14 = List.Flatten(list=ofRepeatedItem_14)
add_3 = flatten_13 + flatten_14
setParameterByName_10 = Element.SetParameterByName(element=parking_elements, parameterName=code_block_37.out1, value=add_3)

# group: RATIO ESTACIONAMIENTOS
code_block_39 = CodeBlock { "Ratio"; }
code_block_40 = CodeBlock { "Area"; 2; }
getParameterValueByName_27 = Element.GetParameterValueByName(element=groupByKey_4.groups, parameterName=code_block_40.out0)
round_7 = Math.Round(number=getParameterValueByName_27, digits=code_block_40.out1)
sum_6 = Math.Sum(values=round_7)
div_15 = sum_6 / count_4
round_8 = Math.Round(number=div_15, digits=code_block_40.out1)
div_16 = round_8 / count_3
ofRepeatedItem_15 = List.OfRepeatedItem(item=div_16@L1, amount=count_3@L1)
flatten_15 = List.Flatten(list=ofRepeatedItem_15)
setParameterByName_11 = Element.SetParameterByName(element=parking_elements, parameterName=code_block_39, value=flatten_15)

# group: SUPERFICIE VENDIBLE DE VIVIENDA POR NIVEL
identity = Object.Identity(obj=filterByBoolMask_11.in)
code_block_41 = CodeBlock { "LOCAL/NOMBRE"; }
getParameterValueByName_28 = Element.GetParameterValueByName(element=identity, parameterName=code_block_41)
code_block_42 = CodeBlock { "Sup.Vendible Total"; }
code_block_43 = CodeBlock { "Area"; }
getParameterValueByName_29 = Element.GetParameterValueByName(element=identity, parameterName=code_block_43)
code_block_44 = CodeBlock { "m2 Terraza Cubierta"; }
getParameterValueByName_30 = Element.GetParameterValueByName(element=identity, parameterName=code_block_44)
python_script_5 = Python(IN[0]=getParameterValueByName_30)
# ---------- python_script_5.python (21 lines) ----------
# Enable Python support and load DesignScript library
import clr
clr.AddReference('ProtoGeometry')
from Autodesk.DesignScript.Geometry import *

# The inputs to this node will be stored as a list in the IN variables.
list = IN[0]
a = []


# Place your code below this line

for num in list:
	if isinstance(num,float):
		a.append(num)
	else:
		a.append(0)


# Assign your output to the OUT variable.
OUT = a
# ----------------------------------------
code_block_45 = CodeBlock { "m2 Terraza No Cubierta"; }
getParameterValueByName_31 = Element.GetParameterValueByName(element=identity, parameterName=code_block_45)
python_script_6 = Python(IN[0]=getParameterValueByName_31)
# ---------- python_script_6.python (23 lines) ----------
# Enable Python support and load DesignScript library
import clr
clr.AddReference('ProtoGeometry')
from Autodesk.DesignScript.Geometry import *

# The inputs to this node will be stored as a list in the IN variables.
list = IN[0]
a = []
# Place your code below this line


for num in list:
	if isinstance(num,float):
		a.append(num)
	else:
		a.append(0)





# Assign your output to the OUT variable.
OUT = a
# ----------------------------------------
python_script_7 = Python(IN[0]=getParameterValueByName_29, IN[1]=python_script_5, IN[2]=python_script_6)
# ---------- python_script_7.python (22 lines) ----------
# Enable Python support and load DesignScript library
import clr
clr.AddReference('ProtoGeometry')
from Autodesk.DesignScript.Geometry import *

# The inputs to this node will be stored as a list in the IN variables.
a_int =  IN[0]
ext_cub = IN[1]
ext_sc = IN[2]

list = []

ll = zip(a_int,ext_cub,ext_sc)


for a,b,c in ll:
	suma = a+b+c
	list.append(suma)


# Assign your output to the OUT variable.
OUT =list
# ----------------------------------------
setParameterByName_12 = Element.SetParameterByName(element=identity, parameterName=code_block_42, value=python_script_7)

# group: AMENIDADES
getParameterValueByName_32 = Element.GetParameterValueByName(element=filterByBoolMask.in, parameterName=code_block_3)
code_block_46 = CodeBlock { "Amenidades"; }
eq_14 = getParameterValueByName_32 == code_block_46
filterByBoolMask_21 = List.FilterByBoolMask(list=filterByBoolMask.in, mask=eq_14)
code_block_47 = CodeBlock { "Name"; }
getParameterValueByName_33 = Element.GetParameterValueByName(element=filterByBoolMask_21.in, parameterName=code_block_47)
toUpper = String.ToUpper(str=code_block_46)
eq_15 = getParameterValueByName_33 == toUpper
amenidades = List.FilterByBoolMask(list=filterByBoolMask_21.in, mask=eq_15)
getParameterValueByName_34 = Element.GetParameterValueByName(element=amenidades.in, parameterName=code_block_4)
sortByKey_12 = List.SortByKey(list=amenidades.in, keys=getParameterValueByName_34)
groupByKey_12 = List.GroupByKey(list=sortByKey_12.sorted_list, keys=sortByKey_12.sorted_keys)
code_block_48 = CodeBlock { "Amenidades"; "Amenidades T NC"; }
code_block_49 = CodeBlock { "Area"; }
getParameterValueByName_35 = Element.GetParameterValueByName(element=groupByKey_12.groups, parameterName=code_block_49)
code_block_50 = CodeBlock { 2; }
round_9 = Math.Round(number=getParameterValueByName_35, digits=code_block_50)
setParameterByName_13 = Element.SetParameterByName(element=groupByKey_12.groups, parameterName=code_block_48.out0, value=round_9)
code_block_51 = CodeBlock { "S/C"; }
contains_4 = String.Contains(str=getParameterValueByName_33, searchFor=code_block_51)
exterior_sin_cubrir = List.FilterByBoolMask(list=filterByBoolMask_21.in, mask=contains_4)
getParameterValueByName_36 = Element.GetParameterValueByName(element=exterior_sin_cubrir.in, parameterName=code_block_4)
sortByKey_13 = List.SortByKey(list=exterior_sin_cubrir.in, keys=getParameterValueByName_36)
groupByKey_13 = List.GroupByKey(list=sortByKey_13.sorted_list, keys=sortByKey_13.sorted_keys)
getParameterValueByName_37 = Element.GetParameterValueByName(element=groupByKey_13.groups, parameterName=code_block_49)
round_10 = Math.Round(number=getParameterValueByName_37, digits=code_block_50)
setParameterByName_14 = Element.SetParameterByName(element=groupByKey_13.groups, parameterName=code_block_48.out1, value=round_10)
code_block_52 = CodeBlock { "CIRCULACIONES"; }
eq_16 = getParameterValueByName_33 == code_block_52
CIRCULACIONES = List.FilterByBoolMask(list=filterByBoolMask_21.in, mask=eq_16)
getParameterValueByName_38 = Element.GetParameterValueByName(element=CIRCULACIONES.in, parameterName=code_block_4)
sortByKey_14 = List.SortByKey(list=CIRCULACIONES.in, keys=getParameterValueByName_38)
groupByKey_14 = List.GroupByKey(list=sortByKey_14.sorted_list, keys=sortByKey_14.sorted_keys)
code_block_53 = CodeBlock { "Circulaciones"; }
getParameterValueByName_39 = Element.GetParameterValueByName(element=groupByKey_14.groups, parameterName=code_block_49)
round_11 = Math.Round(number=getParameterValueByName_39, digits=code_block_50)
setParameterByName_15 = Element.SetParameterByName(element=groupByKey_14.groups, parameterName=code_block_53, value=round_11)

# group (continued): EXTERIORES CUBIERTOS
ofRepeatedItem_16 = List.OfRepeatedItem(item=div_6@L1, amount=count_6@L1)

# group: SET PARAMETER"[sup.vivienda,sup.balcones . sup terrace no cubierta]
code_block_54 = CodeBlock { "Sup.Vivienda Total"; }
flatten_16 = List.Flatten(list=ofRepeatedItem_4)
setParameterByName_16 = Element.SetParameterByName(element=flatten_3, parameterName=code_block_54, value=flatten_16)
code_block_55 = CodeBlock { "S.Terrace NC/V"; }
flatten_17 = List.Flatten(list=ofRepeatedItem_5)
setParameterByName_17 = Element.SetParameterByName(element=flatten_3, parameterName=code_block_55, value=flatten_17)
code_block_56 = CodeBlock { "S.Balcones Total"; }
flatten_18 = List.Flatten(list=ofRepeatedItem_16)
setParameterByName_18 = Element.SetParameterByName(element=flatten_3, parameterName=code_block_56, value=flatten_18)

code_block_57 = CodeBlock { "LOCAL/NOMBRE"; }
getParameterValueByName_40 = Element.GetParameterValueByName(element=setParameterByName_18, parameterName=code_block_57)

# group: EXTERIOR CUBIERTA
ext = List.Flatten(list=groupByKey_8.groups)
getParameterValueByName_41 = Element.GetParameterValueByName(element=ext, parameterName=code_block_30)
getParameterValueByName_42 = Element.GetParameterValueByName(element=ext, parameterName=code_block_31)
getParameterValueByName_43 = Element.GetParameterValueByName(element=ext, parameterName=code_block_32)
python_script_8 = Python(IN[0]=getParameterValueByName_41, IN[1]=getParameterValueByName_42, IN[2]=getParameterValueByName_43, IN[3]=getParameterValueByName_18, IN[4]=getParameterValueByName_19, IN[5]=getParameterValueByName_20, IN[6]=int)
# ---------- python_script_8.python (24 lines) ----------
# Enable Python support and load DesignScript library
import clr
clr.AddReference('ProtoGeometry')
from Autodesk.DesignScript.Geometry import *

# The inputs to this node will be stored as a list in the IN variables.
cat_keys = IN[0]
cat_lev =IN[1]
cat_enum = IN[2]

ll = zip(IN[3],IN[4],IN[5],IN[6])

a = []

for nombres,niveles,enums,areas in ll:
	if nombres in cat_keys and niveles in cat_lev and enums in cat_enum:
		a.append(areas)
	else:
		pass

# Place your code below this line

# Assign your output to the OUT variable.
OUT = a
# ----------------------------------------
code_block_58 = CodeBlock { "m2 Terraza Cubierta"; }
getParameterValueByName_44 = Element.GetParameterValueByName(element=python_script_8, parameterName=code_block_32)
python_script_9 = Python(IN[0]=getParameterValueByName_43, IN[1]=ext, IN[2]=getParameterValueByName_44)
# ---------- python_script_9.python (19 lines) ----------
# Enable Python support and load DesignScript library
import clr
clr.AddReference('ProtoGeometry')
from Autodesk.DesignScript.Geometry import *

# The inputs to this node will be stored as a list in the IN variables.
cargas_dsord = IN[0]
keys_dsord = IN[1]
lisord = IN[2]



test_list = zip(cargas_dsord,keys_dsord)

res = [tuple for x in lisord for tuple in test_list if tuple[0]==x]


# Assign your output to the OUT variable.
OUT = res
# ----------------------------------------
getItemAtIndex_4 = List.GetItemAtIndex(list=python_script_9@L2, index=code_block_33)

getParameterValueByName_45 = Element.GetParameterValueByName(element=getItemAtIndex_4, parameterName=code_block_32)
groupByKey_15 = List.GroupByKey(list=getItemAtIndex_4, keys=getParameterValueByName_45)

# group (continued): EXTERIOR CUBIERTA
getParameterValueByName_46 = Element.GetParameterValueByName(element=groupByKey_15.groups, parameterName=code_block_34)
round_12 = Math.Round(number=getParameterValueByName_46, digits=code_block_35)

sum_7 = Math.Sum(values=round_12)

# group (continued): EXTERIOR CUBIERTA
setParameterByName_19 = Element.SetParameterByName(element=python_script_8, parameterName=code_block_58, value=sum_7)
