# Dynamo graph AH Parámetros 02.dyn (Dynamo 2.0.3.8104)

categories = Categories(index=74)
all_elements_of_category = ElementsOfCategory(Category=categories)
code_block = CodeBlock { "Name"; }
getParameterValueByName = Element.GetParameterValueByName(element=all_elements_of_category, parameterName=code_block)
code_block_2 = CodeBlock { "INTERIOR"; }
eq = getParameterValueByName == code_block_2
filterByBoolMask = List.FilterByBoolMask(list=all_elements_of_category, mask=eq)
areas_rvt_elements = List.Flatten(list=filterByBoolMask.in)
categories_2 = Categories(index=222)
all_elements_of_category_2 = ElementsOfCategory(Category=categories_2)
name = Family.Name(family=all_elements_of_category_2)
code_block_3 = CodeBlock { "CAMA"; }
contains = String.Contains(str=name, searchFor=code_block_3)
filterByBoolMask_2 = List.FilterByBoolMask(list=all_elements_of_category_2, mask=contains)
getLocation = Element.GetLocation(element=filterByBoolMask_2.in)
count = List.Count(list=getLocation)
ofRepeatedItem = List.OfRepeatedItem(item=areas_rvt_elements, amount=count)
ʳʰʸᵗʰᵐ_areas_outerboundary = Rhythm.Revit.Elements.Areas.OuterBoundary(area=filterByBoolMask.in)
flatten = List.Flatten(list=ʳʰʸᵗʰᵐ_areas_outerboundary)
byPatch = Surface.ByPatch(closedCurve=flatten)
ofRepeatedItem_2 = List.OfRepeatedItem(item=byPatch, amount=count)
python_script = Python(IN[0]=getLocation, IN[1]=ofRepeatedItem_2)
# ---------- python_script.python (27 lines) ----------
# Enable Python support and load DesignScript library
import clr
clr.AddReference('ProtoGeometry')
from Autodesk.DesignScript.Geometry import *

# The inputs to this node will be stored as a list in the IN variables.
dataEnteringNode = IN

a=[]
# Place your code below this line

output = [[] for i in range(len(IN[0]))]

en = enumerate(zip(IN[0],IN[1]))

for index,(pts,list1) in en:
	for surfaces in list1:
		i = Geometry.Intersect(surfaces,pts)
		if i:
			output[index].append(i[0])
		else:
			output[index].append(None)
			
	

# Assign your output to the OUT variable.
OUT = output
# ----------------------------------------
isNull = Object.IsNull(obj=python_script)
filterByBoolMask_3 = List.FilterByBoolMask(list=ofRepeatedItem, mask=isNull)
flatten_2 = List.Flatten(list=filterByBoolMask_3.out)
code_block_4 = CodeBlock { "LOCAL/NOMBRE"; }
getParameterValueByName_2 = Element.GetParameterValueByName(element=flatten_2, parameterName=code_block_4)
groupByKey = List.GroupByKey(list=flatten_2, keys=getParameterValueByName_2)
code_block_5 = CodeBlock { 0; }
getItemAtIndex = List.GetItemAtIndex(list=groupByKey.groups@L2, index=code_block_5)
code_block_6 = CodeBlock { "Cajones X UN"; }
count_2 = List.Count(list=groupByKey.groups@L2)
setParameterByName = Element.SetParameterByName(element=getItemAtIndex, parameterName=code_block_6, value=count_2)
