# Dynamo graph AH-Cuantificacion_Cajones.dyn (Dynamo 2.0.3.8104)

# group: vista actual del documento
python_script = Python()
# ---------- python_script.python (37 lines) ----------
#Copyright(c) 2015, Konrad K Sobon
# @arch_laboratory, http://archi-lab.net

import clr
import sys
clr.AddReference('ProtoGeometry')
from Autodesk.DesignScript.Geometry import *

pyt_path = r'C:\Program Files (x86)\IronPython 2.7\Lib'
sys.path.append(pyt_path)

# Import Element wrapper extension methods
clr.AddReference("RevitNodes")
import Revit
clr.ImportExtensions(Revit.Elements)

# Import DocumentManager and TransactionManager
clr.AddReference("RevitServices")
import RevitServices
from RevitServices.Persistence import DocumentManager
from RevitServices.Transactions import TransactionManager

doc = DocumentManager.Instance.CurrentDBDocument
uiapp = DocumentManager.Instance.CurrentUIApplication
app = uiapp.Application

# Import RevitAPI
clr.AddReference("RevitAPI")
import Autodesk
from Autodesk.Revit.DB import *
import System



DOC = DocumentManager.Instance.CurrentDBDocument

OUT = DOC.ActiveView
# ----------------------------------------

# group: extracting view elements
code_block = CodeBlock { "TEXT_TEXT"; }
categories = Categories(index=585)
selectByCategoryAndView = Python(IN[0]=python_script, IN[1]=categories)
# ---------- selectByCategoryAndView.python (32 lines) ----------
#Alban de Chasteigner 2018
#twitter : @geniusloci_bim
#geniusloci.bim@gmail.com

import clr
clr.AddReference('RevitAPI')
import Autodesk
from Autodesk.Revit.DB import *
clr.AddReference('RevitServices')
import RevitServices
from RevitServices.Persistence import DocumentManager
clr.AddReference("RevitNodes")
import Revit
clr.ImportExtensions(Revit.GeometryConversion)

def tolist(x):
    if hasattr(x,'__iter__'): return x
    else : return [x]

views = tolist(UnwrapElement(IN[0]))
cats = tolist(UnwrapElement(IN[1]))

linkedEl,elements = [],[]
for view in views:
	doc=view.Document
	for cat in cats:
		collector = FilteredElementCollector(doc,view.Id).OfCategoryId(cat.Id).ToElements()
		linkedEl.append(collector)
	elements.append(linkedEl)

if not isinstance(IN[0], list) and not isinstance(IN[1], list): OUT = elements[0][0]
else: OUT = elements[0]
# ----------------------------------------
get_built_in_parameter = Custom[Get Built In Parameter](parameterNames=code_block, elements=selectByCategoryAndView)  # This node will take an input of a built in parameter name and element to return that parameters value.

string_from_object = FromObject(obj=get_built_in_parameter)
code_block_2 = CodeBlock { " G"; }
contains = String.Contains(str=string_from_object, searchFor=code_block_2)
cajones_grandes = List.FilterByBoolMask(list=get_built_in_parameter, mask=contains)
watch = Watch(cajones_grandes.in)
code_block_3 = CodeBlock { " CH"; }
contains_2 = String.Contains(str=string_from_object, searchFor=code_block_3)
cajones_chicos = List.FilterByBoolMask(list=get_built_in_parameter, mask=contains_2)
watch_2 = Watch(cajones_chicos.in)

# group: ASIGNACIÒN DE PARAMETROS
code_block_4 = CodeBlock { "CAJONES CHICOS"; }
count = List.Count(list=cajones_chicos.in)
string_from_object_2 = FromObject(obj=count)
setParameterByName = Element.SetParameterByName(element=python_script, parameterName=code_block_4, value=string_from_object_2)
code_block_5 = CodeBlock { "CAJONES GRANDES"; }
count_2 = List.Count(list=cajones_grandes.in)
string_from_object_3 = FromObject(obj=count_2)
setParameterByName_2 = Element.SetParameterByName(element=python_script, parameterName=code_block_5, value=string_from_object_3)
code_block_6 = CodeBlock { "TOTAL CAJONES"; }
add = count_2 + count
string_from_object_4 = FromObject(obj=add)
setParameterByName_3 = Element.SetParameterByName(element=python_script, parameterName=code_block_6, value=string_from_object_4)
