# Dynamo graph AXM_SetMaterialMarkByExcel.dyn (Dynamo 2.3.0.5885)

file_path = Filename("G:\Unidades compartidas\MANSUR\SURMAN PEDREGAL\01_RESIDENCIA MANSUR\01_AXM\01_MNSR_Project\01_BIM\19_BIM Schedules\02_Material Takeoff\MNSR_AXM_Materials.xlsx")
file_from_path = FileObject(path=file_path)
code_block = CodeBlock { "dynamo"; }
importExcel = Data.ImportExcel(file=file_from_path, sheetName=code_block)
code_block_2 = CodeBlock { 0; 1; }
getItemAtIndex = List.GetItemAtIndex(list=importExcel@L2, index=code_block_2.out1)
python_script = Python(IN[0]=getItemAtIndex)
# ---------- python_script.python (51 lines) ----------
# Enable Python support and load DesignScript library
import clr
clr.AddReference('ProtoGeometry')
from Autodesk.DesignScript.Geometry import *

clr.AddReference("RevitNodes")

import Revit
clr.ImportExtensions(Revit.Elements)
clr.AddReference("RevitServices")

import RevitServices
from RevitServices.Persistence import DocumentManager
from RevitServices.Transactions import TransactionManager

clr.AddReference("RevitAPI")
from Autodesk.Revit.DB import *
import System

def GetMaterialByName(nombre,materialList):
	mate = None
	for material in materialList:
		
		Name = Element.Name.__get__(material)
		if nombre == Name:
			mate = material
	return mate



doc = DocumentManager.Instance.CurrentDBDocument

Names = IN[0]
		
elems = FilteredElementCollector(doc).OfCategory(BuiltInCategory.OST_Materials).WhereElementIsNotElementType()


a = []

materialList = []
result = []

for i in elems:
	materialList.append(i)
	
for nombre in Names:

	materialchido = GetMaterialByName(nombre,materialList)
	result .append(materialchido)

OUT = result
# ----------------------------------------
code_block_3 = CodeBlock { "Mark"; }
getItemAtIndex_2 = List.GetItemAtIndex(list=importExcel@L2, index=code_block_2.out0)
string_from_object = FromObject(obj=getItemAtIndex_2)
code_block_4 = CodeBlock { "."; 0; }
split = String.Split(str=string_from_object, separator0=code_block_4.out0)
getItemAtIndex_3 = List.GetItemAtIndex(list=split@L2, index=code_block_4.out1)
setParameterByName = Element.SetParameterByName(element=python_script, parameterName=code_block_3, value=getItemAtIndex_3)
