# Dynamo graph OPT2_ExportarTablaExcel.dyn (Dynamo 2.3.0.5885)
# packages: Data-Shapes 2022.2.96, BumbleBee 2021.25.3, bimorphNodes 4.0.7

code_block = CodeBlock { "AXM Mansur"; }
file_path = Filename(".\ExportarTablaExcel.png")
code_block_2 = CodeBlock { "Exportar Areas A Excel"; }
code_block_3 = CodeBlock { "Ruta del Data Sheet"; }
file_path_2 = Filename("..\..\..\21_MasterFormat\XXXX_AXM_TEMPLATE_MF.xlsx")
ui_filepath_data = Custom[UI.FilePath Data](InputName=code_block_3, DefaulPath=file_path_2)  # package Data-Shapes; Create filepath input for UI.MultipleInputForm ++ . Check out www.data-shapes.net for more infos !
code_block_4 = CodeBlock { "Nombre de la Hoja a llenar"; }
code_block_5 = CodeBlock { "revi2"; }
ui_textbox_data = Custom[UI.TextBox Data](InputName=code_block_4, DefaultText=code_block_5)  # package Data-Shapes; Create Data for TextBox input in UI.MultipleInputForm ++ . Check out www.data-shapes.net for more informations
code_block_6 = CodeBlock { "Tablas en Revit"; }
categories = Categories("OST_Schedules")
all_elements_of_category = ElementsOfCategory(Category=categories)
name = Element.Name(element=all_elements_of_category)
listview_data = Custom[Listview Data](InputName=code_block_6, Keys=name, Values=all_elements_of_category)  # package Data-Shapes; Create data for ListView input in UI.MultiInputForm ++ . Check out www.data-shapes.net for more infos.
code_block_7 = CodeBlock { "Excel_Data_Export"; }
file_path_3 = Filename("..\..\..\..\..\04_logos AXM\logos\logo agos 20.jpg")
ui_image_data = Custom[UI.Image Data](ImageTitle=code_block_7, Image=file_path_3)  # package Data-Shapes; Places an image on UI.MultipleInutForm ++ .
list_create = List.Create(item0=ui_filepath_data, item1=ui_textbox_data, item2=listview_data, item3=ui_image_data)
boolean = BoolSelector(true)
code_block_8 = CodeBlock { "Cancelar"; }
ui_multipleinputform = Custom[UI.MultipleInputForm ++](Description_optional=code_block, Logo_optional=file_path, ButtonText_optional=code_block_2, Inputs=list_create, Toggle=boolean, CancelButtonText_optional=code_block_8)  # package Data-Shapes; Create a form with multiple inputs. see www.data-shapes.net for tutorials and infos!
code_block_9 = CodeBlock(l=ui_multipleinputform.User_Inputs) { l[2]; }
getData = Revit.Schedule.GetData(scheduleView=code_block_9)

# group: CELL RANGES
code_block_10 = CodeBlock { "A3:"; }
code_block_11 = CodeBlock { L=["A","B","C","D","E","F","G","H","I","J","K","M","N","L","O","P"]; }
code_block_12 = CodeBlock { 0; }
getItemAtIndex = List.GetItemAtIndex(list=getData@L3, index=code_block_12)
count = List.Count(list=getItemAtIndex@L2)
code_block_13 = CodeBlock { 1; }
sub = count - code_block_13
python_script = Python(IN[0]=code_block_11, IN[1]=sub)
# ---------- python_script.python (28 lines) ----------
# Enable Python support and load DesignScript library
import clr
clr.AddReference('ProtoGeometry')
from Autodesk.DesignScript.Geometry import *

# The inputs to this node will be stored as a list in the IN variables.
abecedario = IN[0]
longitud = IN[1]

a = []
b = []

# Place your code below this line


for i in range(len(abecedario)):
	a.append(i)
	
ll = zip(a,abecedario)


for num,letras in ll:
	if num in longitud:
		b.append(letras)
	else:
		pass

OUT = b
# ----------------------------------------
python_script_2 = Python(IN[0]=code_block_10, IN[1]=python_script)
# ---------- python_script_2.python (17 lines) ----------
# Enable Python support and load DesignScript library
import clr
clr.AddReference('ProtoGeometry')
from Autodesk.DesignScript.Geometry import *

# The inputs to this node will be stored as a list in the IN variables.
ST1= IN[0]
ST2 = IN[1]

a =[]
# Place your code below this line
for i in ST2:
	
	str = ST1+i+"3"
	a.append(str)
# Assign your output to the OUT variable.
OUT = a
# ----------------------------------------

pattern_types = PatternTypesUi("xlSolid")

# group: BB EXCEL BASIC FORMAT
code_block_14 = CodeBlock(L=ui_multipleinputform.User_Inputs) { L[1]; }
color_palette = ColorPalette({R: 228, G: 34, B: 124, A: 255})
fill_style = Custom[Fill Style](PatternType=pattern_types, BackgroundColor=color_palette, PatternColor=color_palette)  # package BumbleBee; This node generates a Fill Style that can be used for conditional formatting or regular cell formatting.
graphic_style = Custom[Graphic Style](FillStyle=fill_style)  # package BumbleBee; This node will create a graphic style that can be used either for conditional formatting or regular cell formatting.
bb_style = Custom[BB Style](SheetName=code_block_14, CellRange=python_script_2, GraphicStyle=graphic_style)  # package BumbleBee; This node is a building block for different modes of formatting an Excel file. You can combines this node into a list to apply formatting to multiple ranges or sheets at the same time.

# group: EXCEL
code_block_15 = CodeBlock { 0; }
getItemAtIndex_2 = List.GetItemAtIndex(list=ui_multipleinputform.User_Inputs, index=code_block_15)
code_block_16 = CodeBlock(l=ui_multipleinputform.User_Inputs) { l[1]; }

boolean_2 = BoolSelector(true)
boolean_3 = BoolSelector(false)
code_block_17 = CodeBlock { "A1"; }
python_script_3 = Python(IN[0]=code_block_9)
# ---------- python_script_3.python (44 lines) ----------
#python nodes in dynamo 1.0
#proposed by Julien Benoit @jbenoit44 
#http://aecuandme.wordpress.com/
import clr
clr.AddReference('ProtoGeometry')
from Autodesk.DesignScript.Geometry import *
# Import ToDSType(bool) extension method
clr.AddReference("RevitNodes")
import Revit
clr.ImportExtensions(Revit.Elements)
# Import geometry conversion extension methods
clr.ImportExtensions(Revit.GeometryConversion)
# Import DocumentManager and TransactionManager
clr.AddReference("RevitServices")
import RevitServices
from RevitServices.Persistence import DocumentManager
from RevitServices.Transactions import TransactionManager
from System.Collections.Generic import *
# Import RevitAPI
clr.AddReference("RevitAPI")
import Autodesk
from Autodesk.Revit.DB import *

doc = DocumentManager.Instance.CurrentDBDocument
uiapp = DocumentManager.Instance.CurrentUIApplication
app = uiapp.Application
uidoc=DocumentManager.Instance.CurrentUIApplication.ActiveUIDocument

elt = []
for i in IN[0]:
	elt.append(UnwrapElement(i))
list=[]

# Start Transaction
TransactionManager.Instance.EnsureInTransaction(doc)
for v in elt:
	b=SectionType.Header
	a=v.GetCellText(b,0,0)
	list.append(a)

# End Transaction
TransactionManager.Instance.TransactionTaskDone()

OUT=list
# ----------------------------------------
code_block_18 = CodeBlock { l=[" "," "," "," "," "]; }
code_block_19 = CodeBlock(a=code_block_18) { a; }
list_create_2 = List.Create(item0=code_block_19)
addItemToFront = List.AddItemToFront(item=list_create_2, list=getData)
list_create_3 = List.Create(item0=addItemToFront)
code_block_20 = CodeBlock { 2; }
flatten = List.Flatten(list=list_create_3, amt=code_block_20)
addItemToFront_2 = List.AddItemToFront(item=python_script_3, list=flatten)
bb_data = Custom[BB Data](sheetName=code_block_16, origin=code_block_17, data=addItemToFront_2)  # package BumbleBee; This node is a building block for different modes of writing to Excel files. You can combines this node into a list to write to multiple sheets or use just one to write to a single sheet.
write_excel = Custom[Write Excel](filePath=getItemAtIndex_2, runIt=boolean_2, byColumn=boolean_3, BBData=bb_data)  # package BumbleBee; This node will write data to Excel file and based on how your BBData nodes are structured it will either override the exsting file, create a new one and write a single worksheet or write multiple worksheets.
