# Dynamo graph DirectShape Roof.dyn (Dynamo 2.3.0.5885)

select_faces = SelectFaces()  # 6 picked in the model
flatten = List.Flatten(list=select_faces)
byJoinedSurfaces = PolySurface.ByJoinedSurfaces(surfaces=flatten)
categories = Categories("OST_Roofs")
code_block = CodeBlock { "Roof Metal Panel"; }
byName = Material.ByName(name=code_block)
code_block_2 = CodeBlock { "Metal Panel Cladding"; }
byGeometry = DirectShape.ByGeometry(geometry=byJoinedSurfaces, category=categories, material=byName, name=code_block_2)
