# Dynamo graph Facade_Generator.dyn (Dynamo 2.0.3.8104)

code_block = CodeBlock { "Facade Generator"; }
code_block_2 = CodeBlock { "Correr"; }
code_block_3 = CodeBlock { "S+MK"; }
file_path = Filename("..\..\UI\s+mk.png")
ui_image_data = Custom[UI.Image Data](ImageTitle=code_block_3, Image=file_path)  # Places an image on UI.MultipleInutForm ++ .
code_block_4 = CodeBlock { "SELECCIONE EL NIVEL TOPE"; "SELECCIONE EL NIVEL BASE"; }
python_script = Python()  # unwired: IN[0]
# ---------- python_script.python (36 lines) ----------
#python nodes in dynamo 1.2
#proposed by Julien Benoit @jbenoit44 
#http://aecuandme.wordpress.com/
import clr
clr.AddReference('ProtoGeometry')
from Autodesk.DesignScript.Geometry import *
# Import ToDSType(bool) extension method
clr.AddReference("RevitNodes")
import Revit
clr.ImportExtensions(Revit.Elements)
# Import geometry conversion extension methods
clr.ImportExtensions(Revit.GeometryConversion)
# Import DocumentManager and TransactionManager
clr.AddReference("RevitServices")
import RevitServices
from RevitServices.Persistence import DocumentManager
from RevitServices.Transactions import TransactionManager
from System.Collections.Generic import *
# Import RevitAPI
clr.AddReference("RevitAPI")
import Autodesk
from Autodesk.Revit.DB import *

doc = DocumentManager.Instance.CurrentDBDocument
uiapp = DocumentManager.Instance.CurrentUIApplication
app = uiapp.Application
uidoc=DocumentManager.Instance.CurrentUIApplication.ActiveUIDocument

colector = FilteredElementCollector(doc).OfCategory(BuiltInCategory.OST_Levels).WhereElementIsNotElementType().ToElements()






OUT = colector
# ----------------------------------------
name = Level.Name(level=python_script)
ui_dropdown_data = Custom[UI.DropDown Data](InputName=code_block_4.out0, Keys=name, Values=python_script)  # Create data for DropDown input in UI.MultiInputForm ++ . Check out www.data-shapes.net for more infos.
ui_listview_data = Custom[UI.Listview Data](InputName=code_block_4.out1, Keys=name, Values=python_script)  # Create data for ListView input in UI.MultiInputForm ++ . Check out www.data-shapes.net for more infos.
code_block_5 = CodeBlock { "SELECCIONA FAMILIA MONTEN"; }
python_script_2 = Python()  # unwired: IN[0]
# ---------- python_script_2.python (36 lines) ----------
#python nodes in dynamo 1.2
#proposed by Julien Benoit @jbenoit44 
#http://aecuandme.wordpress.com/
import clr
clr.AddReference('ProtoGeometry')
from Autodesk.DesignScript.Geometry import *
# Import ToDSType(bool) extension method
clr.AddReference("RevitNodes")
import Revit
clr.ImportExtensions(Revit.Elements)
# Import geometry conversion extension methods
clr.ImportExtensions(Revit.GeometryConversion)
# Import DocumentManager and TransactionManager
clr.AddReference("RevitServices")
import RevitServices
from RevitServices.Persistence import DocumentManager
from RevitServices.Transactions import TransactionManager
from System.Collections.Generic import *
# Import RevitAPI
clr.AddReference("RevitAPI")
import Autodesk
from Autodesk.Revit.DB import *

doc = DocumentManager.Instance.CurrentDBDocument
uiapp = DocumentManager.Instance.CurrentUIApplication
app = uiapp.Application
uidoc=DocumentManager.Instance.CurrentUIApplication.ActiveUIDocument

colector = FilteredElementCollector(doc).OfCategory(BuiltInCategory.OST_StructuralFraming).WhereElementIsElementType().ToElements()






OUT = colector
# ----------------------------------------
ui_dropdown_data_2 = Custom[UI.DropDown Data](InputName=code_block_5, Keys=python_script_2, Values=python_script_2)
code_block_6 = CodeBlock { "SELECCIONA FAMILIA LAMINA"; }
python_script_3 = Python()  # unwired: IN[0]
# ---------- python_script_3.python (36 lines) ----------
#python nodes in dynamo 1.2
#proposed by Julien Benoit @jbenoit44 
#http://aecuandme.wordpress.com/
import clr
clr.AddReference('ProtoGeometry')
from Autodesk.DesignScript.Geometry import *
# Import ToDSType(bool) extension method
clr.AddReference("RevitNodes")
import Revit
clr.ImportExtensions(Revit.Elements)
# Import geometry conversion extension methods
clr.ImportExtensions(Revit.GeometryConversion)
# Import DocumentManager and TransactionManager
clr.AddReference("RevitServices")
import RevitServices
from RevitServices.Persistence import DocumentManager
from RevitServices.Transactions import TransactionManager
from System.Collections.Generic import *
# Import RevitAPI
clr.AddReference("RevitAPI")
import Autodesk
from Autodesk.Revit.DB import *

doc = DocumentManager.Instance.CurrentDBDocument
uiapp = DocumentManager.Instance.CurrentUIApplication
app = uiapp.Application
uidoc=DocumentManager.Instance.CurrentUIApplication.ActiveUIDocument

colector = FilteredElementCollector(doc).OfClass(WallType).ToElements()






OUT = colector
# ----------------------------------------
name_2 = Family.Name(family=python_script_3)
ui_dropdown_data_3 = Custom[UI.DropDown Data](InputName=code_block_6, Keys=name_2, Values=python_script_3)
list_create = List.Create(item0=ui_image_data, item1=ui_dropdown_data, item2=ui_listview_data, item3=ui_dropdown_data_2, item4=ui_dropdown_data_3)
boolean = BoolSelector(true)
ui_multipleinputform = Custom[UI.MultipleInputForm ++](Description_optional=code_block, ButtonText_optional=code_block_2, Inputs=list_create, Toggle=boolean)  # Create a form with multiple inputs. see www.data-shapes.net for tutorials and infos!
python_script_4 = Python(IN[0]=ui_multipleinputform.Was_Run)
# ---------- python_script_4.python (29 lines) ----------
import clr
clr.AddReference('RevitAPI')
from Autodesk.Revit.DB import *

clr.AddReference("RevitAPIUI")
from Autodesk.Revit.UI import *

clr.AddReference("RevitNodes")
import Revit
clr.ImportExtensions(Revit.Elements)

clr.AddReference("RevitServices")
import RevitServices
from RevitServices.Persistence import DocumentManager
from RevitServices.Transactions import TransactionManager

doc = DocumentManager.Instance.CurrentDBDocument
uidoc = DocumentManager.Instance.CurrentUIApplication.ActiveUIDocument

REFRESH = IN[0]


if REFRESH:
	msg1 = "PORFAVOR SELECCIONA LAS CURVAS DESEADAS "

	f = TaskDialog.Show("Springall + MK" ,msg1)


OUT = f
# ----------------------------------------
boolean_2 = BoolSelector(true)
boolean_3 = BoolSelector(false)
if_ = If(test=python_script_4, true=boolean_2, false=boolean_3)
python_script_5 = Python(IN[0]=if_)
# ---------- python_script_5.python (46 lines) ----------
#python nodes in dynamo 1.2
#proposed by Julien Benoit @jbenoit44 
#http://aecuandme.wordpress.com/
import clr
clr.AddReference('ProtoGeometry')
from Autodesk.DesignScript.Geometry import *
# Import ToDSType(bool) extension method
clr.AddReference("RevitNodes")
import Revit
clr.ImportExtensions(Revit.Elements)
# Import geometry conversion extension methods
clr.ImportExtensions(Revit.GeometryConversion)
# Import DocumentManager and TransactionManager
clr.AddReference("RevitServices")
import RevitServices
from RevitServices.Persistence import DocumentManager
from RevitServices.Transactions import TransactionManager
from System.Collections.Generic import *
# Import RevitAPI
clr.AddReference("RevitAPI")
import Autodesk
from Autodesk.Revit.DB import *

doc = DocumentManager.Instance.CurrentDBDocument
uiapp = DocumentManager.Instance.CurrentUIApplication
app = uiapp.Application
uidoc=DocumentManager.Instance.CurrentUIApplication.ActiveUIDocument

rb = IN[0]
a = []

cc = 0




while cc < IN[0]:
	sel1 = uidoc.Selection.PickElementsByRectangle("Seleccione Las Curvas Deseadas")
	cc +=1
	a.append(sel1)

pp = UnwrapElement(a)



OUT=a
# ----------------------------------------
flatten = List.Flatten(list=python_script_5)
string_from_object = FromObject(obj=flatten)
code_block_7 = CodeBlock { "ModelCurve"; }
contains = String.Contains(str=string_from_object, searchFor=code_block_7)
filterByBoolMask = List.FilterByBoolMask(list=flatten, mask=contains)
curve = CurveElement.Curve(curveElement=filterByBoolMask.in)
byJoinedCurves = PolyCurve.ByJoinedCurves(curves=curve)
ZAxis = Vector.ZAxis()
code_block_8 = CodeBlock(L=ui_multipleinputform.User_Inputs) { L[0]; }
elevation = Level.Elevation(level=code_block_8)
code_block_9 = CodeBlock(a=elevation) { a-0.25; }
code_block_10 = CodeBlock { 0.07/2; }
code_block_11 = CodeBlock(a=code_block_9, b=code_block_10) { a-b; }
translate = Geometry.Translate(geometry=byJoinedCurves, direction=ZAxis, distance=code_block_11)
code_block_12 = CodeBlock(a=byJoinedCurves, b=translate) { l = [a,b]; }
byLoft = Surface.ByLoft(crossSections=code_block_12)
code_block_13 = CodeBlock { 0.07+0.20; }
offset = Surface.Offset(surface=byLoft, distance=code_block_13)
translate_2 = Geometry.Translate(geometry=byJoinedCurves, direction=ZAxis, distance=code_block_10)
code_block_14 = CodeBlock { 1.50; }
range = Range(start=code_block_14, end=code_block_9, step=code_block_14)
translate_3 = Geometry.Translate(geometry=translate_2, direction=ZAxis, distance=range)
code_block_15 = CodeBlock(a=translate_2, b=translate_3, c=translate) { l = [a,b,c]; }
flatten_2 = List.Flatten(list=code_block_15)
curves = PolyCurve.Curves(polyCurve=flatten_2)
midPoint = Custom[Curve.MidPoint](curve=curves)  # Get the midpoint along the Curve
byOriginNormal = Plane.ByOriginNormal(origin=midPoint)
flatten_3 = List.Flatten(list=byOriginNormal)
intersect = Geometry.Intersect(geometry=offset, other=flatten_3)
flatten_4 = List.Flatten(list=intersect)
removeDuplicates = Curve.RemoveDuplicates(curves=flatten_4)
byCurve = ModelCurve.ByCurve(curve=removeDuplicates.cleanedCurves)
code_block_16 = CodeBlock(L=ui_multipleinputform.User_Inputs) { L[2]; }
code_block_17 = CodeBlock(L=ui_multipleinputform.User_Inputs) { L[1][0]; }
python_script_6 = Python(IN[0]=byCurve, IN[1]=code_block_16, IN[2]=code_block_17)
# ---------- python_script_6.python (43 lines) ----------
# Enable Python support and load DesignScript library
import clr
clr.AddReference('ProtoGeometry')
from Autodesk.DesignScript.Geometry import *

clr.AddReference('RevitAPI')
import Autodesk
from Autodesk.Revit.DB import *

clr.AddReference('RevitServices')
from RevitServices.Transactions import TransactionManager
from RevitServices.Persistence import DocumentManager

clr.AddReference('RevitNodes')
import Revit
clr.ImportExtensions(Revit.Elements)

import math
from math import radians

doc = DocumentManager.Instance.CurrentDBDocument

mons = UnwrapElement(IN[0])
fsymont = UnwrapElement(IN[1])
lev = UnwrapElement(IN[2])




TransactionManager.Instance.EnsureInTransaction(doc)

montenes = []

for mont in mons:
	elemento = doc.Create.NewFamilyInstance(mont.GeometryCurve,fsymont,lev,Structure.StructuralType.Beam)
	montenes.append(elemento)

TransactionManager.Instance.TransactionTaskDone()




OUT = montenes
# ----------------------------------------
code_block_18 = CodeBlock { "Cross-Section Rotation"; }
code_block_19 = CodeBlock { 270; }
setParameterByName = Element.SetParameterByName(element=python_script_6, parameterName=code_block_18, value=code_block_19)
code_block_20 = CodeBlock(l=ui_multipleinputform.User_Inputs) { l[3]; }
code_block_21 = CodeBlock { 0.15; }
python_script_7 = Python(IN[0]=curve, IN[1]=code_block_20, IN[2]=code_block_17, IN[3]=code_block_9, IN[4]=code_block_21)
# ---------- python_script_7.python (53 lines) ----------
# Enable Python support and load DesignScript library
import clr
clr.AddReference('ProtoGeometry')
from Autodesk.DesignScript.Geometry import *

clr.AddReference('RevitAPI')
import Autodesk
from Autodesk.Revit.DB import *

clr.AddReference('RevitServices')
from RevitServices.Transactions import TransactionManager
from RevitServices.Persistence import DocumentManager

clr.AddReference('RevitNodes')
import Revit
clr.ImportExtensions(Revit.Elements)
clr.ImportExtensions(Revit.GeometryConversion)

clr.AddReference('System')
from System.Collections.Generic import *

import math
from math import radians

def toRVTCrvs(list):
	result = []
	for crv in list:
		curvas = crv.ToRevitType()
		result.append(curvas)
	return (result)


doc = DocumentManager.Instance.CurrentDBDocument

mcurves = toRVTCrvs(IN[0])
famsym = UnwrapElement(IN[1])
level = UnwrapElement(IN[2])

H = UnitUtils.ConvertToInternalUnits(IN[3],DisplayUnitType.DUT_METERS)
O = UnitUtils.ConvertToInternalUnits(IN[4],DisplayUnitType.DUT_METERS)

TransactionManager.Instance.EnsureInTransaction(doc)
muros = []
for crv in mcurves:
	muro = Wall.Create(doc,crv,famsym.Id,level.Id,H,O,False,False)
	muros.append(muro)

TransactionManager.Instance.TransactionTaskDone()




OUT = muros
# ----------------------------------------
name_3 = Family.Name(family=python_script_2)
structural_framing_types = StructuralFramingTypes(index=9)
