# Dynamo graph ExportParameterValueExcel.dyn (Dynamo 2.3.0.5885)

file_path = Filename("..\19_BIM Schedules\03_Walls\MNSR_AXMA_Floor Types BLD5-8.xlsx")
code_block = CodeBlock { "Dynamo"; }
code_block_2 = CodeBlock { 0; }
categories = Categories("OST_Floors")
python_script = Python(IN[0]=categories)
# ---------- python_script.python (41 lines) ----------
# Enable Python support and load DesignScript library
import clr
clr.AddReference('ProtoGeometry')
from Autodesk.DesignScript.Geometry import *

clr.AddReference("RevitNodes")

import Revit
clr.ImportExtensions(Revit.Elements)
clr.AddReference("RevitServices")

import RevitServices
from RevitServices.Persistence import DocumentManager
from RevitServices.Transactions import TransactionManager

clr.AddReference("RevitAPI")
from Autodesk.Revit.DB import *
import System

doc = DocumentManager.Instance.CurrentDBDocument

a = []

builtincat = System.Enum.GetValues(BuiltInCategory)

category = UnwrapElement(IN[0])

ID = category.Id
		
elements = FilteredElementCollector(doc).OfCategoryId(ID).WhereElementIsElementType()

parametros = []
ids = []

for el in elements:
	par = el.LookupParameter("Type Mark")
	val = par.AsString()
	id = el.Id
	parametros.append(val)
	ids.append(id)
OUT = elements.ToElements(),parametros,ids
# ----------------------------------------
code_block_3 = CodeBlock { 1; }
getItemAtIndex = List.GetItemAtIndex(list=python_script, index=code_block_3)
code_block_4 = CodeBlock { 0; }
getItemAtIndex_2 = List.GetItemAtIndex(list=python_script, index=code_block_4)
code_block_5 = CodeBlock { 2; }
getItemAtIndex_3 = List.GetItemAtIndex(list=python_script, index=code_block_5)
python_script_2 = Python(IN[0]=getItemAtIndex, IN[1]=getItemAtIndex_2, IN[2]=getItemAtIndex_3)
# ---------- python_script_2.python (22 lines) ----------
# Load the Python Standard and DesignScript Libraries
import sys
import clr
clr.AddReference('ProtoGeometry')
from Autodesk.DesignScript.Geometry import *

# The inputs to this node will be stored as a list in the IN variables.
lista  = IN[0]
tipos = UnwrapElement(IN[1])
ids = IN[2]
a = []
b = []
c=[]
for i,tp,id in zip(lista,tipos,ids):
	if not i is None:
		a.append(i)
		b.append(tp)
		c.append(id)
	else:
		pass	

OUT = a,b,c
# ----------------------------------------
transpose = List.Transpose(lists=python_script_2)
boolean = BoolSelector(true)
exportExcel = Data.ExportExcel(filePath=file_path, sheetName=code_block, startRow=code_block_2, startCol=code_block_2, data=transpose, overWrite=boolean)
type = Object.Type(obj=getItemAtIndex_3)
