# Dynamo graph FloorImportParameterValueExcel.dyn (Dynamo 2.3.0.5885)

file_path = Filename("..\19_BIM Schedules\03_Walls\MNSR_AXMA_Floor Types BLD5-8.xlsx")
file_from_path = FileObject(path=file_path)
code_block = CodeBlock { "Dynamo"; }
boolean = BoolSelector(false)
importExcel = Data.ImportExcel(file=file_from_path, sheetName=code_block, showExcel=boolean)
code_block_2 = CodeBlock { 1; }
getItemAtIndex = List.GetItemAtIndex(list=importExcel@L2, index=code_block_2)
byName = FloorType.ByName(name=getItemAtIndex)
code_block_3 = CodeBlock { "Type Mark"; }
code_block_4 = CodeBlock { 0; }
getItemAtIndex_2 = List.GetItemAtIndex(list=importExcel@L2, index=code_block_4)
setParameterByName = Element.SetParameterByName(element=byName, parameterName=code_block_3, value=getItemAtIndex_2)
