# Dynamo graph GetAllPlacedViewsInSheets.dyn (Dynamo 2.3.0.5885)
# packages: Clockwork for Dynamo 2.x 2.3.0

schedules = Custom[Sheet.Schedules]()  # frozen; package Clockwork for Dynamo 2.x; Returns all schedules placed on a specified sheet; unwired: sheet
categories = Categories("OST_Sheets")
all_elements_of_category = ElementsOfCategory(Category=categories)
code_block = CodeBlock { "Sheet Number"; }
getParameterValueByName = Element.GetParameterValueByName(element=all_elements_of_category, parameterName=code_block)
code_block_2 = CodeBlock { "C-"; }
contains = String.Contains(str=getParameterValueByName, searchFor=code_block_2)
filterByBoolMask = List.FilterByBoolMask(list=all_elements_of_category, mask=contains)
python_script = Python(IN[0]=filterByBoolMask.in)
# ---------- python_script.python (38 lines) ----------
import clr
clr.AddReference('ProtoGeometry')
from Autodesk.DesignScript.Geometry import *


clr.AddReference("RevitServices")
import RevitServices
from RevitServices.Persistence import DocumentManager
from RevitServices.Transactions import TransactionManager
from System.Collections.Generic import *


clr.AddReference('RevitAPI')
import Autodesk
from Autodesk.Revit.DB import *

sheets = UnwrapElement(IN[0])
elementlist = list()
rr = []

doc = DocumentManager.Instance.CurrentDBDocument


for sheet in sheets:
	try:
		#viewlist = []
		#collector = FilteredElementCollector(sheet.Document, sheet.Id).OfClass(ScheduleSheetInstance)
		#for item in collector:
			#viewlist.append(sheet.Document.GetElement(item.ScheduleId))
		#elementlist.append(viewlist)
		listavv = sheet.GetAllPlacedViews()
		for set in listavv:
			sheet = doc.GetElement(set)
			rr.append(sheet)
		#viewlist.append(rr)
	except:
		rr.append("ERROR EN CODIGO")
OUT = rr
# ----------------------------------------
code_block_3 = CodeBlock { "View Name"; }
code_block_4 = CodeBlock(e=python_script) { e.Name; }
code_block_5 = CodeBlock { "Gentlemen's"; "Lounge"; }
replace = String.Replace(str=code_block_4, searchFor=code_block_5.out0, replaceWith=code_block_5.out1)
setParameterByName = Element.SetParameterByName(element=python_script, parameterName=code_block_3, value=replace)
