# Dynamo graph BatchUpgrader.dyn (Dynamo 2.0.3.8104)

# group: MAIN DIALOGUE BOX UI
code_block = CodeBlock { "DETACH-MASTER"; }
file_path = Filename("..\..\UI\s+mk.png")
code_block_2 = CodeBlock { "DETACH MODEL"; }
code_block_3 = CodeBlock { "SELECCIONAR CARPETA EXISTENTE"; }
directory_path = Directory("Z:\ALTHAUS PEDREGAL\AHP 2019\REVIT\01 XREF\14 TOPOGRAFIA")
ui_directorypath_data = Custom[UI.DirectoryPath Data](InputName=code_block_3, DefaultPath=directory_path)  # Creates a DirectoryPath input for UI.MultipleInputForm ++ . Check out www.data-shapes.net for more infos!
boolean = BoolSelector(true)
ui_multipleinputform = Custom[UI.MultipleInputForm ++](Description_optional=code_block, Logo_optional=file_path, ButtonText_optional=code_block_2, Inputs=ui_directorypath_data, Toggle=boolean)  # Create a form with multiple inputs. see www.data-shapes.net for tutorials and infos!

# group: UI COMMAND
code_block_4 = CodeBlock { "SELECCIONE LOS ARCHIVOS DESEADOS"; }
file_path_2 = Filename("..\..\..\UI\s+mk.png")
code_block_5 = CodeBlock { "DETACHAR"; }
code_block_6 = CodeBlock(l=ui_multipleinputform.User_Inputs) { l[0]; }
directory_from_path = DirectoryObject(path=code_block_6)
getDirectoryContents = FileSystem.GetDirectoryContents(directory=directory_from_path)
ui_listview_data = Custom[UI.Listview Data](Keys_var=getDirectoryContents.files, Values_var=getDirectoryContents.files)  # Create data for ListView input in UI.MultiInputForm ++ . Check out www.data-shapes.net for more infos.
count = List.Count(list=getDirectoryContents.files)
code_block_7 = CodeBlock { 0; }
gt = count > code_block_7
boolean_2 = BoolSelector(true)
boolean_3 = BoolSelector(false)
if_ = If(test=gt, true=boolean_2, false=boolean_3)
ui_multipleinputform_2 = Custom[UI.MultipleInputForm ++](Description_optional=code_block_4, Logo_optional=file_path_2, ButtonText_optional=code_block_5, Inputs=ui_listview_data, Toggle=if_)

# group: REVIT DETACH BULK COMMAND()
code_block_8 = CodeBlock(L=ui_multipleinputform_2.User_Inputs) { L[0]; }
flatten = List.Flatten(list=code_block_8)
code_block_9 = CodeBlock { ".rvt"; }
code_block_10 = CodeBlock { "DETACHED.rvt"; }
replace = String.Replace(str=flatten, searchFor=code_block_9, replaceWith=code_block_10)
python_script = Python(IN[0]=flatten, IN[1]=replace)
# ---------- python_script.python (52 lines) ----------
import clr
clr.AddReference('ProtoGeometry')
from Autodesk.DesignScript.Geometry import *

clr.AddReference("RevitServices")
from RevitServices.Transactions import TransactionManager
from RevitServices.Persistence import DocumentManager

clr.AddReference("RevitAPI")
import Autodesk
from Autodesk.Revit.DB import *

clr.AddReference("RevitAPIUI")
from Autodesk.Revit.UI import *

doc = DocumentManager.Instance.CurrentDBDocument
uiapp = DocumentManager.Instance.CurrentUIApplication
app = uiapp.Application


if isinstance(IN[0],list):
	files = IN[0]
else:
	files = [IN[0]]
	
if isinstance(IN[1],list):
	names = IN[1]
else:
	names = [IN[1]]
	

options = OpenOptions()
options.DetachFromCentralOption = DetachFromCentralOption.DetachAndPreserveWorksets

worksharingOptions = WorksharingSaveAsOptions()
worksharingOptions.SaveAsCentral = True

SaveOptions = SaveAsOptions()
SaveOptions.SetWorksharingOptions(worksharingOptions)

for file,name in zip(files,names):
	modelpath = FilePath(file)
	newdoc = app.OpenDocumentFile(modelpath,options)
	newname = name
	newdoc.SaveAs(newname,SaveOptions)
	newdoc.Close(False)


msg  = "SE HAN DETACHADO CON EXITO " +" " + str(len(files)) + " ARCHIVOS!"
TaskDialog.Show("SPRINGALL + MK" , msg)

OUT = "SUCCESS FILES!"
# ----------------------------------------
