# Dynamo graph Delete WallOpenings.dyn (Dynamo 2.0.3.8104)

all_elements_in_active_view = ElementsInView()
string_from_object = FromObject(obj=all_elements_in_active_view)
code_block = CodeBlock { "Opening"; }
eq = string_from_object == code_block
filterByBoolMask = List.FilterByBoolMask(list=all_elements_in_active_view, mask=eq)
delete = archilab.Revit.Elements.Elements.Delete(element=filterByBoolMask.in)
