# Dynamo graph Purgar Filtros.dyn (Dynamo 2.0.3.8104)

code_block = CodeBlock { "Springall + MK"; }
file_path = Filename("..\..\..\UI\s+mk.png")
code_block_2 = CodeBlock { "BORRAR FILTROS"; }
code_block_3 = CodeBlock { "lista de filtros"; }
tipos_de_elemento = ElementTypes(index=127)
all_elements_of_type = ElementsOfType(element_type=tipos_de_elemento)
name = Family.Name(family=all_elements_of_type)
boolean = BoolSelector(false)
ui_listview_data = Custom[UI.Listview Data](InputName=code_block_3, Keys_var=name, Values_var=all_elements_of_type, ShowId_optionnal=boolean)  # Create data for ListView input in UI.MultiInputForm ++ . Check out www.data-shapes.net for more infos.
boolean_2 = BoolSelector(true)
ui_multipleinputform = Custom[UI.MultipleInputForm ++](Description_optional=code_block, Logo_optional=file_path, ButtonText_optional=code_block_2, Inputs=ui_listview_data, Toggle=boolean_2)  # Create a form with multiple inputs. see www.data-shapes.net for tutorials and infos!
flatten = List.Flatten(list=ui_multipleinputform.User_Inputs)
delete = archilab.Revit.Elements.Elements.Delete(element=flatten)
