# Dynamo graph Purgar Parámetros.dyn (Dynamo 2.0.3.8104)

# group: FRONTEND BASICS
code_block = CodeBlock { "Purge Project Parameters"; }
file_path = Filename("\\slserver\00-PROYECTOS\BIM S+MK\04 Rutinas\Springall+MK\UI\s+mk.png")
code_block_2 = CodeBlock { "Purge Unused"; }
boolean = BoolSelector(true)

code_block_3 = CodeBlock { "Clean MetADATA"; }
file_path_2 = Filename("\\slserver\00-PROYECTOS\BIM S+MK\04 Rutinas\Springall+MK\UI\PURGE PARAM.png")
ui_image_data = Custom[UI.Image Data](ImageTitle=code_block_3, Image_var=file_path_2)  # Places an image on UI.MultipleInutForm ++ .
code_block_4 = CodeBlock { "Project & Shared Parameters List"; }

# group: GET PARAMETERS
boolean_2 = BoolSelector(true)
projectParameters = Custom[Document.ProjectParameters](toggle=boolean_2)  # Retrieves all project parameters and the categories they have been assigned to
flatten = List.Flatten(list=projectParameters.paramName)
flatten_2 = List.Flatten(list=projectParameters.parameterElement)
code_block_5 = CodeBlock { true; false; }

ui_listview_data = Custom[UI.Listview Data](InputName=code_block_4, Keys_var=flatten, Values_var=flatten_2, ShowElementCount_optionnal=code_block_5.out0, ShowId_optionnal=code_block_5.out1)  # Create data for ListView input in UI.MultiInputForm ++ . Check out www.data-shapes.net for more infos.
code_block_6 = CodeBlock(A=ui_image_data, B=ui_listview_data) { [A,B]; }
ui_multipleinputform = Custom[UI.MultipleInputForm ++](Description_optional=code_block, Logo_optional=file_path, ButtonText_optional=code_block_2, Inputs=code_block_6, Toggle=boolean)  # Create a form with multiple inputs. see www.data-shapes.net for tutorials and infos!
code_block_7 = CodeBlock { 0; }
getItemAtIndex = List.GetItemAtIndex(list=ui_multipleinputform.User_Inputs, index=code_block_7)
delete = archilab.Revit.Elements.Elements.Delete(element=getItemAtIndex)
