# Dynamo graph Purgar Vistas.dyn (Dynamo 2.0.3.8104)

code_block = CodeBlock { "Springall + MK"; }
file_path = Filename("\\slserver\00-PROYECTOS\BIM S+MK\04 Rutinas\Springall+MK\UI\s+mk.png")
code_block_2 = CodeBlock { "PURGAR VISTAS"; }
code_block_3 = CodeBlock { "LISTA DE VISTAS A BORRAR"; }
python_script = Python()  # unwired: IN[0]
# ---------- python_script.python (26 lines) ----------
import clr
clr.AddReference('ProtoGeometry')
from Autodesk.DesignScript.Geometry import *

clr.AddReference('RevitAPI')
from Autodesk.Revit.DB import * 
clr.AddReference('RevitServices')

from RevitServices.Persistence import DocumentManager
from RevitServices.Transactions import TransactionManager

doc = DocumentManager.Instance.CurrentDBDocument
vlist = []

views = FilteredElementCollector(doc).OfClass(View).WhereElementIsNotElementType()

vistas = []

for view in views:
	if view.IsTemplate == True or view.IsTemplate == None:
		vlist.append(view)
	else:
		vistas.append(view)
	

OUT = vistas
# ----------------------------------------
name = Element.Name(element=python_script)
boolean = BoolSelector(false)
ui_listview_data = Custom[UI.Listview Data](InputName=code_block_3, Keys_var=name, Values_var=python_script, ShowId_optionnal=boolean)  # Create data for ListView input in UI.MultiInputForm ++ . Check out www.data-shapes.net for more infos.
boolean_2 = BoolSelector(true)
ui_multipleinputform = Custom[UI.MultipleInputForm ++](Description_optional=code_block, Logo_optional=file_path, ButtonText_optional=code_block_2, Inputs=ui_listview_data, Toggle=boolean_2)  # Create a form with multiple inputs. see www.data-shapes.net for tutorials and infos!
flatten = List.Flatten(list=ui_multipleinputform.User_Inputs)
isNull = Object.IsNull(obj=flatten)
filterByBoolMask = List.FilterByBoolMask(list=flatten, mask=isNull)
delete = archilab.Revit.Elements.Elements.Delete(element=filterByBoolMask.out)
