# Dynamo graph PurgeActiveView.dyn (Dynamo 2.0.3.8104)

all_elements_in_active_view = ElementsInView()

# group: USER INTERFACE ()
code_block = CodeBlock { "Purgador Por Vista Actual"; }
file_path = Filename("..\..\..\UI\s+mk.png")
code_block_2 = CodeBlock { "Purgar"; }
code_block_3 = CodeBlock { "CATEGORIAS"; }
categories_list = Custom[Categories list]()  # Gives list of all Revit categories and a matching list of their names
ui_dropdown_data = Custom[UI.DropDown Data](InputName=code_block_3, Keys_var=categories_list.Category_name_s, Values_var=categories_list.Category_name_s)  # Create data for DropDown input in UI.MultiInputForm ++ . Check out www.data-shapes.net for more infos.
boolean = BoolSelector(true)
ui_multipleinputform = Custom[UI.MultipleInputForm ++](Description_optional=code_block, Logo_optional=file_path, ButtonText_optional=code_block_2, Inputs=ui_dropdown_data, Toggle=boolean)  # Create a form with multiple inputs. see www.data-shapes.net for tutorials and infos!

code_block_4 = CodeBlock(L=ui_multipleinputform.User_Inputs) { L[0]; }
string_from_object = FromObject(obj=code_block_4)
getCategory = Element.GetCategory(element=all_elements_in_active_view)
string_from_object_2 = FromObject(obj=getCategory)
eq = string_from_object == string_from_object_2
filterByBoolMask = List.FilterByBoolMask(list=all_elements_in_active_view, mask=eq)
delete = archilab.Revit.Elements.Elements.Delete(element=filterByBoolMask.in)
