# Dynamo graph PurgeMaster.dyn (Dynamo 2.0.3.8104)

# group: USER INTERFACE ()
code_block = CodeBlock { "PURGE MODEL"; }
file_path = Filename("..\..\UI\s+mk.png")
code_block_2 = CodeBlock { "CLEAN "; }
code_block_3 = CodeBlock { "CATEGORIAS REVIT"; "TIPOS DE ELEMENTOS"; }
categories_list = Custom[Categories list]()  # Gives list of all Revit categories and a matching list of their names
ui_dropdown_data = Custom[UI.DropDown Data](InputName=code_block_3.out0, Keys=categories_list.Category_name_s, Values=categories_list.Category_name_s)  # Create data for DropDown input in UI.MultiInputForm ++ . Check out www.data-shapes.net for more infos.
elementTypes = Custom[Document.ElementTypes]()
ui_dropdown_data_2 = Custom[UI.DropDown Data](InputName=code_block_3.out1, Keys=elementTypes.elementTypeNames, Values=elementTypes.elementTypes)
code_block_4 = CodeBlock { "SELECCIONE MÉTODO"; }
boolean = BoolSelector(true)
code_block_5 = CodeBlock { "SI = CAT , NO = TYPE"; }
ui_boolean_input = Custom[UI.Boolean input](InputName=code_block_4, DefaultValue=boolean, SideText=code_block_5)  # Creates a boolean input for UI.MultipleInputForm ++ . Check out www.data-shapes.net for more infos!
code_block_6 = CodeBlock(A=ui_dropdown_data, B=ui_dropdown_data_2, C=ui_boolean_input) { L = [A,B,C]; }
boolean_2 = BoolSelector(true)
ui_multipleinputform = Custom[UI.MultipleInputForm ++](Description_optional=code_block, Logo_optional=file_path, ButtonText_optional=code_block_2, Inputs=code_block_6, Toggle=boolean_2)  # Create a form with multiple inputs. see www.data-shapes.net for tutorials and infos!

booleano = CodeBlock(l=ui_multipleinputform.User_Inputs) { l[2]; }
code_block_7 = CodeBlock(L=ui_multipleinputform.User_Inputs) { L[0]; }
byName = Category.ByName(name=code_block_7)
all_elements_of_category = ElementsOfCategory(Category=byName)
code_block_8 = CodeBlock(L=ui_multipleinputform.User_Inputs) { L[1]; }
all_elements_of_type = ElementsOfType(element_type=code_block_8)
python_script = Python(IN[0]=booleano, IN[1]=all_elements_of_category, IN[2]=all_elements_of_type)
# ---------- python_script.python (14 lines) ----------
# Enable Python support and load DesignScript library
import clr
clr.AddReference('ProtoGeometry')
from Autodesk.DesignScript.Geometry import *


bool = IN[0]
cats = IN[1]
types = IN[2]

if bool:
	OUT = cats
else:
	OUT = types
# ----------------------------------------
delete = archilab.Revit.Elements.Elements.Delete(element=python_script)
