# Dynamo graph AXM-Asignar MetaData.dyn (Dynamo 2.3.0.5885)
# packages: Data-Shapes 2022.2.96

code_block = CodeBlock { "FAMILY TYPES"; }

# group: 1ER DIALOGO (SELECCION POR CATEGORIA)
code_block_2 = CodeBlock { "REVIT MODEL CATEGORIES"; }
categories_list = Custom[Categories list]()  # package Data-Shapes; Gives list of all Revit categories and a matching list of their names
ui_listview_data = Custom[UI.Listview Data](InputName=code_block_2, Keys=categories_list.Category_name_s, Values=categories_list.Revit_Categories)  # package Data-Shapes; Create data for ListView input in UI.MultiInputForm ++ . Check out www.data-shapes.net for more infos.
code_block_3 = CodeBlock { "RELAOAD DATABASE"; }
boolean = BoolSelector(true)
code_block_4 = CodeBlock { "BROWSE"; }
ui_boolean_input = Custom[UI.Boolean input](InputName=code_block_3, DefaultValue=boolean, SideText=code_block_4)  # package Data-Shapes; Creates a boolean input for UI.MultipleInputForm ++ . Check out www.data-shapes.net for more infos!
code_block_5 = CodeBlock { "FILTRAR POR CATEGORIA"; }
boolean_2 = BoolSelector(false)
ui_boolean_input_2 = Custom[UI.Boolean input](InputName=code_block_5, DefaultValue=boolean_2)

code_block_6 = CodeBlock(A=ui_listview_data, B=ui_boolean_input, C=ui_boolean_input_2) { [A,B,C]; }

# group: 1ER FORMULARIO
code_block_7 = CodeBlock { "KEYNOTE MASTER-MF"; }
file_path = Filename("Y:\BIM S+MK\04 Rutinas\Springall+MK\UI\s+mk.png")
code_block_8 = CodeBlock { "SELECCCIONAR CATEGORIAS"; }
boolean_3 = BoolSelector(true)
code_block_9 = CodeBlock { 750; 650; }
ui_multipleinputform = Custom[UI.MultipleInputForm ++](Description_optional=code_block_7, Logo_optional=file_path, ButtonText_optional=code_block_8, Inputs=code_block_6, Toggle=boolean_3, MaxHeight_optional=code_block_9.out0, Width_optional=code_block_9.out1)  # package Data-Shapes; Create a form with multiple inputs. see www.data-shapes.net for tutorials and infos!
code_block_10 = CodeBlock(L=ui_multipleinputform.User_Inputs) { L[0]; L[1]; L[2]; }
type_collector_by_categorie = Python(IN[0]=code_block_10.out0)
# ---------- type_collector_by_categorie.python (33 lines) ----------
# Enable Python support and load DesignScript library
import clr
clr.AddReference('ProtoGeometry')
from Autodesk.DesignScript.Geometry import *

clr.AddReference("RevitNodes")

import Revit
clr.ImportExtensions(Revit.Elements)
clr.AddReference("RevitServices")

import RevitServices
from RevitServices.Persistence import DocumentManager
from RevitServices.Transactions import TransactionManager

clr.AddReference("RevitAPI")
from Autodesk.Revit.DB import *
import System

doc = DocumentManager.Instance.CurrentDBDocument

catList = IN[0]

result = []
names = []
filtros = []
for catname in catList:
	catId = []
	names.append(catname.Name)

	
	
OUT = names
# ----------------------------------------

code_block_11 = CodeBlock { "Materials"; }
eq = categories_list.Category_name_s == code_block_11
filterByBoolMask = List.FilterByBoolMask(list=categories_list.Revit_Categories, mask=eq)
material_id = Python(IN[0]=filterByBoolMask.in)
# ---------- material_id.python (33 lines) ----------
# Enable Python support and load DesignScript library
import clr
clr.AddReference('ProtoGeometry')
from Autodesk.DesignScript.Geometry import *

clr.AddReference("RevitNodes")

import Revit
clr.ImportExtensions(Revit.Elements)
clr.AddReference("RevitServices")

import RevitServices
from RevitServices.Persistence import DocumentManager
from RevitServices.Transactions import TransactionManager

clr.AddReference("RevitAPI")
from Autodesk.Revit.DB import *
import System

doc = DocumentManager.Instance.CurrentDBDocument

catList = IN[0]

result = []
names = []
filtros = []
for catname in catList:
	catId = []
	names.append(catname.Name)

ll = catList[0]	
	
OUT = ll.Id
# ----------------------------------------
code_block_12 = CodeBlock { 450; }
code_block_13 = CodeBlock { true; }
code_block_14 = CodeBlock { "CLASSIFICATION CODE"; }
file_path_2 = Filename("C:\Users\SMK\BIM 360\Akurat - Arq\Explanada AGS\01.ARQUITECTURA (1)\CDE DATA\00 MF_S-MK EXPLANADA ARQUITECTURA r1.xlsx")

# group: RELOAD DATA BASE
code_block_15 = CodeBlock { "RELOAD DATABASE"; }
code_block_16 = CodeBlock { "RUTA DE ARCHIVO EXCEL"; }
code_block_17 = CodeBlock { "BUSCAR"; }
ui_filepath_data = Custom[UI.FilePath Data](InputName=code_block_16, DefaulPath=file_path_2, ButtonText=code_block_17)  # package Data-Shapes; Create filepath input for UI.MultipleInputForm ++ . Check out www.data-shapes.net for more infos !
ui_multipleinputform_2 = Custom[UI.MultipleInputForm ++](Description_optional=code_block_7, Logo_optional=file_path, ButtonText_optional=code_block_15, Inputs=ui_filepath_data, Toggle=code_block_10.out1, MaxHeight_optional=code_block_9.out0, Width_optional=code_block_9.out1)

code_block_18 = CodeBlock(L=ui_multipleinputform_2.User_Inputs) { L[0]; }
if_ = If(test=ui_multipleinputform_2.Was_Run, true=code_block_18, false=file_path_2)
file_from_path = FileObject(path=if_)
code_block_19 = CodeBlock { "Hoja1"; }
code_block_20 = CodeBlock { false; }
importExcel = Data.ImportExcel(file=file_from_path, sheetName=code_block_19, showExcel=code_block_20)
code_block_21 = CodeBlock(ll=importExcel) { 16..(List.Count(ll)-1); }
getItemAtIndex = List.GetItemAtIndex(list=importExcel, index=code_block_21)
transpose = List.Transpose(lists=getItemAtIndex)
identity = Object.Identity(obj=transpose)

# group: OUTPUT : 1ER FORMULARIO
type_collector_by_categorie_2 = Python(IN[0]=code_block_10.out0, IN[1]=material_id)
# ---------- type_collector_by_categorie_2.python (46 lines) ----------
# Enable Python support and load DesignScript library
import clr
clr.AddReference('ProtoGeometry')
from Autodesk.DesignScript.Geometry import *

clr.AddReference("RevitNodes")

import Revit
clr.ImportExtensions(Revit.Elements)
clr.AddReference("RevitServices")

import RevitServices
from RevitServices.Persistence import DocumentManager
from RevitServices.Transactions import TransactionManager

clr.AddReference("RevitAPI")
from Autodesk.Revit.DB import *
import System

doc = DocumentManager.Instance.CurrentDBDocument

catList = IN[0]
mat_Id = IN[1]

result = []

filtros = []
for catname in catList:
	catId = []
	
	filtros = []
	catId.append(catname.Id)
	for cid in catId:
		if cid == mat_Id:
			collector = FilteredElementCollector(doc)
			filtro = collector.OfCategoryId(cid).WhereElementIsNotElementType()
			filtros.append(filtro.ToElements())
		else:
			collector = FilteredElementCollector(doc)
			filtro = collector.OfCategoryId(cid).WhereElementIsElementType()
			filtros.append(filtro.ToElements())
			
	result.append(filtros[0])
	
	
OUT = result
# ----------------------------------------
classificationCode = Python(IN[0]=type_collector_by_categorie, IN[1]=identity)  # "GetMasterFormatCSI.ClassificationCode"
# ---------- classificationCode.python (41 lines) ----------
# Enable Python support and load DesignScript library
import clr
clr.AddReference('ProtoGeometry')
from Autodesk.DesignScript.Geometry import *


catList = IN[0]
claves = IN[1][0]
descripicones = IN[1][1]
partidas = IN[1][2]
categorias = IN[1][4]

matrix = zip(claves,descripicones,partidas,categorias)
a = []
b = []
c = []
for cl,des,par,cat in matrix:
	if cat in catList:
		a.append(cl)
		b.append(des)
		c.append(cat)
	else:
		pass

fliped = zip(a,b,c)
r = []

cate_u = set(c)

for cates in cate_u:
	subl = []
	for i,b,x in fliped:
		if cates == x:
			subl.append(i)
			
	r.append(subl)
	



OUT = r
# ----------------------------------------
classificationDescription = Python(IN[0]=type_collector_by_categorie, IN[1]=identity)  # "GetMasterFormatCSI.ClassificationDescription"
# ---------- classificationDescription.python (29 lines) ----------
# Enable Python support and load DesignScript library
import clr
clr.AddReference('ProtoGeometry')
from Autodesk.DesignScript.Geometry import *


catList = IN[0]
claves = IN[1][0]
descripicones = IN[1][1]
partidas = IN[1][2]
categorias = IN[1][4]

matrix = zip(claves,descripicones,partidas,categorias)
a = []
b = []
c = []
for cl,des,par,cat in matrix:
	if cat in catList:
		a.append(cl)
		b.append(des)
		c.append(cat)
	else:
		pass

	



OUT = b
# ----------------------------------------

flatten = List.Flatten(list=type_collector_by_categorie_2)
name = Element.Name(element=flatten)
getCategory = Element.GetCategory(element=flatten)
concats = Python(IN[0]=name, IN[1]=getCategory, IN[2]=flatten)
# ---------- concats.python (38 lines) ----------
# Enable Python support and load DesignScript library
import clr
clr.AddReference('ProtoGeometry')
from Autodesk.DesignScript.Geometry import *

clr.AddReference("RevitNodes")

import Revit
clr.ImportExtensions(Revit.Elements)
clr.AddReference("RevitServices")

import RevitServices
from RevitServices.Persistence import DocumentManager
from RevitServices.Transactions import TransactionManager

clr.AddReference("RevitAPI")
from Autodesk.Revit.DB import *
import System

doc = DocumentManager.Instance.CurrentDBDocument

types = IN[0]
catnames = IN[1]
reserv = IN[2]

result = []
for typ,cats,rvt in zip(types,catnames,reserv):
	if typ is None:
		names = rvt.ToString()
		fullname = names + " - " + cats.ToString()
		result.append(fullname)
	else:
		names = typ.ToString()
		fullname = names + " - " + cats.ToString()
		result.append(fullname)
	
	
OUT = result
# ----------------------------------------
ui_listview_data_2 = Custom[UI.Listview Data](InputName=code_block, Keys=concats, Values=flatten, Height_optionnal=code_block_12, ShowElementCount_optionnal=code_block_13)
getomniclass_csi = Python(IN[0]=type_collector_by_categorie, IN[1]=identity)  # "GetOmniClass CSI.ClassificationRVT-CAT"
# ---------- getomniclass_csi.python (41 lines) ----------
# Enable Python support and load DesignScript library
import clr
clr.AddReference('ProtoGeometry')
from Autodesk.DesignScript.Geometry import *


catList = IN[0]
claves = IN[1][0]
descripicones = IN[1][1]
partidas = IN[1][2]
categorias = IN[1][4]

matrix = zip(claves,descripicones,partidas,categorias)
a = []
b = []
c = []
for cl,des,par,cat in matrix:
	if cat in catList:
		a.append(cl)
		b.append(des)
		c.append(cat)
	else:
		pass

fliped = zip(a,b,c)
r = []

cate_u = set(c)

for cates in cate_u:
	subl = []
	for i,b,x in fliped:
		if cates == x:
			subl.append(x)
			
	r.append(subl)
	



OUT = r
# ----------------------------------------
flatten_2 = List.Flatten(list=getomniclass_csi)
flatten_3 = List.Flatten(list=classificationCode)
flatten_4 = List.Flatten(list=classificationDescription)
concats_2 = Python(IN[0]=flatten_2, IN[1]=flatten_3, IN[2]=flatten_4)
# ---------- concats_2.python (33 lines) ----------
# Enable Python support and load DesignScript library
import clr
clr.AddReference('ProtoGeometry')
from Autodesk.DesignScript.Geometry import *

clr.AddReference("RevitNodes")

import Revit
clr.ImportExtensions(Revit.Elements)
clr.AddReference("RevitServices")

import RevitServices
from RevitServices.Persistence import DocumentManager
from RevitServices.Transactions import TransactionManager

clr.AddReference("RevitAPI")
from Autodesk.Revit.DB import *
import System

doc = DocumentManager.Instance.CurrentDBDocument

types = IN[0]
catnames = IN[1]
desc = IN[2]

result = []
for typ,cats,DESC in zip(types,catnames,desc):
	names = typ.ToString()
	fullname = names + " - " + cats + " - " + DESC
	result.append(fullname)
	
	
OUT = result
# ----------------------------------------
code_block_22 = CodeBlock { 450; }
ui_treeview_input = Custom[UI.TreeView input](InputName=code_block_14, Data=concats_2, Height=code_block_22)  # package Data-Shapes; Create a TreeView input for UI.MultipleInputForm ++ . Check out www.data-shapes.net for more infos and tips!

# group: 2DA(FORMAULARIO)
code_block_23 = CodeBlock { "ASIGNAR"; }
code_block_24 = CodeBlock(A=ui_listview_data_2, B=ui_treeview_input) { [A,B]; }
code_block_25 = CodeBlock { 1200; }
ui_multipleinputform_3 = Custom[UI.MultipleInputForm ++](Description_optional=code_block_7, Logo_optional=file_path, ButtonText_optional=code_block_23, Inputs=code_block_24, Toggle=ui_multipleinputform.Was_Run, MaxHeight_optional=code_block_9.out0, Width_optional=code_block_25)

code_block_26 = CodeBlock(L=ui_multipleinputform_3.User_Inputs) { L[0]; L[1]; }
code_block_27 = CodeBlock { "Keynote"; "Type Mark"; "Description"; }
code_block_28 = CodeBlock { " - "; }
split = String.Split(str=code_block_26.out1, separator0=code_block_28)
code_block_29 = CodeBlock { 1; 2; }
getItemAtIndex_2 = List.GetItemAtIndex(list=split@L2, index=code_block_29.out1)
python_script = Python(IN[0]=getItemAtIndex_2)
# ---------- python_script.python (27 lines) ----------
import clr
clr.AddReference('RevitAPI')
from Autodesk.Revit.DB import *

clr.AddReference("RevitAPIUI")
from Autodesk.Revit.UI import *

clr.AddReference("RevitNodes")
import Revit
clr.ImportExtensions(Revit.Elements)

clr.AddReference("RevitServices")
import RevitServices
from RevitServices.Persistence import DocumentManager
from RevitServices.Transactions import TransactionManager

doc = DocumentManager.Instance.CurrentDBDocument
uidoc = DocumentManager.Instance.CurrentUIApplication.ActiveUIDocument

values = IN[0]


for var in values:
	if len(values) == 1:
		OUT = var
	else:
		OUT = values
# ----------------------------------------
setParameterByName = Element.SetParameterByName(element=code_block_26.out0, parameterName=code_block_27.out2, value=python_script)
getItemAtIndex_3 = List.GetItemAtIndex(list=split@L2, index=code_block_29.out0)
python_script_2 = Python(IN[0]=getItemAtIndex_3)  # same code as python_script
setParameterByName_2 = Element.SetParameterByName(element=code_block_26.out0, parameterName=code_block_27.out1, value=python_script_2)
setParameterByName_3 = Element.SetParameterByName(element=code_block_26.out0, parameterName=code_block_27.out0, value=python_script_2)
python_script_3 = Python(IN[0]=setParameterByName_3)
# ---------- python_script_3.python (31 lines) ----------
import clr
clr.AddReference('RevitAPI')
from Autodesk.Revit.DB import *

clr.AddReference("RevitAPIUI")
from Autodesk.Revit.UI import *

clr.AddReference("RevitNodes")
import Revit
clr.ImportExtensions(Revit.Elements)

clr.AddReference("RevitServices")
import RevitServices
from RevitServices.Persistence import DocumentManager
from RevitServices.Transactions import TransactionManager

doc = DocumentManager.Instance.CurrentDBDocument
uidoc = DocumentManager.Instance.CurrentUIApplication.ActiveUIDocument

elist = IN[0]

llist = len(elist)

stlist = llist.ToString()

msg1 = "SE HAN ASIGNADO :" + stlist + "CLASIFICACIONES"

TaskDialog.Show("Springall + MK" ,msg1)


OUT = 0
# ----------------------------------------
