# Dynamo graph AXM_MasterFormatTypeInjection.dyn (Dynamo 2.3.0.5885)

# group: excel import
file_path = Filename("..\..\..\21_MasterFormat\REVIT KEYNOTE TABLE\MNSR_AXM_KEYNOTE-TABLE_CD.xlsx")  # graph input
file_from_path = FileObject(path=file_path)
code_block = CodeBlock { "Hoja1"; }
importExcel = Data.ImportExcel(file=file_from_path, sheetName=code_block)
transpose = List.Transpose(lists=importExcel)

# group: engine
code_block_2 = CodeBlock { 16; }
dropItems = List.DropItems(list=transpose@L2, amount=code_block_2)
code_block_3 = CodeBlock { 0; 1; 3; 2; }
claves = List.GetItemAtIndex(list=dropItems, index=code_block_3.out0)
descripciones = List.GetItemAtIndex(list=dropItems, index=code_block_3.out1)
family_types = List.GetItemAtIndex(list=dropItems, index=code_block_3.out2)
python_script = Python(IN[0]=claves, IN[1]=descripciones, IN[2]=family_types)
# ---------- python_script.python (84 lines) ----------
# Enable Python support and load DesignScript library
import clr
clr.AddReference('ProtoGeometry')
from Autodesk.DesignScript.Geometry import *

clr.AddReference("RevitNodes")

import Revit
clr.ImportExtensions(Revit.Elements)
clr.AddReference("RevitServices")

import RevitServices
from RevitServices.Persistence import DocumentManager
from RevitServices.Transactions import TransactionManager

clr.AddReference("RevitAPI")
from Autodesk.Revit.DB import *
from Autodesk.Revit.DB.Architecture import *

clr.AddReference('System')
from System.Collections.Generic import *

def buscarElementType(nombre,data):
	tipo = None
	for ele in data:
		ttname = Element.Name.__get__(ele)
		if nombre == ttname:
			tipo = ele
		else:
			pass
	return tipo

doc = DocumentManager.Instance.CurrentDBDocument
uiapp = DocumentManager.Instance.CurrentUIApplication
app = uiapp.Application

#category list
cat_list = List[BuiltInCategory]()
cat_list.Add(BuiltInCategory.OST_Walls)
cat_list.Add(BuiltInCategory.OST_Floors)
cat_list.Add(BuiltInCategory.OST_Roofs)
cat_list.Add(BuiltInCategory.OST_Ceilings)
cat_list.Add(BuiltInCategory.OST_Stairs)
cat_list.Add(BuiltInCategory.OST_Ramps)
cat_list.Add(BuiltInCategory.OST_Railings)
cat_list.Add(BuiltInCategory.OST_CurtainWallPanels)
cat_list.Add(BuiltInCategory.OST_CurtainWallMullions)
cat_list.Add(BuiltInCategory.OST_StructuralFraming)
cat_list.Add(BuiltInCategory.OST_StructuralColumns)
cat_list.Add(BuiltInCategory.OST_PlumbingFixtures)
cat_list.Add(BuiltInCategory.OST_GenericModel)
cat_list.Add(BuiltInCategory.OST_SpecialityEquipment)
cat_list.Add(BuiltInCategory.OST_Windows)
cat_list.Add(BuiltInCategory.OST_StructuralStiffener)
cat_list.Add(BuiltInCategory.OST_Doors)

filter = ElementMulticategoryFilter(cat_list)
collector = FilteredElementCollector(doc).WherePasses(filter).WhereElementIsElementType()

ll = zip(IN[0],IN[1],IN[2])

lista = []


#revit inpunts
types = []
keynote = []
descripciones = []

for element in collector:
	lista.append(element)

for clave,desc,tipos in ll:
	element = buscarElementType(tipos,lista)
	if element != None:
		
		types.append(element)
		keynote.append(clave)
		descripciones.append(desc)
		



OUT = types,keynote,descripciones
# ----------------------------------------

revit_types = List.GetItemAtIndex(list=python_script, index=code_block_3.out0)
boolean = BoolSelector(false)
clean = List.Clean(list=revit_types, preserveIndices=boolean)
code_block_4 = CodeBlock { "Keynote"; "Description"; "Type Mark"; }
revit_keynotes = List.GetItemAtIndex(list=python_script, index=code_block_3.out1)
clean_2 = List.Clean(list=revit_keynotes, preserveIndices=boolean)
setParameterByName = Element.SetParameterByName(element=clean, parameterName=code_block_4.out0, value=clean_2)
setParameterByName_2 = Element.SetParameterByName(element=clean, parameterName=code_block_4.out2, value=clean_2)
revit_descriptions = List.GetItemAtIndex(list=python_script, index=code_block_3.out3)
clean_3 = List.Clean(list=revit_descriptions, preserveIndices=boolean)
setParameterByName_3 = Element.SetParameterByName(element=clean, parameterName=code_block_4.out1, value=clean_3)
