# Dynamo graph MasterFormat Injection.dyn (Dynamo 2.3.0.5885)

file_path = Filename("..\..\..\21_MasterFormat\REVIT KEYNOTE TABLE\MNSR_AXM_KEYNOTE-TABLE_CD.xlsx")  # graph input
file_from_path = FileObject(path=file_path)
code_block = CodeBlock { "Hoja1"; }
importExcel = Data.ImportExcel(file=file_from_path, sheetName=code_block)
transpose = List.Transpose(lists=importExcel)
code_block_2 = CodeBlock { 3; }
getItemAtIndex = List.GetItemAtIndex(list=transpose, index=code_block_2)
code_block_3 = CodeBlock { 1; }
getItemAtIndex_2 = List.GetItemAtIndex(list=transpose, index=code_block_3)
code_block_4 = CodeBlock { 0; }
getItemAtIndex_3 = List.GetItemAtIndex(list=transpose, index=code_block_4)
python_script = Python(IN[0]=getItemAtIndex, IN[1]=getItemAtIndex_2, IN[2]=getItemAtIndex_3)
# ---------- python_script.python (25 lines) ----------
# Load the Python Standard and DesignScript Libraries
import sys
import clr
clr.AddReference('ProtoGeometry')
from Autodesk.DesignScript.Geometry import *

# The inputs to this node will be stored as a list in the IN variables.
tipos = IN[0]
descripciones = IN[1]
keynote = IN[2]

data = zip(tipos,descripciones,keynote)

a = []
b = []
c = []
for tp,desc,key in data:
	if tp is None:
		pass
	else:
		a.append(tp)
		b.append(desc)
		c.append(key)

OUT = a,b,c
# ----------------------------------------
getItemAtIndex_4 = List.GetItemAtIndex(list=python_script, index=code_block_4)
byName = WallType.ByName(name=getItemAtIndex_4)
code_block_5 = CodeBlock { "Description"; "Type Mark"; "Keynote"; }
getItemAtIndex_5 = List.GetItemAtIndex(list=python_script, index=code_block_3)
setParameterByName = Element.SetParameterByName(element=byName, parameterName=code_block_5.out0, value=getItemAtIndex_5)
code_block_6 = CodeBlock { 2; }
getItemAtIndex_6 = List.GetItemAtIndex(list=python_script, index=code_block_6)
setParameterByName_2 = Element.SetParameterByName(element=byName, parameterName=code_block_5.out2, value=getItemAtIndex_6)
setParameterByName_3 = Element.SetParameterByName(element=byName, parameterName=code_block_5.out1, value=getItemAtIndex_6)
