# Dynamo graph OPT2-AXM_MasterFormatTypeInjection.dyn (Dynamo 2.1.0.7500)

# group: excel import
file_path = Filename("..\..\..\21_MasterFormat\REVIT KEYNOTE TABLE\MNSR_AXM_KEYNOTE-TABLE_CD.xlsx")  # graph input
file_from_path = FileObject(path=file_path)
code_block = CodeBlock { "Hoja1"; }

boolean = BoolSelector(true)
read_excel = Custom[Read Excel](filePath=file_from_path, runIt=boolean, sheetName=code_block)  # This node will read an excel file. You can read an entore sheet contents, read from specific origin cell, read only specific range, or do all of the former for multiple sheets at the same time.

# group (continued): excel import
transpose = List.Transpose(lists=read_excel)

# group: engine
code_block_2 = CodeBlock { 16; }
dropItems = List.DropItems(list=transpose@L2, amount=code_block_2)
code_block_3 = CodeBlock { 0; 1; 3; 2; }
claves = List.GetItemAtIndex(list=dropItems, index=code_block_3.out0)
descripciones = List.GetItemAtIndex(list=dropItems, index=code_block_3.out1)
family_types = List.GetItemAtIndex(list=dropItems, index=code_block_3.out2)
python_script = Python(IN[0]=claves, IN[1]=descripciones, IN[2]=family_types)
# ---------- python_script.python (84 lines) ----------
# Enable Python support and load DesignScript library
import clr
clr.AddReference('ProtoGeometry')
from Autodesk.DesignScript.Geometry import *

clr.AddReference("RevitNodes")

import Revit
clr.ImportExtensions(Revit.Elements)
clr.AddReference("RevitServices")

import RevitServices
from RevitServices.Persistence import DocumentManager
from RevitServices.Transactions import TransactionManager

clr.AddReference("RevitAPI")
from Autodesk.Revit.DB import *
from Autodesk.Revit.DB.Architecture import *

clr.AddReference('System')
from System.Collections.Generic import *

def buscarElementType(nombre,data):
	tipo = None
	for ele in data:
		ttname = Element.Name.__get__(ele)
		if nombre == ttname:
			tipo = ele
		else:
			pass
	return tipo

doc = DocumentManager.Instance.CurrentDBDocument
uiapp = DocumentManager.Instance.CurrentUIApplication
app = uiapp.Application

#category list
cat_list = List[BuiltInCategory]()
cat_list.Add(BuiltInCategory.OST_Walls)
cat_list.Add(BuiltInCategory.OST_Floors)
cat_list.Add(BuiltInCategory.OST_Roofs)
cat_list.Add(BuiltInCategory.OST_Ceilings)
cat_list.Add(BuiltInCategory.OST_Stairs)
cat_list.Add(BuiltInCategory.OST_Ramps)
cat_list.Add(BuiltInCategory.OST_Railings)
cat_list.Add(BuiltInCategory.OST_CurtainWallPanels)
cat_list.Add(BuiltInCategory.OST_CurtainWallMullions)
cat_list.Add(BuiltInCategory.OST_StructuralFraming)
cat_list.Add(BuiltInCategory.OST_StructuralColumns)
cat_list.Add(BuiltInCategory.OST_PlumbingFixtures)
cat_list.Add(BuiltInCategory.OST_GenericModel)
cat_list.Add(BuiltInCategory.OST_SpecialityEquipment)
cat_list.Add(BuiltInCategory.OST_Windows)
cat_list.Add(BuiltInCategory.OST_StructuralStiffener)


filter = ElementMulticategoryFilter(cat_list)
collector = FilteredElementCollector(doc).WherePasses(filter).WhereElementIsElementType()

ll = zip(IN[0],IN[1],IN[2])

lista = []


#revit inpunts
types = []
keynote = []
descripciones = []

for element in collector:
	lista.append(element)

for clave,desc,tipos in ll:
	element = buscarElementType(tipos,lista)
	if element != None:
		
		types.append(element)
		keynote.append(clave)
		descripciones.append(desc)
		



OUT = types,keynote,descripciones
# ----------------------------------------

revit_types = List.GetItemAtIndex(list=python_script, index=code_block_3.out0)
code_block_4 = CodeBlock { "Keynote"; "Description"; "Type Mark"; }
revit_keynotes = List.GetItemAtIndex(list=python_script, index=code_block_3.out1)
setParameterByName = Element.SetParameterByName(element=revit_types, parameterName=code_block_4.out0, value=revit_keynotes)
setParameterByName_2 = Element.SetParameterByName(element=revit_types, parameterName=code_block_4.out2, value=revit_keynotes)
revit_descriptions = List.GetItemAtIndex(list=python_script, index=code_block_3.out3)
setParameterByName_3 = Element.SetParameterByName(element=revit_types, parameterName=code_block_4.out1, value=revit_descriptions)
