# Dynamo graph TxtExcelMF.dyn (Dynamo 2.0.3.8104)

code_block = CodeBlock { "KEYNOTE UPGRADER"; }
file_path = Filename("..\..\..\UI\s+mk.png")
code_block_2 = CodeBlock { "UPGRADE!"; }
code_block_3 = CodeBlock { "TABLA DE KEYNOTES EXCEL"; }
keynote_schedule = Filename("\\slserver\00-PROYECTOS\BIM S+MK\12 Keynotes\MasterKeynote_SMK.xlsx")
code_block_4 = CodeBlock { "Browse"; }
ui_filepath_data = Custom[UI.FilePath Data](InputName=code_block_3, DefaulPath=keynote_schedule, ButtonText=code_block_4)  # Create filepath input for UI.MultipleInputForm ++ . Check out www.data-shapes.net for more infos !
code_block_5 = CodeBlock { "KEYNOTE TABLE (.TXT)"; }
keynote_schedule_txt = Filename("\\slserver\00-PROYECTOS\BIM S+MK\12 Keynotes\MasterKeynote_SMK.xlsx")
code_block_6 = CodeBlock { "Browse"; }
ui_filepath_data_2 = Custom[UI.FilePath Data](InputName=code_block_5, DefaulPath=keynote_schedule_txt, ButtonText=code_block_6)
code_block_7 = CodeBlock(A=ui_filepath_data, B=ui_filepath_data_2) { [A,B]; }
boolean = BoolSelector(true)
ui_multipleinputform = Custom[UI.MultipleInputForm ++](Description_optional=code_block, Logo_optional=file_path, ButtonText_optional=code_block_2, Inputs=code_block_7, Toggle=boolean)  # Create a form with multiple inputs. see www.data-shapes.net for tutorials and infos!
code_block_8 = CodeBlock(l=ui_multipleinputform.User_Inputs) { l[0]; }
file_from_path = FileObject(path=code_block_8)
code_block_9 = CodeBlock { "Hoja1"; }
boolean_2 = BoolSelector(true)
boolean_3 = BoolSelector(true)
importExcel = Data.ImportExcel(file=file_from_path, sheetName=code_block_9, readAsStrings=boolean_2, showExcel=boolean_3)
clear_list = Custom[Clear List](input=importExcel)  # This node will remove all Null and Empty Lists from any list.
code_block_10 = CodeBlock { false; }
clean = List.Clean(list=clear_list, preserveIndices=code_block_10)

# group: master Keynote
python_script = Python(IN[0]=clean)
# ---------- python_script.python (45 lines) ----------
# Enable Python support and load DesignScript library
import clr
clr.AddReference('ProtoGeometry')
from Autodesk.DesignScript.Geometry import *

from System.IO import Directory,Path

clr.AddReference('RevitAPI')
from Autodesk.Revit.DB import *

clr.AddReference('RevitServices')
from RevitServices.Persistence import DocumentManager
from RevitServices.Transactions import TransactionManager

doc = DocumentManager.Instance.CurrentDBDocument

data = IN[0]

f = open("00 MF_S-MK EXPLANADA ARQUITECTURA r1.txt","w+")

for i in data:
	for j in i:
		#f.write('\t')
		f.write(j)
		f.write('\t')
		
	f.write('\n')
f.close()


filename = '00 MF_S-MK EXPLANADA ARQUITECTURA r1.txt'
directory = Directory.GetCurrentDirectory()

fullpath = Path.Combine(directory,filename)

p = ModelPathUtils.ConvertUserVisiblePathToModelPath(fullpath)
s = ExternalResourceReference.CreateLocalResource(doc,ExternalResourceTypes.BuiltInExternalResourceTypes.KeynoteTable,p,PathType.Absolute);

TransactionManager.Instance.EnsureInTransaction(doc)

KeynoteTable.GetKeynoteTable(doc).LoadFrom(s, KeyBasedTreeEntriesLoadResults());

TransactionManager.Instance.ForceCloseTransaction()

OUT = s,fullpath
# ----------------------------------------
