# Dynamo graph AsociarNiveles.dyn (Dynamo 2.0.3.8104)

# group: MAIN DIALOGUE : REVIT UI FRONTEND []
file_path = Filename("..\..\..\UI\s+mk.png")
code_block = CodeBlock { "SMK TOOLS"; }
code_block_2 = CodeBlock { "Seleccionar LINK REVIT"; }
code_block_3 = CodeBlock { "REVIT LINKS"; }
getDocuments = archilab.Revit.Selection.Select.GetDocuments()
ui_dropdown_data = Custom[UI.DropDown Data](InputName=code_block_3, Keys_var=getDocuments.Link_Name, Values_var=getDocuments.Link_Doc)  # Create data for DropDown input in UI.MultiInputForm ++ . Check out www.data-shapes.net for more infos.
code_block_4 = CodeBlock { "REVIT LINKS PATH"; }
ui_dropdown_data_2 = Custom[UI.DropDown Data](InputName=code_block_4, Keys_var=getDocuments.Link_Path, Values_var=getDocuments.Link_Instance)
list_create = List.Create(item0=ui_dropdown_data, item1=ui_dropdown_data_2)
boolean = BoolSelector(true)
code_block_5 = CodeBlock { 600; }
ui_multipleinputform = Custom[UI.MultipleInputForm ++](Description_optional=code_block, Logo_optional=file_path, ButtonText_optional=code_block_2, Inputs=list_create, Toggle=boolean, Width_optional=code_block_5)  # Create a form with multiple inputs. see www.data-shapes.net for tutorials and infos!

# group: SECOND DIALOGUE : REVIT UI FRONTEND[] || SET LEVELS TO ASSOCIATE
code_block_6 = CodeBlock { "SELECCIONAR NIVELES"; }
code_block_7 = CodeBlock { "ASOCIAR NIVELES"; }
code_block_8 = CodeBlock { "CAMBIAR NOMBRES?"; }
boolean_2 = BoolSelector(true)
code_block_9 = CodeBlock { "SI / NO"; }
ui_boolean_input = Custom[UI.Boolean input](InputName=code_block_8, DefaultValue=boolean_2, SideText=code_block_9)  # Creates a boolean input for UI.MultipleInputForm ++ . Check out www.data-shapes.net for more infos!
code_block_10 = CodeBlock { "SELECCIONAR NIVELES MAESTROS[LINK]"; }
code_block_11 = CodeBlock(L=ui_multipleinputform.User_Inputs) { L[0]; L[1]; }
code_block_12 = CodeBlock { "Levels"; }
byName = Category.ByName(name=code_block_12)
getFromLinkedFile = Custom[Element.GetFromLinkedFile](Link_Instance=code_block_11.out1, Link_Document=code_block_11.out0, Category=byName)  # Get elements from link document instance based on category
name = Element.Name(element=getFromLinkedFile)
ui_listview_data = Custom[UI.Listview Data](InputName=code_block_10, Keys_var=name, Values_var=getFromLinkedFile)  # Create data for ListView input in UI.MultiInputForm ++ . Check out www.data-shapes.net for more infos.
code_block_13 = CodeBlock { "SELECCIONAR NIVELES A ASOCIAR [MODEL]"; }
all_elements_of_category = ElementsOfCategory(Category=byName)
name_2 = Element.Name(element=all_elements_of_category)
ui_listview_data_2 = Custom[UI.Listview Data](InputName=code_block_13, Keys_var=name_2, Values_var=all_elements_of_category)
list_create_2 = List.Create(item0=ui_boolean_input, item1=ui_listview_data, item2=ui_listview_data_2)
ui_multipleinputform_2 = Custom[UI.MultipleInputForm ++](Description_optional=code_block_6, Logo_optional=file_path, ButtonText_optional=code_block_7, Inputs=list_create_2, Toggle=ui_multipleinputform.Was_Run, Width_optional=code_block_5)

# group: REVIT MODEL DATA TO MATCH
code_block_14 = CodeBlock { 2; }
revit_model_data = List.GetItemAtIndex(list=ui_multipleinputform_2.User_Inputs, index=code_block_14)
elevation = Level.Elevation(level=revit_model_data)
sortByKey = List.SortByKey(list=revit_model_data, keys=elevation)
name_3 = Level.Name(level=sortByKey.sorted_list)

# group: REVIT LINK SELECTED DATA
code_block_15 = CodeBlock { 1; }
revit_link_data = List.GetItemAtIndex(list=ui_multipleinputform_2.User_Inputs, index=code_block_15)
elevation_2 = Level.Elevation(level=revit_link_data)
sortByKey_2 = List.SortByKey(list=revit_link_data, keys=elevation_2)
name_4 = Level.Name(level=sortByKey_2.sorted_list)

BOOL = CodeBlock(L=ui_multipleinputform_2.User_Inputs) { L[0]; }
python_script = Python(IN[0]=BOOL, IN[1]=name_4, IN[2]=name_3)
# ---------- python_script.python (9 lines) ----------
# Enable Python support and load DesignScript library
import clr
clr.AddReference('ProtoGeometry')
from Autodesk.DesignScript.Geometry import *

if IN[0]:
	OUT = IN[1]
else:
	OUT = IN[2]
# ----------------------------------------

# group: REVIT SET PARAMETER BY USER INPUT
code_block_16 = CodeBlock { "Elevation"; }
setParameterByName = Element.SetParameterByName(element=sortByKey.sorted_list, parameterName=code_block_16, value=sortByKey_2.sorted_keys)
code_block_17 = CodeBlock { "Name"; }
setParameterByName_2 = Element.SetParameterByName(element=sortByKey.sorted_list, parameterName=code_block_17, value=python_script)
