# Dynamo graph SolucionarClashMuros.dyn (Dynamo 2.0.3.8104)

# group: SMK USER INTERFACE ()
code_block = CodeBlock { "WALL CLASH OPENINGS"; }
file_path = Filename("..\..\..\UI\s+mk.png")
code_block_2 = CodeBlock { "RUN!"; }
code_block_3 = CodeBlock { "ACTUALIZAR MUROS"; }
actualizar_muros = BoolSelector(false)
ui_boolean_input = Custom[UI.Boolean input](InputName=code_block_3, DefaultValue=actualizar_muros)  # Creates a boolean input for UI.MultipleInputForm ++ . Check out www.data-shapes.net for more infos!
code_block_4 = CodeBlock { "DIRECCIÓN MUROS"; }
actualizar_muros_2 = BoolSelector(true)
ui_boolean_input_2 = Custom[UI.Boolean input](InputName=code_block_4, DefaultValue=actualizar_muros_2)
code_block_5 = CodeBlock { "ACTUALIZAR TRABES"; }
actualizar_muros_3 = BoolSelector(true)
ui_boolean_input_3 = Custom[UI.Boolean input](InputName=code_block_5, DefaultValue=actualizar_muros_3)
code_block_6 = CodeBlock { "TOP/BASE"; }
string = StringInput("0")
actualizar_muros_4 = BoolSelector(true)
ui_textbox_data = Custom[UI.TextBox Data](InputName=code_block_6, DefaultText=string, IsNumberEntry=actualizar_muros_4)  # Create Data for TextBox input in UI.MultipleInputForm ++ . Check out www.data-shapes.net for more informations
list_create = List.Create(item0=ui_boolean_input, item1=ui_boolean_input_2, item2=ui_boolean_input_3, item3=ui_textbox_data)
boolean = BoolSelector(true)
ui_multipleinputform = Custom[UI.MultipleInputForm ++](Description_optional=code_block, Logo_optional=file_path, ButtonText_optional=code_block_2, Inputs=list_create, Toggle=boolean)  # Create a form with multiple inputs. see www.data-shapes.net for tutorials and infos!

# group: REVIT DATA
code_block_7 = CodeBlock(L=ui_multipleinputform.User_Inputs) { L[0]; }
code_block_8 = CodeBlock(L=ui_multipleinputform.User_Inputs) { L[2]; }
code_block_9 = CodeBlock(L=ui_multipleinputform.User_Inputs) { L[1]; }
code_block_10 = CodeBlock(L=ui_multipleinputform.User_Inputs) { L[3]; }

objects = Custom[Pick.Objects](bool_var=code_block_7)  # Select Multicategory Model Objects in Revit UI
geometry = Element.Geometry(element=objects)
flatten = List.Flatten(list=geometry)
ꟿ_selectlinkedelements = Custom[ꟿ SelectLinkedElements](refresh=code_block_8)  # Select the linked instance first, followed by the elements. To finish the selection, press Finish. If your selection fails, just press escape or Cancel. To refresh the node, connect a boolean switch node.
geometry_2 = Element.Geometry(element=ꟿ_selectlinkedelements)
flatten_2 = List.Flatten(list=geometry_2)

# group: intersect
code_block_11 = CodeBlock(t1=flatten, t2=flatten_2) { geometry1 = Geometry.Intersect(t1<1>, t2<2>); t3 = List.Flatten(geometry1, -1); point1 = Solid.Centroid(t3); }

# group: WALL ORDERED LIST
boundingBox = Geometry.BoundingBox(geometry=flatten)
contains = BoundingBox.Contains(boundingBox=boundingBox, point=code_block_11.point1, lacing=CrossProduct)
transpose = List.Transpose(lists=contains)
boolean_2 = BoolSelector(true)
indexOf = List.IndexOf(element=boolean_2)  # unwired: list
map = List.Map(list=transpose, f_x=indexOf)
getItemAtIndex = List.GetItemAtIndex(list=objects, index=map)

# group: GEOMETRIC DIMENTIONS EXTRACTION
flatten_3 = List.Flatten(list=code_block_11.geometry1)
faces = Topology.Faces(topology=flatten_3)
surfaceGeometry = Face.SurfaceGeometry(face=faces)
area = Surface.Area(surface=surfaceGeometry)
maximumItem = List.MaximumItem(list=area)
eq = area == maximumItem
filterByBoolMask = List.FilterByBoolMask(list=surfaceGeometry, mask=eq)
getItemAtIndex_2 = List.GetItemAtIndex(list=filterByBoolMask.in@L2, index=code_block_10)
perimeterCurves = Surface.PerimeterCurves(surface=getItemAtIndex_2)
length = Curve.Length(curve=perimeterCurves)
maximumItem_2 = List.MaximumItem(list=length)
eq_2 = length == maximumItem_2
filterByBoolMask_2 = List.FilterByBoolMask(list=length, mask=eq_2)

code_block_12 = CodeBlock { 0.0015; }

# group: OPENINGS PHYSIQUE PARAMETERS
string_2 = StringInput("x")
string_3 = StringInput("y")
if_ = If(test=code_block_9, true=string_2, false=string_3)
maximumItem_3 = List.MaximumItem(list=filterByBoolMask_2.out)
eq_3 = filterByBoolMask_2.out == maximumItem_3
filterByBoolMask_3 = List.FilterByBoolMask(list=filterByBoolMask_2.out, mask=eq_3)
code_block_13 = CodeBlock { 2; }
code_block_14 = CodeBlock { 1; }
code_block_15 = CodeBlock { 0; }
HEIGHT = List.GetItemAtIndex(list=filterByBoolMask_2.in@L2, index=code_block_15)
round = Math.Round(number=HEIGHT, digits=code_block_14)
code_block_16 = CodeBlock { 0.0025; }
add = round + code_block_16

flatten_4 = List.Flatten(list=filterByBoolMask_3.in)

# group (continued): OPENINGS PHYSIQUE PARAMETERS
WIDHT = Math.Round(number=flatten_4, digits=code_block_13)
round_2 = Math.Round(number=WIDHT, digits=code_block_14)
add_2 = round_2 + code_block_12

python_script = Python(IN[0]=getItemAtIndex, IN[1]=code_block_11.point1, IN[2]=if_, IN[3]=add_2, IN[4]=add)
# ---------- python_script.python (52 lines) ----------
import clr
clr.AddReference('RevitAPI')
from Autodesk.Revit.DB import *
import Autodesk

clr.AddReference("RevitServices")
import RevitServices
from RevitServices.Persistence import DocumentManager
from RevitServices.Transactions import TransactionManager


doc = DocumentManager.Instance.CurrentDBDocument
openings = []

walls = IN[0]
points = IN[1]
direction = IN[2]
width = IN[3]
height = IN[4]

for idx in range(0,len(walls)):
	if direction == 'x' :
		ULX=(points[idx]).X  - width[idx]/2
		ULY=(points[idx]).Y
		ULZ=(points[idx]).Z + height[idx]/2
			
		UL = XYZ(ULX/0.3048,ULY/0.3048,ULZ/0.3048)
		
		DRX=(points[idx]).X + width[idx]/2
		DRY=(points[idx]).Y
		DRZ=(points[idx]).Z - height[idx]/2
		
		DR = XYZ(DRX/0.3048,DRY/0.3048,DRZ/0.3048)
	else:
		ULX=(points[idx]).X + width[idx]/2
		ULY=(points[idx]).Y - width[idx]/2
		ULZ=(points[idx]).Z + height[idx]/2
			
		UL = XYZ(ULX/0.3048,ULY/0.3048,ULZ/0.3048)
		
		DRX=(points[idx]).X + width[idx]/2
		DRY=(points[idx]).Y + width[idx]/2
		DRZ=(points[idx]).Z - height[idx]/2
		
		DR = XYZ(DRX/0.3048,DRY/0.3048,DRZ/0.3048)
	
	TransactionManager.Instance.EnsureInTransaction(doc)
	opening = doc.Create.NewOpening(UnwrapElement(walls[idx]),UL,DR)
	TransactionManager.Instance.TransactionTaskDone()
	openings.append(opening)
	
OUT = openings
# ----------------------------------------
