# Dynamo graph UnJoinPickedObjects.dyn (Dynamo 2.0.3.8810)

select_model_elements = DSModelElementsSelection()  # 517 picked in the model
getCategory = Element.GetCategory(element=select_model_elements)
code_block = CodeBlock(e=getCategory) { e.Name; }
code_block_2 = CodeBlock { "Walls"; }
eq = code_block == code_block_2
filterByBoolMask = List.FilterByBoolMask(list=select_model_elements, mask=eq)
python_script = Python(IN[0]=filterByBoolMask.in, IN[1]=filterByBoolMask.in)
# ---------- python_script.python (36 lines) ----------
import System
import clr
clr.AddReference('RevitAPI')
import Autodesk

clr.AddReference("RevitServices")
import RevitServices
from RevitServices.Persistence import DocumentManager
from RevitServices.Transactions import TransactionManager
doc = DocumentManager.Instance.CurrentDBDocument

clr.AddReference('RevitNodes')
import Revit
clr.ImportExtensions(Revit.Elements)

#Las entradas de este nodo se almacenan como lista en las variables IN.
elementA = UnwrapElement(IN[0])
elementB = UnwrapElement(IN[1])

doc = DocumentManager.Instance.CurrentDBDocument

results = []
TransactionManager.Instance.EnsureInTransaction(doc)

for a in elementA:
	for b in elementB:
		try:
			result = Autodesk.Revit.DB.JoinGeometryUtils.UnJoinGeometry(doc,a,b)
			results.append(result)
		except:
			pass
	
TransactionManager.Instance.TransactionTaskDone()

#Asigne la salida a la variable OUT.
OUT = results
# ----------------------------------------
