# Dynamo graph Colocar Leyendas .dyn "Revit_Automatic_PlacesLegendComp-OnSheets" (Dynamo 2.0.3.8104)

# group: UI FORMAT()
code_block = CodeBlock { "PLACE SELECTED LEGENDS ON SHEETS"; }
file_path = Filename("..\..\UI\s+mk.png")
code_block_2 = CodeBlock { "Run Command"; }
boolean = BoolSelector(true)

code_block_3 = CodeBlock { "SELECCIONE LOS LEYEND COMPONENTS"; }
categories = Categories(index=602)
all_elements_of_category = ElementsOfCategory(Category=categories)
string_from_object = FromObject(obj=all_elements_of_category)
code_block_4 = CodeBlock { "Legend"; }
contains = String.Contains(str=string_from_object, searchFor=code_block_4)
filterByBoolMask = List.FilterByBoolMask(list=all_elements_of_category, mask=contains)
boolean_2 = BoolSelector(true)
boolean_3 = BoolSelector(false)
ui_listview_data = Custom[UI.Listview Data](InputName=code_block_3, Keys_var=filterByBoolMask.in, Values_var=filterByBoolMask.in, ShowElementCount_optionnal=boolean_2, ShowId_optionnal=boolean_3)  # Create data for ListView input in UI.MultiInputForm ++ . Check out www.data-shapes.net for more infos.
code_block_5 = CodeBlock { "SELECCIONE LOS SHEETS DESEADOS"; }
categories_2 = Categories(index=447)
all_elements_of_category_2 = ElementsOfCategory(Category=categories_2)
boolean_4 = BoolSelector(false)
clean = List.Clean(list=all_elements_of_category_2, preserveIndices=boolean_4)
ui_listview_data_2 = Custom[UI.Listview Data](InputName=code_block_5, Keys_var=clean, Values_var=clean, ShowElementCount_optionnal=boolean_2, ShowId_optionnal=boolean_3)
list_create = List.Create(item0=ui_listview_data, item1=ui_listview_data_2)
code_block_6 = CodeBlock { 450; }
ui_multipleinputform = Custom[UI.MultipleInputForm ++](Description_optional=code_block, Logo_optional=file_path, ButtonText_optional=code_block_2, Inputs=list_create, Toggle=boolean, Width_optional=code_block_6)  # Create a form with multiple inputs. see www.data-shapes.net for tutorials and infos!

# group: VIEW SHEET LIST
code_block_7 = CodeBlock { 1; }
getItemAtIndex = List.GetItemAtIndex(list=ui_multipleinputform.User_Inputs, index=code_block_7)
count = List.Count(list=getItemAtIndex)
code_block_8 = CodeBlock { 1; }
eq = count == code_block_8
ofRepeatedItem = List.OfRepeatedItem(item=getItemAtIndex, amount=count)
code_block_9 = CodeBlock { 0; }
getItemAtIndex_2 = List.GetItemAtIndex(list=ofRepeatedItem, index=code_block_9)

# group: LEGEND VIEW LIST
code_block_10 = CodeBlock { 0; }
getItemAtIndex_3 = List.GetItemAtIndex(list=ui_multipleinputform.User_Inputs, index=code_block_10)
ofRepeatedItem_2 = List.OfRepeatedItem(item=getItemAtIndex_3, amount=count)
count_2 = List.Count(list=ofRepeatedItem_2@L2)
flatten = List.Flatten(list=ofRepeatedItem_2)

# group (continued): VIEW SHEET LIST
ofRepeatedItem_3 = List.OfRepeatedItem(item=getItemAtIndex_2@L1, amount=count_2@L1)
if_ = If(test=eq, true=ofRepeatedItem, false=ofRepeatedItem_3)
flatten_2 = List.Flatten(list=if_)

# group: UI PLACEMENT POINTS
count_3 = List.Count(list=getItemAtIndex_3)
python_script = Python(IN[0]=count_3)
# ---------- python_script.python (43 lines) ----------
#python nodes in dynamo 1.2
#proposed by Julien Benoit @jbenoit44 
#http://aecuandme.wordpress.com/
import clr
clr.AddReference('ProtoGeometry')
from Autodesk.DesignScript.Geometry import *
# Import ToDSType(bool) extension method
clr.AddReference("RevitNodes")
import Revit
clr.ImportExtensions(Revit.Elements)
# Import geometry conversion extension methods
clr.ImportExtensions(Revit.GeometryConversion)
# Import DocumentManager and TransactionManager
clr.AddReference("RevitServices")
import RevitServices
from RevitServices.Persistence import DocumentManager
from RevitServices.Transactions import TransactionManager
from System.Collections.Generic import *
# Import RevitAPI
clr.AddReference("RevitAPI")
import Autodesk
from Autodesk.Revit.DB import *

doc = DocumentManager.Instance.CurrentDBDocument
uiapp = DocumentManager.Instance.CurrentUIApplication
app = uiapp.Application
uidoc=DocumentManager.Instance.CurrentUIApplication.ActiveUIDocument

rb = IN[0]
a = []

cc = 0

while cc < IN[0]:
	sel1 = uidoc.Selection.PickPoint("Seleccione Nueva Pocision")
	cc +=1
	a.append(sel1.ToPoint())

pp = UnwrapElement(a)



OUT=a
# ----------------------------------------
ofRepeatedItem_4 = List.OfRepeatedItem(item=python_script, amount=count)
flatten_3 = List.Flatten(list=ofRepeatedItem_4)
boolean_5 = BoolSelector(true)
boolean_6 = BoolSelector(false)
if_2 = If(test=eq, true=boolean_5, false=boolean_6)
if_3 = If(test=if_2, true=boolean_6, false=boolean_5)

togle = Python(IN[0]=flatten_3, IN[1]=if_3)
# ---------- togle.python (13 lines) ----------
# Enable Python support and load DesignScript library
import clr
clr.AddReference('ProtoGeometry')
from Autodesk.DesignScript.Geometry import *

# The inputs to this node will be stored as a list in the IN variables.
datos = IN[0]
bool = IN[1]

if bool:
	OUT = datos
else:
	OUT = None
# ----------------------------------------
placeViewsOnExistingSheets = Custom[Tool.PlaceViewsOnExistingSheets](Sheet=flatten_2, View=flatten, Point=togle)  # Place the views on the sheets at the points you provide.
togle_2 = Python(IN[0]=flatten_3, IN[1]=if_2)  # same code as togle
placeViewsOnSheets = Custom[Tool.PlaceViewsOnSheets](Sheet_List_var=flatten_2, Views_List_var=flatten, Points_List_var=togle_2)  # Places existing views on existing sheets
