# Dynamo graph Colocar Tablas .dyn "Revit_Automatic_PlacesScheduleViewsOnSheets" (Dynamo 2.0.3.8104)

# group: UI FORMAT()
code_block = CodeBlock { "PLACE SELECTED SCHEDULES ON SHEETS"; }
file_path = Filename("..\..\UI\s+mk.png")
code_block_2 = CodeBlock { "Run Command"; }
boolean = BoolSelector(true)

code_block_3 = CodeBlock { "SELECCIONE LAS TABLAS DESEADAS"; }
element_types = ElementTypes(index=336)
all_elements_of_type = ElementsOfType(element_type=element_types)
boolean_2 = BoolSelector(false)
clean = List.Clean(list=all_elements_of_type, preserveIndices=boolean_2)
boolean_3 = BoolSelector(true)
boolean_4 = BoolSelector(false)
ui_listview_data = Custom[UI.Listview Data](InputName=code_block_3, Keys_var=clean, Values_var=clean, ShowElementCount_optionnal=boolean_3, ShowId_optionnal=boolean_4)  # Create data for ListView input in UI.MultiInputForm ++ . Check out www.data-shapes.net for more infos.
code_block_4 = CodeBlock { "SELECCIONE LOS SHEETS DESEADOS"; }
categories = Categories(index=447)
all_elements_of_category = ElementsOfCategory(Category=categories)
clean_2 = List.Clean(list=all_elements_of_category, preserveIndices=boolean_2)
ui_listview_data_2 = Custom[UI.Listview Data](InputName=code_block_4, Keys_var=clean_2, Values_var=clean_2, ShowElementCount_optionnal=boolean_3, ShowId_optionnal=boolean_4)
list_create = List.Create(item0=ui_listview_data, item1=ui_listview_data_2)
code_block_5 = CodeBlock { 450; }
ui_multipleinputform = Custom[UI.MultipleInputForm ++](Description_optional=code_block, Logo_optional=file_path, ButtonText_optional=code_block_2, Inputs=list_create, Toggle=boolean, Width_optional=code_block_5)  # Create a form with multiple inputs. see www.data-shapes.net for tutorials and infos!

# group: VIEW SHEET LIST
code_block_6 = CodeBlock { 1; }
getItemAtIndex = List.GetItemAtIndex(list=ui_multipleinputform.User_Inputs, index=code_block_6)
count = List.Count(list=getItemAtIndex)
code_block_7 = CodeBlock { 1; }
eq = count == code_block_7
ofRepeatedItem = List.OfRepeatedItem(item=getItemAtIndex, amount=count)
code_block_8 = CodeBlock { 0; }
getItemAtIndex_2 = List.GetItemAtIndex(list=ofRepeatedItem, index=code_block_8)

# group: SCHEDULE VIEW LIST
code_block_9 = CodeBlock { 0; }
getItemAtIndex_3 = List.GetItemAtIndex(list=ui_multipleinputform.User_Inputs, index=code_block_9)
ofRepeatedItem_2 = List.OfRepeatedItem(item=getItemAtIndex_3, amount=count)
flatten = List.Flatten(list=ofRepeatedItem_2)
count_2 = List.Count(list=ofRepeatedItem_2@L2)

# group (continued): VIEW SHEET LIST
ofRepeatedItem_3 = List.OfRepeatedItem(item=getItemAtIndex_2@L1, amount=count_2@L1)
if_ = If(test=eq, true=ofRepeatedItem, false=ofRepeatedItem_3)
flatten_2 = List.Flatten(list=if_)

# group: UI PLACEMENT POINTS
count_3 = List.Count(list=getItemAtIndex_3)
python_script = Python(IN[0]=count_3)
# ---------- python_script.python (43 lines) ----------
#python nodes in dynamo 1.2
#proposed by Julien Benoit @jbenoit44 
#http://aecuandme.wordpress.com/
import clr
clr.AddReference('ProtoGeometry')
from Autodesk.DesignScript.Geometry import *
# Import ToDSType(bool) extension method
clr.AddReference("RevitNodes")
import Revit
clr.ImportExtensions(Revit.Elements)
# Import geometry conversion extension methods
clr.ImportExtensions(Revit.GeometryConversion)
# Import DocumentManager and TransactionManager
clr.AddReference("RevitServices")
import RevitServices
from RevitServices.Persistence import DocumentManager
from RevitServices.Transactions import TransactionManager
from System.Collections.Generic import *
# Import RevitAPI
clr.AddReference("RevitAPI")
import Autodesk
from Autodesk.Revit.DB import *

doc = DocumentManager.Instance.CurrentDBDocument
uiapp = DocumentManager.Instance.CurrentUIApplication
app = uiapp.Application
uidoc=DocumentManager.Instance.CurrentUIApplication.ActiveUIDocument

rb = IN[0]
a = []

cc = 0

while cc < IN[0]:
	sel1 = uidoc.Selection.PickPoint("Seleccione Nueva Pocision")
	cc +=1
	a.append(sel1.ToPoint())

pp = UnwrapElement(a)



OUT=a
# ----------------------------------------
ofRepeatedItem_4 = List.OfRepeatedItem(item=python_script, amount=count)
flatten_3 = List.Flatten(list=ofRepeatedItem_4)
boolean_5 = BoolSelector(true)
boolean_6 = BoolSelector(false)
if_2 = If(test=eq, true=boolean_5, false=boolean_6)
if_3 = If(test=if_2, true=boolean_6, false=boolean_5)

togle = Python(IN[0]=flatten_3, IN[1]=if_3)
# ---------- togle.python (13 lines) ----------
# Enable Python support and load DesignScript library
import clr
clr.AddReference('ProtoGeometry')
from Autodesk.DesignScript.Geometry import *

# The inputs to this node will be stored as a list in the IN variables.
datos = IN[0]
bool = IN[1]

if bool:
	OUT = datos
else:
	OUT = None
# ----------------------------------------
multiple_schedules_on_multiple = Custom[MULTIPLE SCHEDULES ON MULTIPLE VIEWS](ScheduleView_var=flatten, Sheet=flatten_2, Point=togle)  # Place a list of Scheduleviews on Existing ViewSheets
togle_2 = Python(IN[0]=flatten_3, IN[1]=if_2)  # same code as togle
place_schedules_on_views = Python(IN[0]=flatten_2, IN[1]=flatten, IN[2]=togle_2)
# ---------- place_schedules_on_views.python (47 lines) ----------
import clr
clr.AddReference('ProtoGeometry')
from Autodesk.DesignScript.Geometry import *
# Import ToDSType(bool) extension method
clr.AddReference("RevitNodes")
import Revit
clr.ImportExtensions(Revit.Elements)
# Import geometry conversion extension methods
clr.ImportExtensions(Revit.GeometryConversion)
# Import DocumentManager and TransactionManager
clr.AddReference("RevitServices")
import RevitServices
from RevitServices.Persistence import DocumentManager
from RevitServices.Transactions import TransactionManager
from System.Collections.Generic import *
# Import RevitAPI
clr.AddReference("RevitAPI")
import Autodesk
from Autodesk.Revit.DB import *

doc = DocumentManager.Instance.CurrentDBDocument
uiapp = DocumentManager.Instance.CurrentUIApplication
app = uiapp.Application
uidoc=DocumentManager.Instance.CurrentUIApplication.ActiveUIDocument

sheets = []
for i in IN[0]:
	sheets.append(UnwrapElement(i))
views=[]	
for i in IN[1]:
	views.append(UnwrapElement(i))
points=[]	
for i in IN[2]:
	points.append(UnwrapElement(i).ToXyz())

# Start Transaction
TransactionManager.Instance.EnsureInTransaction(doc)
viewp=[]
for s in sheets:
	for v,p in zip(views,points):
		a=ScheduleSheetInstance.Create(doc, s.Id,v.Id, p)
		viewp.append(a)

# End Transaction
TransactionManager.Instance.TransactionTaskDone()

OUT=viewp
# ----------------------------------------
