# Dynamo graph Colocar TitleBlocks.dyn "Revit_Place_TitleBlocks" (Dynamo 2.0.3.8104)

categoria_sheets = Categories(index=447)
all_elements_of_category = ElementsOfCategory(Category=categoria_sheets)

# group: USER INTERFACE ()
code_block = CodeBlock { "S+MK PLACE TITLEBLOCKS"; }
file_path = Filename("..\..\UI\s+mk.png")
code_block_2 = CodeBlock { "RUN !"; }
code_block_3 = CodeBlock { "SELECCIONE PIE DE PLANO"; }
titleblocks_type_colector = Python()  # unwired: IN[0]
# ---------- titleblocks_type_colector.python (27 lines) ----------
# Enable Python support and load DesignScript library
import clr
clr.AddReference('ProtoGeometry')
from Autodesk.DesignScript.Geometry import *

clr.AddReference('RevitAPI')
import Autodesk
from Autodesk.Revit.DB import *

clr.AddReference('RevitServices')
from RevitServices.Transactions import *
from RevitServices.Persistence import *

clr.AddReference('RevitNodes')
import Revit
clr.ImportExtensions(Revit.Elements)
clr.ImportExtensions(Revit.GeometryConversion)


doc = DocumentManager.Instance.CurrentDBDocument


colector = FilteredElementCollector(doc).OfCategory(BuiltInCategory.OST_TitleBlocks).WhereElementIsElementType().ToElements()



OUT = colector
# ----------------------------------------
name = Family.Name(family=titleblocks_type_colector)
ui_dropdown_data = Custom[UI.DropDown Data](InputName=code_block_3, Keys_var=name, Values_var=titleblocks_type_colector)  # Create data for DropDown input in UI.MultiInputForm ++ . Check out www.data-shapes.net for more infos.
boolean = BoolSelector(true)
ui_multipleinputform = Custom[UI.MultipleInputForm ++](Description_optional=code_block, Logo_optional=file_path, ButtonText_optional=code_block_2, Inputs=ui_dropdown_data, Toggle=boolean)  # Create a form with multiple inputs. see www.data-shapes.net for tutorials and infos!

code_block_4 = CodeBlock(L=ui_multipleinputform.User_Inputs) { L[0]; }
count = List.Count(list=all_elements_of_category)
ofRepeatedItem = List.OfRepeatedItem(item=code_block_4, amount=count)
code_block_5 = CodeBlock { l = Point.ByCoordinates(0,0,0); }
ofRepeatedItem_2 = List.OfRepeatedItem(item=code_block_5, amount=count)
boolean_2 = BoolSelector(true)
python_script = Python(IN[0]=all_elements_of_category, IN[1]=ofRepeatedItem, IN[2]=ofRepeatedItem_2, IN[3]=boolean_2)
# ---------- python_script.python (46 lines) ----------
import clr
clr.AddReference('ProtoGeometry')
from Autodesk.DesignScript.Geometry import *

clr.AddReference('RevitAPI')
import Autodesk

clr.AddReference('RevitAPIUI')
from Autodesk.Revit.DB import *

clr.AddReference('RevitNodes')
import Revit
clr.ImportExtensions(Revit.GeometryConversion)
clr.ImportExtensions(Revit.Elements)


clr.AddReference('RevitServices')
import RevitServices
from RevitServices.Persistence import DocumentManager
from RevitServices.Transactions import TransactionManager



def Tolist(obj1):
	if hasattr(obj1,"__iter__"): return obj1
	else: return[obj1]

doc = DocumentManager.Instance.CurrentDBDocument
result = []

vistas = UnwrapElement(Tolist(IN[0]))
famType = UnwrapElement(Tolist(IN[1]))
points = UnwrapElement(Tolist(IN[2]))
pers = IN[3]
ll = zip(points,vistas,famType)

TransactionManager.Instance.EnsureInTransaction(doc)

for p,v,f in ll:
	newp = p.ToXyz(True)
	newFam = doc.Create.NewFamilyInstance(newp,f,v)
	result.append(newFam.ToDSType(pers))
	
TransactionManager.Instance.TransactionTaskDone()

OUT = result
# ----------------------------------------
