# Dynamo graph Renombrar Vistas.dyn "Revit_ViewsRename" (Dynamo 2.0.3.8104)

categories = Categories(index=602)
python_script = Python(IN[0]=categories)
# ---------- python_script.python (31 lines) ----------
import clr
clr.AddReference('ProtoGeometry')
from Autodesk.DesignScript.Geometry import *

clr.AddReference('RevitAPI')
import Autodesk
from Autodesk.Revit.DB import *

clr.AddReference('RevitServices')
from RevitServices.Persistence import *
from RevitServices.Transactions import *

clr.AddReference('RevitNodes')
import Revit
clr.ImportExtensions(Revit.GeometryConversion)
clr.ImportExtensions(Revit.Elements)


doc = DocumentManager.Instance.CurrentDBDocument
cat = UnwrapElement(IN[0])


colector = FilteredElementCollector(doc).OfClass(ViewPlan).WhereElementIsNotElementType().ToElements()
a = []

for views in colector:
	if not views.IsTemplate:
		a.append(views)

	
OUT = a
# ----------------------------------------
python_script_2 = Python(IN[0]=python_script)
# ---------- python_script_2.python (59 lines) ----------
import clr
clr.AddReference('ProtoGeometry')
from Autodesk.DesignScript.Geometry import *

clr.AddReference('RevitAPI')
import Autodesk
from Autodesk.Revit.DB import *

clr.AddReference('RevitServices')
from RevitServices.Persistence import *
from RevitServices.Transactions import *

clr.AddReference('RevitNodes')
import Revit
clr.ImportExtensions(Revit.GeometryConversion)
clr.ImportExtensions(Revit.Elements)

def ListTranspose(matrix):
	return map(list,zip(*matrix))



def GetParameters(views):
	result = []
	for view in views:
		par  = view.Parameters
		result.append(par)
	return result
	
def GetViewType(parameters):
	result = []
	for el in parameters:
		if el.Definition.Name == "Type":
			valor = el.AsValueString()
			result.append(valor)
		else:
			pass
	return (result)
			
	

vistas = UnwrapElement(IN[0])
doc = DocumentManager.Instance.CurrentDBDocument


pars = GetParameters(vistas)

data = zip(vistas,pars)

ro = []
for vis,lista in data:
	types = GetViewType(lista)
	
	ro.append(types)



	
OUT = ro
# ----------------------------------------
isNull = Object.IsNull(obj=python_script_2)
filterByBoolMask = List.FilterByBoolMask(list=python_script_2, mask=isNull)
flatten = List.Flatten(list=filterByBoolMask.out)
groupByKey = List.GroupByKey(list=python_script, keys=flatten)

# group: USER INTERFACE ()
code_block = CodeBlock { "RENOMBRAR VISTAS"; }
file_path = Filename("..\..\UI\s+mk.png")
code_block_2 = CodeBlock { "RUN!"; }
code_block_3 = CodeBlock { "SELECCIONE PARTIDA"; }
count = List.Count(list=groupByKey.unique_keys)
code_block_4 = CodeBlock(CC=count) { 0..(CC-1); }
ui_dropdown_data = Custom[UI.DropDown Data](InputName=code_block_3, Keys_var=groupByKey.unique_keys, Values_var=code_block_4)  # Create data for DropDown input in UI.MultiInputForm ++ . Check out www.data-shapes.net for more infos.
boolean = BoolSelector(true)
ui_multipleinputform = Custom[UI.MultipleInputForm ++](Description_optional=code_block, Logo_optional=file_path, ButtonText_optional=code_block_2, Inputs=ui_dropdown_data, Toggle=boolean)  # Create a form with multiple inputs. see www.data-shapes.net for tutorials and infos!

code_block_5 = CodeBlock(l=groupByKey.groups, C=ui_multipleinputform.User_Inputs) { l[C]; }
flatten_2 = List.Flatten(list=code_block_5)
code_block_6 = CodeBlock(l=groupByKey.unique_keys, C=ui_multipleinputform.User_Inputs) { l[C][0]; }

# group: RENAME VIEWS
code_block_7 = CodeBlock { "View Name"; }
code_block_8 = CodeBlock { "Associated Level"; }
getParameterValueByName = Element.GetParameterValueByName(element=flatten_2, parameterName=code_block_8)
python_script_3 = Python(IN[0]=getParameterValueByName, IN[1]=code_block_6)
# ---------- python_script_3.python (15 lines) ----------
# Enable Python support and load DesignScript library
import clr
clr.AddReference('ProtoGeometry')
from Autodesk.DesignScript.Geometry import *

# The inputs to this node will be stored as a list in the IN variables.
niveles  = IN[0]
tipo = IN[1]
a = []
for each in niveles:
	newname = tipo +"-"+each
	a.append(newname)


OUT = a
# ----------------------------------------
setParameterByName = Element.SetParameterByName(element=flatten_2, parameterName=code_block_7, value=python_script_3)
