# Dynamo graph RHINO CURVES TO MODEL LINES.dyn (Dynamo 2.3.0.5885)
# packages: LinkDWG 0.3.91

select_model_element = DSModelElementSelection()  # 1 picked in the model
groupGeometriesByLayer = Custom[GroupGeometriesByLayer](importInstance=select_model_element)  # package LinkDWG; Group geometries in ImportInstance by their layer name and convert the inside meshes into polysurface
watch = Watch(groupGeometriesByLayer.2_Layer_Names)
code_block = CodeBlock { 0; }
getItemAtIndex = List.GetItemAtIndex(list=groupGeometriesByLayer.0_Grouped_Geometries, index=code_block)
code_block_2 = CodeBlock { 0; }
getItemAtIndex_2 = List.GetItemAtIndex(list=getItemAtIndex, index=code_block_2)
code_block_3 = CodeBlock { 1; }
getItemAtIndex_3 = List.GetItemAtIndex(list=groupGeometriesByLayer.0_Grouped_Geometries, index=code_block_3)
curves = PolyCurve.Curves(polyCurve=getItemAtIndex_3)
byCurve = ModelCurve.ByCurve(curve=curves)
