# Dynamo graph Renombrar claves Planos.dyn (Dynamo 2.3.0.5885)

categories = Categories("OST_Sheets")
all_elements_of_category = ElementsOfCategory(Category=categories)
code_block = CodeBlock { "Sheet Number"; }
getParameterValueByName = Element.GetParameterValueByName(element=all_elements_of_category, parameterName=code_block)
code_block_2 = CodeBlock { "E"; }
startsWith = String.StartsWith(str=getParameterValueByName, searchFor=code_block_2)
filterByBoolMask = List.FilterByBoolMask(list=all_elements_of_category, mask=startsWith)
code_block_3 = CodeBlock { 43..56; }
getItemAtIndex = List.GetItemAtIndex(list=filterByBoolMask.in, index=code_block_3)
python_script = Python()  # unwired: IN[0]
# ---------- python_script.python (24 lines) ----------
# Load the Python Standard and DesignScript Libraries
import sys
import clr
clr.AddReference('ProtoGeometry')
from Autodesk.DesignScript.Geometry import *

# The inputs to this node will be stored as a list in the IN variables.
dataEnteringNode = IN
nombres = []
nombres2 = []
for i in range(5):
	prefijo = "E-D0"
	sufijo  = str( i + 5) 
	name = prefijo + sufijo
	nombres.append(name)

for i in range(9):
	prefijo = "E-D"
	sufijo  = str( i + 10) 
	name = prefijo + sufijo
	nombres2.append(name)


OUT = nombres,nombres2
# ----------------------------------------
flatten = List.Flatten(list=python_script)
setParameterByName = Element.SetParameterByName(element=getItemAtIndex, parameterName=code_block, value=flatten)
getParameterValueByName_2 = Element.GetParameterValueByName(element=getItemAtIndex, parameterName=code_block)
