# Dynamo graph SHEETSETREVISIONS.dyn (Dynamo 2.3.0.5885)

# group: SHEETS COLLECTOR
categories = Categories("OST_Sheets")
all_elements_of_category = ElementsOfCategory(Category=categories)

# group: GET DOCUMENT REVISIONS
python_script = Python()  # unwired: IN[0]
# ---------- python_script.python (27 lines) ----------
import clr
# Import Element wrapper extension methods
clr.AddReference("RevitNodes")
import Revit
clr.ImportExtensions(Revit.Elements)

# Import DocumentManager and TransactionManager
clr.AddReference("RevitServices")
import RevitServices
from RevitServices.Persistence import DocumentManager


# Import RevitAPI
clr.AddReference("RevitAPI")
import Autodesk
from Autodesk.Revit.DB import *
# The inputs to this node will be stored as a list in the IN variables.
dataEnteringNode = IN

doc = DocumentManager.Instance.CurrentDBDocument
revisiones = FilteredElementCollector(doc).OfCategory(BuiltInCategory.OST_Revisions).WhereElementIsNotElementType()
a = []
b=[]
for i in revisiones:
	a.append(i.Description)
	b.append(i)
OUT = a,b
# ----------------------------------------

code_block = CodeBlock { 1; }
getItemAtIndex = List.GetItemAtIndex(list=python_script, index=code_block)
code_block_2 = CodeBlock(L=getItemAtIndex) { L[1]; }
python_script_2 = Python(IN[0]=all_elements_of_category, IN[1]=code_block_2)
# ---------- python_script_2.python (38 lines) ----------
import clr
# Import Element wrapper extension methods
clr.AddReference("RevitNodes")
import Revit
clr.ImportExtensions(Revit.Elements)

# Import DocumentManager and TransactionManager
clr.AddReference("RevitServices")
import RevitServices
from RevitServices.Persistence import DocumentManager
from RevitServices.Transactions import TransactionManager

# Import RevitAPI
clr.AddReference("RevitAPI")
import Autodesk
from Autodesk.Revit.DB import *

import System
from System import Array
from System.Collections.Generic import *
# The inputs to this node will be stored as a list in the IN variables.
REVISION = UnwrapElement(IN[1])
planos = UnwrapElement(IN[0])

doc = DocumentManager.Instance.CurrentDBDocument

for i in planos:
	rev = i.GetAdditionalRevisionIds()
	if REVISION.Id not in rev:
		rev.Add(REVISION.Id)
	else:
		continue
	TransactionManager.Instance.EnsureInTransaction(doc)
	i.SetAdditionalRevisionIds(rev)
	TransactionManager.Instance.TransactionTaskDone()


OUT = planos
# ----------------------------------------
