# Dynamo graph SetCategoryFilteredParameter.dyn (Dynamo 2.3.0.5885)

python_script = Python()  # unwired: IN[0]
# ---------- python_script.python (35 lines) ----------
# Enable Python support and load DesignScript library
import clr
clr.AddReference('ProtoGeometry')
from Autodesk.DesignScript.Geometry import *

clr.AddReference("RevitNodes")

import Revit
clr.ImportExtensions(Revit.Elements)
clr.AddReference("RevitServices")

import RevitServices
from RevitServices.Persistence import DocumentManager
from RevitServices.Transactions import TransactionManager

clr.AddReference("RevitAPI")
from Autodesk.Revit.DB import *
import System

doc = DocumentManager.Instance.CurrentDBDocument

a = []
b =[]

elems = FilteredElementCollector(doc,doc.ActiveView.Id).WhereElementIsNotElementType().ToElements()
for i in elems:
	try:
		nombrescate = i.Category.Name
		a.append(i)
		b.append(nombrescate)
	except:
		b.append("IMPORT INSTANCES")


OUT = a,b
# ----------------------------------------
code_block = CodeBlock { 0; }
getItemAtIndex = List.GetItemAtIndex(list=python_script, index=code_block)
code_block_2 = CodeBlock { "AXM_Category"; }
code_block_3 = CodeBlock { 1; }
getItemAtIndex_2 = List.GetItemAtIndex(list=python_script, index=code_block_3)
setParameterByName = Element.SetParameterByName(element=getItemAtIndex, parameterName=code_block_2, value=getItemAtIndex_2)
