# Dynamo graph SetMaterialMarkfromExcel.dyn (Dynamo 2.3.0.5885)

archivo_xlsx = Filename("G:\Unidades compartidas\MANSUR\SURMAN PEDREGAL\01_RESIDENCIA MANSUR\01_AXM\01_MNSR_Project\01_BIM\19_BIM Schedules\02_Material Takeoff\MNSR_AXM_Materials.xlsx")  # graph input
file_from_path = FileObject(path=archivo_xlsx)
code_block = CodeBlock { "Hoja1"; }
boolean = BoolSelector(false)
importExcel = Data.ImportExcel(file=file_from_path, sheetName=code_block, showExcel=boolean)

# group: REORDER LIST PROPERTIES()
count = List.Count(list=importExcel)
code_block_2 = CodeBlock(final=count) { 8..(final-1); }
getItemAtIndex = List.GetItemAtIndex(list=importExcel, index=code_block_2)
code_block_3 = CodeBlock { 0..1; }
getItemAtIndex_2 = List.GetItemAtIndex(list=getItemAtIndex@L2, index=code_block_3)

code_block_4 = CodeBlock { 0; 1; }

# group: EXCEL OUTPUT
excel_materials = List.GetItemAtIndex(list=getItemAtIndex_2@L2, index=code_block_4.out1)
excel_mark_values = List.GetItemAtIndex(list=getItemAtIndex_2@L2, index=code_block_4.out0)

# group: engine
python_script = Python(IN[0]=excel_materials, IN[1]=excel_mark_values)
# ---------- python_script.python (48 lines) ----------
# Enable Python support and load DesignScript library
import clr
clr.AddReference('ProtoGeometry')
from Autodesk.DesignScript.Geometry import *

clr.AddReference("RevitNodes")

import Revit
clr.ImportExtensions(Revit.Elements)
clr.AddReference("RevitServices")

import RevitServices
from RevitServices.Persistence import DocumentManager
from RevitServices.Transactions import TransactionManager

clr.AddReference("RevitAPI")
from Autodesk.Revit.DB import *
import System

doc = DocumentManager.Instance.CurrentDBDocument

excelmats = IN[0]
claves = IN[1]

ele = FilteredElementCollector(doc).OfCategory(BuiltInCategory.OST_Materials)

nom =[]
clave = []

for i in ele:
	for ab,keys in zip(excelmats,claves):
		if i.Name == ab:
			nom.append(i)
			if(keys is None):
				clave.append("SIN VALOR")
			else:
				if(isinstance(keys,float) or isinstance(keys,int)):
					nn = str(keys)
					nna = nn.split(".",-1)
					#nnb = nna.split(".",-1)
					clave.append(nna[0])
				else:
					clave.append(keys)
			
			
	

OUT = nom,clave
# ----------------------------------------

code_block_5 = CodeBlock { 0; 1; }
getItemAtIndex_3 = List.GetItemAtIndex(list=python_script, index=code_block_5.out0)
code_block_6 = CodeBlock { "Mark"; }
getItemAtIndex_4 = List.GetItemAtIndex(list=python_script, index=code_block_5.out1)
setParameterByName = Element.SetParameterByName(element=getItemAtIndex_3, parameterName=code_block_6, value=getItemAtIndex_4)
