# Dynamo graph Cortes a 3D.dyn "Section_To3DView" (Dynamo 2.0.3.8104)

python_script = Python()  # unwired: IN[0]
# ---------- python_script.python (61 lines) ----------
import clr
clr.AddReference('ProtoGeometry')
from Autodesk.DesignScript.Geometry import *


clr.AddReference("RevitNodes")
import Revit
from Revit import Elements
clr.ImportExtensions(Revit.Elements)
clr.ImportExtensions(Revit.GeometryConversion)

clr.AddReference("RevitServices")
import RevitServices
from RevitServices.Persistence import DocumentManager
from RevitServices.Transactions import TransactionManager

from System.Collections.Generic import *

clr.AddReference("RevitAPI")
import Autodesk
from Autodesk.Revit.DB import *

doc = DocumentManager.Instance.CurrentDBDocument
collector = FilteredElementCollector(doc).OfClass(ViewFamilyType)

views = []
a = []
b= []
c=[]


c2 = FilteredElementCollector(doc).OfClass(ViewSection).WhereElementIsNotElementType()

for ele in c2:
	tipo = ele.LookupParameter('Type').AsValueString()
	if tipo == "Building Section":
		views.append(ele)
	else:
		pass
	

for view in views:
	crop_R = view.GetCropRegionShapeManager()
	curve = crop_R.GetCropShape()
	vector = view.ViewDirection.ToVector().Reverse()
	offset = view.LookupParameter('Far Clip Offset').AsDouble()
	points = []
	
	for i in curve[0]:
		start = i.GetEndPoint(0).ToPoint()
		points.append(start)
	
	curves = PolyCurve.ByPoints(points,True)
	
	a.append(curves)
	b.append(vector)
	c.append(offset)
	
	
OUT = a,b,c, views
	
# ----------------------------------------
code_block = CodeBlock { 0; 1; 2; 3; }
getItemAtIndex = List.GetItemAtIndex(list=python_script, index=code_block.out0)
getItemAtIndex_2 = List.GetItemAtIndex(list=python_script, index=code_block.out1)
getItemAtIndex_3 = List.GetItemAtIndex(list=python_script, index=code_block.out2)
extrudeAsSolid = Curve.ExtrudeAsSolid(curve=getItemAtIndex, direction=getItemAtIndex_2, distance=getItemAtIndex_3)
getItemAtIndex_4 = List.GetItemAtIndex(list=python_script, index=code_block.out3)
python_script_2 = Python(IN[0]=extrudeAsSolid, IN[1]=getItemAtIndex_4)
# ---------- python_script_2.python (58 lines) ----------
import clr
clr.AddReference('ProtoGeometry')
from Autodesk.DesignScript.Geometry import *


clr.AddReference("RevitNodes")
import Revit
from Revit import Elements
clr.ImportExtensions(Revit.Elements)
clr.ImportExtensions(Revit.GeometryConversion)

clr.AddReference("RevitServices")
import RevitServices
from RevitServices.Persistence import DocumentManager
from RevitServices.Transactions import TransactionManager

from System.Collections.Generic import *

clr.AddReference("RevitAPI")
import Autodesk
from Autodesk.Revit.DB import *

doc = DocumentManager.Instance.CurrentDBDocument
collector = FilteredElementCollector(doc).OfClass(ViewFamilyType)

for el in collector:
	if el.ViewFamily == ViewFamily.ThreeDimensional:
		viewType = el
		break

Solid = IN[0]
views = UnwrapElement(IN[1])
result = []

ll =zip(Solid,views)

TransactionManager.Instance.EnsureInTransaction(doc)

for el,view in ll:
	bbox = BoundingBox.ByGeometry(el).ToRevitType()
	view3D = View3D.CreateIsometric(doc,viewType.Id)
	view3D.ViewName = view.ViewName + "(SMK_ISO SECTION VIEW)"
	view3D.CropBox = bbox
	view3D.CropBoxActive = False
	view3D.CropBoxVisible = False
	view3D.SetSectionBox(bbox)
	view3D.Scale = 50
	result.append(view3D)
	
	
	


TransactionManager.Instance.TransactionTaskDone()


#Assign your output to the OUT variable
OUT = result
# ----------------------------------------
