# Dynamo graph SectionBoxXNivel.dyn "FloorPlan_To3DView" (Dynamo 2.0.3.8104)

# group: USER INTERFACE UI ()
code_block = CodeBlock { "ROOMS TO 3DVIEW"; }
file_path = Filename("..\..\UI\s+mk.png")
code_block_2 = CodeBlock { "GENERAR"; }
code_block_3 = CodeBlock { "SELECCIONAR NIVELES"; }
python_script = Python()  # unwired: IN[0]
# ---------- python_script.python (26 lines) ----------
# Enable Python support and load DesignScript library
import clr
clr.AddReference('ProtoGeometry')
from Autodesk.DesignScript.Geometry import *

clr.AddReference("RevitNodes")

import Revit
clr.ImportExtensions(Revit.Elements)
clr.AddReference("RevitServices")

import RevitServices
from RevitServices.Persistence import DocumentManager
from RevitServices.Transactions import TransactionManager

clr.AddReference("RevitAPI")
from Autodesk.Revit.DB import *
import System

doc = DocumentManager.Instance.CurrentDBDocument

colector = FilteredElementCollector(doc).OfCategory(BuiltInCategory.OST_Levels).WhereElementIsNotElementType().ToElements()



OUT = colector
# ----------------------------------------
ui_listview_data = Custom[UI.Listview Data](InputName=code_block_3, Keys_var=python_script, Values_var=python_script)  # Create data for ListView input in UI.MultiInputForm ++ . Check out www.data-shapes.net for more infos.
code_block_4 = CodeBlock { "OFFSET"; }
code_block_5 = CodeBlock { "200"; }
boolean = BoolSelector(true)
ui_textbox_data = Custom[UI.TextBox Data](InputName=code_block_4, DefaultText=code_block_5, IsNumberEntry=boolean)  # Create Data for TextBox input in UI.MultipleInputForm ++ . Check out www.data-shapes.net for more informations
code_block_6 = CodeBlock(A=ui_listview_data, B=ui_textbox_data) { L=[A,B]; }
boolean_2 = BoolSelector(true)
ui_multipleinputform = Custom[UI.MultipleInputForm ++](Description_optional=code_block, Logo_optional=file_path, ButtonText_optional=code_block_2, Inputs=code_block_6, Toggle=boolean_2)  # Create a form with multiple inputs. see www.data-shapes.net for tutorials and infos!

code_block_7 = CodeBlock(L=ui_multipleinputform.User_Inputs) { L[1]; }
code_block_8 = CodeBlock(L=ui_multipleinputform.User_Inputs) { L[0]; }
python_script_2 = Python(IN[0]=code_block_7, IN[1]=code_block_8)
# ---------- python_script_2.python (89 lines) ----------
import clr
clr.AddReference('ProtoGeometry')
from Autodesk.DesignScript.Geometry import *


clr.AddReference("RevitNodes")
import Revit
from Revit import Elements
clr.ImportExtensions(Revit.Elements)
clr.ImportExtensions(Revit.GeometryConversion)

clr.AddReference("RevitServices")
import RevitServices
from RevitServices.Persistence import DocumentManager
from RevitServices.Transactions import TransactionManager

from System.Collections.Generic import *

clr.AddReference("RevitAPI")
import Autodesk
from Autodesk.Revit.DB import *





doc = DocumentManager.Instance.CurrentDBDocument
collector = FilteredElementCollector(doc).OfClass(ViewFamilyType)

views = []

result = []

offset = IN[0]/304.8
levels = UnwrapElement(IN[1])

c2 = FilteredElementCollector(doc).OfClass(ViewPlan).WhereElementIsNotElementType()

for ele in c2:
	tipo = ele.LookupParameter('Type').AsValueString()
	
	if tipo == "Floor Plan":
		views.append(ele)
	else:
		pass

collector = FilteredElementCollector(doc).OfClass(ViewFamilyType)

for i in collector:
	if i.ViewFamily == ViewFamily.ThreeDimensional:
		viewType = i
		break
		
TransactionManager.Instance.EnsureInTransaction(doc)





number = []


for i in range(len(levels)):
	number.append(i)

for num,lev in zip(number,levels):
	View3d = View3D.CreateIsometric(doc,viewType.Id)
	View3d.Name = lev.Name + "SMK TOOLS VIEW"
	Bbox = BoundingBoxXYZ()
	Bbox.Min = XYZ(-80,-100, lev.Elevation-4)
	zoffset = 0
	
	if len(levels) > num+1:
		zoffset = levels[num].Elevation+13
	else:
		zoffset = lev.Elevation + 10
	Bbox.Max = XYZ(200,125,zoffset)
	View3d.SetSectionBox(Bbox)
	result.append(View3d)


TransactionManager.Instance.TransactionTaskDone()


OUT = result



	
# ----------------------------------------
